# Grasshopper definition Play_Ground.gh (Grasshopper 1.0.8)
# plug-ins: Design Tools

number_slider = Slider(10, range=0..50)
number_slider_2 = Slider(10, range=0..50)
circle = Circle(Radius=Slider(13, range=0..50), Number=Slider(9, range=0..50))  # -> Arcs, Points
number_slider_3 = Slider(20, range=0..50)
rectangle = Rectangle(X=Slider(20, range=0..50), Y=Slider(20, range=0..50), Radii=Slider(5, range=0..10), Blends=Slider(0.65, range=0..1), s=0)  # -> Curves, Joined, Points, Notes
xz = XZPlane(Origin=Point(0, 0, 0))
asterisk = Asterisk(Radius=5, Width=2, NumberOfArms=5, s=0)  # -> Curves, Joined, Points
pt = ConstructPoint(XCoordinate=0, YCoordinate=0, ZCoordinate=0)
pt_2 = ConstructPoint(XCoordinate=number_slider, YCoordinate=number_slider, ZCoordinate=number_slider)
vec = VectorXYZ(XComponent=Slider(0.5, range=0..1), YComponent=0, ZComponent=0)  # -> Vector, Length
vec_2 = VectorXYZ(XComponent=Slider(0.5, range=0..1), YComponent=0, ZComponent=0)  # -> Vector, Length
rectangle_2 = Rectangle(X=Slider(40, range=0..50), Y=Slider(30, range=0..50), Radii=Slider(10, range=0..10), s=0)  # -> Curves, Joined, Points, Notes
text_style = TextStyle(
    TextCase=Slider(0, range=0..3),
    Height=Slider(5, range=0..10),
    HorizontalAlign=Slider(0, range=0..2),
    VerticalAlign=Slider(0, range=0..2))
cylinder = Cylinder(Height=10, Sections=Slider(6, range=0..10), CapEnds=False, Centre=False, s=0)  # -> Brep, Profile, Circles, Arcs
cylinder_2 = Cylinder(
    TopAndBottomRadius=Slider(10, range=0..10),
    Height=Slider(30, range=0..50),
    Sections=Slider(4, range=0..10),
    Fillets=Slider(2, range=0..10),
    Blends=Slider(0, range=0..1),
    CapEnds=True,
    Centre=False,
    s=0)  # -> Brep, Profile, Circles, Arcs
rectangle_3 = Rectangle(X=10, Y=10, s=0)  # -> Curves, Joined, Points, Notes
cube = Cube(X=Slider(20, range=0..50), centre=True)
rectangle_4 = Rectangle(X=Slider(20, range=0..50), Y=Slider(20, range=0..50), Radii=Slider(5, range=0..10), Blends=Slider(0.65, range=0..1), s=0)  # -> Curves, Joined, Points, Notes
number_slider_4 = Slider(10, range=0..10)
item = ListItem(List=circle.Arcs, Index=Slider(6, range=0..50), Wrap=True)
rectangle_5 = Rectangle(X=number_slider_2, Y=number_slider_2, Radii=Slider(2, range=0..10), s=0)  # -> Curves, Joined, Points, Notes
surface = Surface(Plane=xz, X=Slider(20, range=0..50), Y=Slider(10, range=0..50), s=0)
arrow = Arrow(
    Length=Slider(20, range=0..50),
    Width=Slider(3, range=0..10),
    Head=Slider(3, range=0..10),
    Barb=Slider(1, range=0..10),
    ends=False)  # -> Curves, Joined, Hatch, Points
arc_arrow = ArcArrow(
    Radius=Slider(10, range=0..50),
    Angle=Slider(90, range=0..100),
    Width=Slider(3, range=0..10),
    Head=Slider(3, range=0..10),
    Barb=Slider(1, range=0..10),
    centre=False,
    ends=True)  # -> Curves, Joined, Hatch, Points
pear = Pear(
    RadiusA=Slider(2.8, range=0..10),
    RadiusB=Slider(5, range=0..10),
    Gap=Slider(5, range=0..10),
    Orient=Slider(0, range=0..10),
    position=1)  # -> Curves, Joined, Centres, GapPoints
cog = Cog(
    Radius=Slider(10, range=0..10),
    Segments=Slider(6, range=0..10),
    Angle=Slider(0, range=0..1),
    Offset=Slider(1.1, range=0..10),
    Extend=Slider(0.5, range=0..1),
    s=0)  # -> Curves, Joined, Points, Notes
rectangle_6 = Rectangle(X=Slider(20, range=0..50), Y=Slider(20, range=0..50), Radii=Slider(5, range=0..10), Blends=Slider(0.65, range=0..1), s=0)  # -> Curves, Joined, Points, Notes
rectangle_7 = Rectangle(X=10, Y=10, s=0)  # -> Curves, Joined, Points, Notes
cube_2 = Cube(centre=False)
rectangle_8 = Rectangle(X=Slider(20, range=0..50), Y=Slider(20, range=0..50), Radii=Slider(5, range=0..10), Blends=Slider(0.65, range=0..1), s=0)  # -> Curves, Joined, Points, Notes
quad = Quadrilateral(X=Slider(20, range=0..50), Y=Slider(20, range=0..50), Insets=Slider(10, range=0..10), shape=0)  # -> Curves, Joined, Points
asterisk_2 = Asterisk(Radius=Slider(10, range=0..10), Width=Slider(3.4, range=0..10), NumberOfArms=Slider(6, range=0..10), s=0)  # -> Curves, Joined, Points
polygon = Polygon(
    Radius=Slider(10, range=0..10),
    Sides=Slider(6, range=0..10),
    Fillet=Slider(4, range=0..10),
    Blend=Slider(0.68, range=0..1),
    Match=Toggle(True),
    s=0)  # -> Curves, Joined, Circle, Centres, Points
rectangle_9 = Rectangle(
    X=Slider(20, range=0..50),
    Y=Slider(20, range=0..50),
    Radii=[Slider(5, range=0..10), Slider(7.5, range=0..10), Slider(1.7, range=0..10), Slider(0, range=0..10)],
    Blends=[Slider(0.65, range=0..1), Slider(0.65, range=0..1), Slider(0.65, range=0..1), Slider(0.65, range=0..1)],
    s=0)  # -> Curves, Joined, Points, Notes
star = Star(RadiusA=Slider(10, range=0..10), RadiusB=Slider(5.6, range=0..10), NumberOfPoints=Slider(6, range=0..10))  # -> Curves, Joined, Points
asterisk_3 = Asterisk(Radius=5, Width=2, NumberOfArms=5, s=0)  # -> Curves, Joined, Points
circle_2 = Circle(Radius=Slider(5, range=0..10), Number=Slider(4, range=0..10))  # -> Arcs, Points
rectangle_10 = Rectangle(X=Slider(20, range=0..50), Y=10, Radii=Slider(3, range=0..10), s=0)  # -> Curves, Joined, Points, Notes
pill = Pill(X=Slider(20, range=0..50), Y=Slider(5, range=0..10), Orient=Slider(0, range=0..10), p_width=False, smooth=False)  # -> Curves, Joined, Pivots
rectangle_11 = Rectangle(X=number_slider_3, Y=number_slider_3, Radii=Slider(3.6, range=0..10), s=0)  # -> Curves, Joined, Points, Notes
rectangle_12 = Rectangle(X=10, Y=10, s=0)  # -> Curves, Joined, Points, Notes
groove = Groove(
    Length=Slider(20, range=0..50),
    Radius=Slider(10, range=0..50),
    Depth=Slider(4, range=0..10),
    Fillet=Slider(2, range=0..10),
    Blend=Slider(0.6, range=0..1),
    smooth=False)  # -> Brep, Curves, Profile
number_slider_5 = Slider(10, range=0..10)
xy = XYPlane(Origin=Point(0, 0, 0))
dom = ConstructDomain(DomainStart=Slider(0.3, range=0..10), DomainEnd=Slider(3, range=0..10))
rectangle_13 = Rectangle(X=Slider(20, range=0..50), Y=Slider(20, range=0..50), Radii=Slider(5, range=0..10), Blends=Slider(0.65, range=0..1), s=0)  # -> Curves, Joined, Points, Notes
rectangle_14 = Rectangle(X=Slider(20, range=0..50), Y=Slider(20, range=0..50), Radii=Slider(5, range=0..10), Blends=Slider(0.65, range=0..1), s=0)  # -> Curves, Joined, Points, Notes
pt_3 = ConstructPoint(XCoordinate=Slider(3.2, range=0..10), YCoordinate=0, ZCoordinate=0)
cube_3 = Cube(X=Slider(20, range=0..50), centre=True)
debrep = DeconstructBrep(Brep=cylinder.Brep)  # -> Faces, Edges, Vertices
cube_4 = Cube(X=Slider(20, range=0..50), centre=True)
extrude_indent = ExtrudeIndent(
    Curves=rectangle.Curves,
    Fillets=[Slider(3, range=0..10), Slider(0.8, range=0..10)],
    Extrude=Slider(13, range=0..50),
    Inset=0,
    Flip=Toggle(True),
    s=0)  # -> Breps, Planes, EdgesA, EdgesB, Notes
pt_4 = ConstructPoint(XCoordinate=Slider(10, range=0..10), YCoordinate=0, ZCoordinate=0)
pop2d = Populate2D(Region=rectangle_3.Joined, Count=Slider(3, range=0..10), Seed=1)
cube_5 = Cube(X=Slider(20, range=0..50), centre=True)
N = Nudge(Geometry=cube_2, AxisIdx=2, ValIdx=2)
random = Random(Range=dom, Number=Slider(20, range=0..50), Seed=2)
item_2 = ListItem(List=rectangle_4.Curves, Index=0, Wrap=True)  # -> Item, Item1, Item2
text = Text(Text="Sample Text", Plane=xy, Style=text_style)  # -> Curves, Hatches, Bounds
blend_curve = Blend_Curve(
    StartPoint=pt,
    EndPoint=pt_2,
    StartVector=vec.Vector,
    EndVector=vec_2.Vector,
    AngleAtStart=Slider(0, range=0..1),
    AngleAtEnd=Slider(0, range=0..1),
    StartCurve=0,
    EndCurve=0,
    StartBlend=Slider(0.86, range=0..1),
    EndBlend=Slider(0.68, range=0..1))
pop2d_2 = Populate2D(Region=rectangle_7.Joined, Count=100, Seed=1)
cube_6 = Cube(centre=True)
Y = UnitY(Factor=1)
yz = YZPlane(Origin=pt_3)
item_3 = ListItem(List=debrep.Faces, Index=0, Wrap=True)  # -> Item, Item1, Item2
pt_5 = ConstructPoint(XCoordinate=number_slider_4, YCoordinate=number_slider_4, ZCoordinate=number_slider_4)
pop3d = Populate3D(Region=cube_3, Count=Slider(5, range=0..50), Seed=1)
pop3d_2 = Populate3D(Region=cube_4, Count=Slider(5, range=0..50), Seed=1)
number_slider_6 = Slider(1, range=0..10)
number_slider_7 = Slider(0.63, range=0..1)
split = SplitList(List=rectangle_8.Curves, Index=Slider(4, range=0..10))  # -> ListA, ListB
yz_2 = YZPlane(Origin=Point(0, 0, 0))
pop3d_3 = Populate3D(Region=cube_5, Count=100, Seed=1)
sweep = Sweep(Rails=rectangle_2.Curves, Profile=item, Origin=pt_4, Sectors=Slider(15, range=0..50), cap=True)  # -> Breps, Curves, Notes
locate = Locate(Geometry=sweep.Breps, InsetU=0, InsetV=0, OffsetW=Slider(4, range=0..10), box=True, simple=False)  # -> Plane, Surface, Edges, Body, Notes
place = Place(Geometry=rectangle_5.Curves, Plane=locate.Plane)  # -> Geometry, Transform
number_slider_8 = Slider(8, range=0..50)
number_slider_9 = Slider(0, range=0..2)
cube_7 = Cube(X=Slider(30, range=0..50), centre=True)
number_slider_10 = Slider(0, range=0..2)
avg = AveragePoint(Points=pop2d)
toggle = BooleanToggle(False)
locate_2 = Locate(Geometry=extrude_indent.Breps, Face=Slider(9, range=0..10), InsetU=0, InsetV=0, OffsetW=0, box=False, simple=False)  # -> Plane, Surface, Edges, Body, Notes
pt_6 = ConstructPoint(XCoordinate=number_slider_5, YCoordinate=number_slider_5, ZCoordinate=number_slider_5)
revolve = Revolve(
    Curves=[item_2.Item, item_2.Item1, item_2.Item2],
    Angle=Slider(180, range=0..360),
    Axis=Y,
    end_cap=False,
    start_cap=False)  # -> Revolve, Joined
sph = Sphere(Base=pop2d_2, Radius=random)
sph_2 = Sphere(Base=pop3d, Radius=1)
extrude_indent_2 = ExtrudeIndent(
    Curves=rectangle_6.Curves,
    Fillets=[Slider(3, range=0..10), Slider(0.8, range=0..10)],
    Extrude=Slider(13, range=0..50),
    Inset=0,
    Flip=False,
    s=0)  # -> Breps, Planes, EdgesA, EdgesB, Notes
sph_3 = Sphere(Base=pop3d_2, Radius=1)
move = Move(Geometry=cube_6, Motion=pt_5)  # -> Geometry, Transform
resize = Resize(Geometry=asterisk_3.Curves, Refs=rectangle_10.Curves, X=Toggle(True), align=False, match=True, union=True)  # -> Geometry, Planes, Scales, Moves, Notes
resize_2 = Resize(Geometry=asterisk.Curves, X=Slider(6.1, range=0..10), Y=Slider(2.3, range=0..10), align=False, match=False, union=True)  # -> Geometry, Planes, Scales, Moves, Notes
sph_4 = Sphere(Base=pop3d_3, Radius=1)
surface_2 = Surface(Curves=text.Curves, s=0)
re_rectangle = Re_rectangle(Geometry=place.Geometry, Offset=Slider(6.6, range=0..10), s=0)  # -> Curves, Offsets, Joined, Points, Values, Notes
extrude_indent_3 = ExtrudeIndent(
    Curves=rectangle_13.Curves,
    Fillets=[Slider(3, range=0..10), Slider(0, range=0..10)],
    Extrude=Slider(13, range=0..50),
    Inset=0,
    Flip=Toggle(True),
    s=0)  # -> Breps, Planes, EdgesA, EdgesB, Notes
extrude_indent_4 = ExtrudeIndent(
    Curves=rectangle_14.Curves,
    Fillets=[Slider(3, range=0..10), Slider(0.8, range=0..10)],
    Extrude=Slider(13, range=0..50),
    Inset=0,
    Flip=Toggle(True),
    s=0)  # -> Breps, Planes, EdgesA, EdgesB, Notes
blend_surface = BlendSurface(
    BrepA=item_3.Item,
    BrepB=item_3.Item2,
    EdgeA=Slider(1, range=0..10),
    EdgeB=Slider(3, range=0..10),
    BlendA=Slider(0.5, range=0..1),
    BlendB=Slider(0.5, range=0..1),
    NumberOfSections=Slider(10, range=0..20))
move_2 = Move(Geometry=cube_7, Motion=pt_6)  # -> Geometry, Transform
size = SizeSelect(Geometry=sph, s=0)  # -> Piece, Others
size_2 = SizeSelect(Geometry=sph, s=1)  # -> Piece, Others
xy_2 = XYPlane(Origin=Point(0, 0, 0))
xy_3 = XYPlane(Origin=Point(0, 0, 0))
xy_4 = XYPlane(Origin=Point(0, 0, 0))
xy_5 = XYPlane(Origin=Point(0, 0, 0))
boundry = Bounding_curve(Geometry=asterisk_2.Curves, Inflate=Slider(3.4, range=0..10), Plane=Slider(6, range=0..10), s=0)  # -> Curves, Plane, Notes
fillet = FilletCurves(
    Curves=rectangle_12.Curves,
    Radii=[Slider(3, range=0..10), Slider(3, range=0..10), Slider(3, range=0..10), Slider(3, range=0..10)],
    Blends=Slider(0.5, range=0..1),
    all=False,
    bully=False,
    clean=False)  # -> Curves, Joined
re_rectangle_2 = Re_rectangle(Geometry=rectangle_9.Curves, Offset=Slider(2.9, range=0..10), Radii=Slider(1.2, range=0..10), s=0)  # -> Curves, Offsets, Joined, Points, Values, Notes
distribute = Distribute(
    Geometry=sph_2,
    X=Slider(0, range=0..10),
    Y=Slider(0, range=0..10),
    Z=Slider(0, range=0..10),
    Insets=Slider(0, range=0..10),
    align=False,
    centre=0,
    order=True)  # -> Geometry, Moves, Notes
split_curves = SplitCurves(
    Curves=rectangle_11.Curves,
    Planes=[yz_2, yz],
    Fillet=Slider(0.8, range=0..1),
    Blend=0.65,
    Gap=Slider(0.5, range=0..1),
    close=True)  # -> Curves, Joined, Points
cent = Centre(Geometry=move.Geometry, Location=Slider(0, range=0..10), s=0)  # -> Geometry, Moves
debrep_2 = DeconstructBrep(Brep=extrude_indent_4.Breps)  # -> Faces, Edges, Vertices
align = Align(Geometry=sph_3, X=Slider(0, range=0..2), Inset=Slider(0, range=0..10), Centre=False, Union=False)  # -> Geometry, Moves, Notes
cube_8 = Cube(centre=True)
select = PlaneSelect(Geometry=sph_4, Plane=xy_2, mode=0, s=0)  # -> GeometryInside, GeometryOutside, Pattern
select_2 = PlaneSelect(Geometry=extrude_indent_3.Breps, Plane=xy_3, mode=2, s=0)  # -> GeometryInside, GeometryOutside, Pattern
select_3 = PlaneSelect(Geometry=extrude_indent_3.Breps, Plane=xy_4, mode=1, s=0)  # -> GeometryInside, GeometryOutside, Pattern
pt_7 = ConstructPoint(XCoordinate=number_slider_8, YCoordinate=number_slider_8, ZCoordinate=number_slider_8)
dims = Dimensions(Geometry=surface_2)  # -> X, Y, Z
split_brep = SplitBrep(
    Brep=extrude_indent.Breps,
    Plane=xy_5,
    Fillet=Slider(1, range=0..10),
    Blend=Slider(0.65, range=0..1),
    Flip=Toggle(False),
    cap=True,
    match=False)  # -> Breps, Curves
volcano_curved = CurvedVolcano(
    Brep=sweep.Breps,
    Curves=place.Geometry,
    Offset=Slider(4, range=0..10),
    Angle=Slider(3.8, range=0..10),
    BlendA=Slider(0.5, range=0..1),
    BlendB=Slider(0.5, range=0..1),
    Fillet=Slider(0.5, range=0..1),
    Blend=0.68,
    cap=True,
    from_edge=False,
    s=3)  # -> Brep, Planes, TopCurves, MidCurves, BottomCurves, FilletCurves, SideCurves
volcano_curved_2 = CurvedVolcano(
    Brep=sweep.Breps,
    Curves=place.Geometry,
    Outer=re_rectangle.Offsets,
    Angle=Slider(38, range=0..50),
    Blend=0.68,
    cap=True,
    from_edge=False,
    s=3)  # -> Brep, Planes, TopCurves, MidCurves, BottomCurves, FilletCurves, SideCurves
number_slider_11 = Slider(0, range=0..10)
geo = Geometry(size.Piece)
geo_2 = Geometry(size_2.Piece)
C = CentrePoint(Geometry=debrep_2.Faces, s=1)
neg = Negative(Value=Slider(7, range=0..10))
sausage = Sausage(
    Curves=split.ListA,
    Width=Slider(5, range=0..10),
    Head=Slider(6.3, range=0..10),
    Barb=Slider(1.9, range=0..10),
    Start=Slider(0, range=0..10),
    End=Slider(2, range=0..10))  # -> Curves, Joined, Hatch, Notes
move_3 = Move(Geometry=cube_8, Motion=pt_7)  # -> Geometry, Transform
align_2 = Align(
    Geometry=sph_3,
    Reference=move_2.Geometry,
    X=Slider(0, range=0..2),
    Y=Slider(0, range=0..2),
    Z=Slider(0, range=0..2),
    Inset=Slider(0, range=0..10),
    Centre=False,
    Union=True)  # -> Geometry, Moves, Notes
geo_3 = Geometry(select_2.GeometryInside)
geo_4 = Geometry(select_3.GeometryInside)
geo_5 = Geometry(select.GeometryInside)
C_2 = CentrePoint(Geometry=split_curves.Joined, s=0)
sph_5 = Sphere(Base=C, Radius=1)
split_brep_2 = SplitBrep(Brep=extrude_indent_3.Breps, Fillet=0, Blend=0.68, Flip=False, cap=False, match=False)  # -> Breps, Curves
extend = Extend_Curve(Curve=blend_curve, Start=Slider(3, range=0..10), End=neg, proportional=False)
extrude_indent_5 = ExtrudeIndent(
    Curves=extrude_indent_2.EdgesB,
    Brep=extrude_indent_2.Breps,
    Fillets=Slider(0.7, range=0..10),
    Inset=Slider(3.5, range=0..10),
    Flip=Toggle(True),
    s=0)  # -> Breps, Planes, EdgesA, EdgesB, Notes
extrude_indent_6 = ExtrudeIndent(
    Curves=extrude_indent_2.EdgesB,
    Brep=extrude_indent_2.Breps,
    Fillets=Slider(0.7, range=0..10),
    Inset=Slider(3.5, range=0..10),
    Flip=False,
    s=0)  # -> Breps, Planes, EdgesA, EdgesB, Notes
extrude_indent_7 = ExtrudeIndent(
    Curves=extrude_indent_2.EdgesB,
    Brep=extrude_indent_2.Breps,
    Fillets=Slider(0.7, range=0..10),
    Extrude=Slider(2, range=0..10),
    Inset=Slider(2, range=0..10),
    Flip=False,
    s=0)  # -> Breps, Planes, EdgesA, EdgesB, Notes
extend_2 = ExtendSurface(Surface=locate_2.Surface, Length=Slider(3, range=0..10))  # -> Surface, Notes
zebra = Zebra(Brep=volcano_curved.Brep, Scale=1, Rotate=0)
optimize = Optimize(Brep=volcano_curved_2.Brep, compact=False, merge_edges=False, merge_faces=False, shrink_face=False, solid_orient=False)
select_4 = BoxSelect(Geometry=sph_5, Boxes=move_3.Geometry, Inflate=Slider(3, range=0..10), s=0, sel=0, xy=False)  # -> GeometryInside, GeometryOutside, Pattern
select_5 = BoxSelect(Geometry=extrude_indent_4.Breps, Boxes=move_3.Geometry, Inflate=Slider(3, range=0..10), s=0, sel=1, xy=False)  # -> GeometryInside, GeometryOutside, Pattern
select_6 = BoxSelect(Geometry=extrude_indent_4.Breps, Boxes=move_3.Geometry, Inflate=Slider(3, range=0..10), s=0, sel=2, xy=False)  # -> GeometryInside, GeometryOutside, Pattern
edges = Edges(Brep=split_brep_2.Breps, Tolerance=0.0175, loop=False, naked=True, sharp=False, show=True, smooth=False)  # -> EdgeCurves, EdgeNumbers
edges_2 = Edges(Brep=split_brep_2.Breps, Tolerance=0.0175, loop=False, naked=True, sharp=False, show=True, smooth=True)  # -> EdgeCurves, EdgeNumbers
edges_3 = Edges(Brep=split_brep_2.Breps, Tolerance=0.0175, loop=False, naked=False, sharp=True, show=False, smooth=False)  # -> EdgeCurves, EdgeNumbers
geo_6 = Geometry(select_4.GeometryInside)
geo_7 = Geometry(select_5.GeometryInside)
geo_8 = Geometry(select_6.GeometryInside)
