# Grasshopper definition Shelf_grid_layout.gh (Grasshopper 1.0.8)
# plug-ins: Design Tools, Design Extras

shelf_sizes = FilePath("/Users/ashleycichocki/Documents/DesignTools/Shelf_sizes.csv")
csv = CSharpLegacy(read=Button(), csv=shelf_sizes)  # -> strings; inputs read: Boolean, csv: String
# ---------- csv: C# usings ----------
using System.IO;
using System.Linq;
# ---------- csv: C# ----------
    // Updated 2025-05-20
    
    if (no_input("csv")) return;

    if (read)
    {
      dataList.Clear();
      dataList = File.ReadAllLines(csv).Skip(1).ToList();// Read all lines from the CSV file except the first
    }

    if (csv.ToLower().Contains("mapping")){
      for (int i = 0; i < dataList.Count; i++)
      {
          dataList[i] = dataList[i].Replace("surface", "0")
                                    .Replace("planar_a", "1")
                                    .Replace("planar_b", "2")
                                    .Replace("planar_c", "3")
                                    .Replace("planar_d", "4")
                                    .Replace("box_a", "5")
                                    .Replace("box_b", "6")
                                    .Replace("box_c", "7")
                                    .Replace("cylindrical", "8")
                                    .Replace("spherical", "9");
      }
    }

    strings = dataList;
# ---------- csv: C# additional code ----------
  List<string> dataList = new List<string>();

  public bool no_input(string name) => Component.Params.Input[Component.Params.IndexOfInputParam(name)].SourceCount == 0;
# ---------- end csv ----------
split = TextSplit(Text=csv, Separators=",")
number_slider = Slider(0, range=0..10)
item = ListItem(List=split, Index=0, Wrap=True)  # -> Item, flatten(Item1), flatten(Item2)
split_2 = SplitList(List=item.Item1, Index=Slider(12, range=0..12))  # -> ListA, ListB
item_2 = ListItem(List=item.Item2, Index=0, Wrap=True)
panel = Panel(item_2)
rectangle = Rectangle(x=Slider(67, range=0..100), y=Slider(43, range=0..100))  # -> rect, joined, points, notes; inputs x: Double, y: Double, radii: list of Double, bend: Double
# ---------- rectangle: C# usings ----------
using System.Linq;
# ---------- rectangle: C# ----------
    if (no_input("x")) x = 20;
    if (no_input("y")) y = 20;
    if (no_input("bend")) bend = 0.72;

    const int degree = 6;
    const int ptnum = 4;
    const double tol = 0.01;

    points = corner_pts(x, y);

    if (Component.Params.Input[2].SourceCount == 0)
    {
      Curve[] r = rectangle(x, y);
      rect = r.Select(c => new GH_Curve(c));
      joined = new GH_Curve(Curve.JoinCurves(r, tol)[0]);
    }
    else
    {
      if (radii.Count == 1) radii.AddRange(new[] { radii[0], radii[0], radii[0] });
      else if (radii.Count == 2) radii.AddRange(new[] { radii[1], radii[0] });
      else if (radii.Count == 3) radii.Add(radii[2]);

      for (int i = 0; i < 4; i++) if (radii[i] < 0) radii[i] *= -1.5;

      if (bend == 0)
      {
        Curve[] r = chamfer(x, y, radii[0], radii[1], radii[2], radii[3]);
        rect = r.Select(c => new GH_Curve(c));
        joined = new GH_Curve(Curve.JoinCurves(r, tol)[0]);
      }
      else if (bend >= 1)
      {
        Curve[] r = multi_arc_rectangle(x, y, radii[0], radii[1], radii[2], radii[3]);
        rect = r.Select(c => new GH_Curve(c));
        joined = new GH_Curve(Curve.JoinCurves(r, tol)[0]);
      }
      else
      {
        Curve[] r = multi_rectangle(x, y, radii[0], radii[1], radii[2], radii[3], bend, ptnum, degree);
        rect = r.Select(c => new GH_Curve(c));
        joined = new GH_Curve(Curve.JoinCurves(r, tol)[0]);
      }
    }


    string[] note_list = {
      "-ve radii will give true arc values if bend = 0.72",
      "No radii input, gives a Simple Rectangle",
      "1 radii input, gives a Rectangle with C2 corners (all the same)",
      "Multi radii input, gives rectangle with multi corner sizes",
      "Bend at 0 plus radii input, gives a chamfered rectangle",
      "Bend at 1 plus radii input, gives a rectangle with arc corners"
    };

    notes = note_list;
# ---------- rectangle: C# additional code ----------
  private bool no_input(string name)
  {
    string[] names = Component.Params.Input.Select(x => x.NickName.Trim()).ToArray();
    int input_idx = Array.IndexOf(names, name);
    return Component.Params.Input[input_idx].SourceCount == 0;
  }


  GH_Point[] corner_pts (double x, double y)
  {
    x *= 0.5;
    y *= 0.5;

    GH_Point[] pts = {
      new GH_Point(new Point3d(-x, -y, 0)),
      new GH_Point(new Point3d(-x, y, 0)),
      new GH_Point(new Point3d(x, y, 0)),
      new GH_Point(new Point3d(x, -y, 0))
      };

    return pts;
  }

  private Curve[] chamfer(double x, double y, double radA, double radB, double radC, double radD)
  {

    x *= 0.5;
    y *= 0.5;

    //Curve c = new Curve[8];
    List<Curve> curves = new List<Curve>();
    if (radA != 0)
    {
      Curve c = new Line(new Point3d(radA, 0, 0), new Point3d(0, radA, 0)).ToNurbsCurve();
      c.Transform(Transform.Translation(-x, -y, 0));
      curves.Add(c);
    }

    curves.Add(new Line(new Point3d(-x, radA - y, 0), new Point3d(-x, y - radB, 0)).ToNurbsCurve());

    if (radB != 0)
    {
      Curve c = new Line(new Point3d(radB, 0, 0), new Point3d(0, radB, 0)).ToNurbsCurve();
      c.Transform(Transform.Rotation(Math.PI * 1.5, Point3d.Origin));
      c.Transform(Transform.Translation(-x, y, 0));
      curves.Add(c);
    }

    curves.Add(new Line(new Point3d(radB - x, y, 0), new Point3d(x - radC, y, 0)).ToNurbsCurve());

    if (radC != 0)
    {
      Curve c = new Line(new Point3d(radC, 0, 0), new Point3d(0, radC, 0)).ToNurbsCurve();
      c.Transform(Transform.Rotation(Math.PI, Point3d.Origin));
      c.Transform(Transform.Translation(x, y, 0));
      curves.Add(c);
    }

    curves.Add(new Line(new Point3d(x, y - radC, 0), new Point3d(x, radD - y, 0)).ToNurbsCurve());

    if (radD != 0)
    {
      Curve c = new Line(new Point3d(radD, 0, 0), new Point3d(0, radD, 0)).ToNurbsCurve();
      c.Transform(Transform.Rotation(Math.PI * 0.5, Point3d.Origin));
      c.Transform(Transform.Translation(x, -y, 0));
      curves.Add(c);
    }

    curves.Add(new Line(new Point3d(x - radD, -y, 0), new Point3d(radA - x, -y, 0)).ToNurbsCurve());


    return curves.ToArray(); //.Select(c => new GH_Curve(c)).ToArray();


  }


  Curve[] rectangle(double x, double y)
  {
    x *= 0.5;
    y *= 0.5;

    Point3d[] pts = {
      new Point3d(-x, -y, 0),
      new Point3d(-x, y, 0),
      new Point3d(x, y, 0),
      new Point3d(x, -y, 0)
      };

    NurbsCurve[] lines = {
      new Line(pts[0], pts[1]).ToNurbsCurve(),
      new Line(pts[1], pts[2]).ToNurbsCurve(),
      new Line(pts[2], pts[3]).ToNurbsCurve(),
      new Line(pts[3], pts[0]).ToNurbsCurve(),
      };

    return lines;

  }


  Curve corner(double radius, double bend, int ptnum, int degree)
  {
    double offset = (radius * bend) / (ptnum - 1);

    Point3d[] corner_points = new Point3d[ptnum * 2];

    for (int i = 0; i < ptnum; i++)
    {
      double ratioA = radius - (i * offset);
      double ratioB = radius - ((ptnum - i - 1) * offset);
      corner_points[i] = new Point3d(ratioA, 0, 0);
      corner_points[i + ptnum] = new Point3d(0, ratioB, 0);
    }

    Curve c = NurbsCurve.Create(false, degree, corner_points);
    c.Domain = new Interval(0, 1);

    return c;
  }

  Curve[] multi_rectangle(double x, double y, double radA, double radB, double radC, double radD, double bend, int ptnum, int degree)
  {
    x *= 0.5;
    y *= 0.5;

    //Curve c = new Curve[8];
    List<Curve> curves = new List<Curve>();
    if (radA != 0)
    {
      Curve c = corner(radA, bend, ptnum, degree);
      c.Transform(Transform.Translation(-x, -y, 0));
      curves.Add(c);
    }

    curves.Add(new Line(new Point3d(-x, radA - y, 0), new Point3d(-x, y - radB, 0)).ToNurbsCurve());

    if (radB != 0)
    {
      Curve c = corner(radB, bend, ptnum, degree);
      c.Transform(Transform.Rotation(Math.PI * 1.5, Point3d.Origin));
      c.Transform(Transform.Translation(-x, y, 0));
      curves.Add(c);
    }

    curves.Add(new Line(new Point3d(radB - x, y, 0), new Point3d(x - radC, y, 0)).ToNurbsCurve());

    if (radC != 0)
    {
      Curve c = corner(radC, bend, ptnum, degree);
      c.Transform(Transform.Rotation(Math.PI, Point3d.Origin));
      c.Transform(Transform.Translation(x, y, 0));
      curves.Add(c);
    }

    curves.Add(new Line(new Point3d(x, y - radC, 0), new Point3d(x, radD - y, 0)).ToNurbsCurve());

    if (radD != 0)
    {
      Curve c = corner(radD, bend, ptnum, degree);
      c.Transform(Transform.Rotation(Math.PI * 0.5, Point3d.Origin));
      c.Transform(Transform.Translation(x, -y, 0));
      curves.Add(c);
    }

    curves.Add(new Line(new Point3d(x - radD, -y, 0), new Point3d(radA - x, -y, 0)).ToNurbsCurve());


    return curves.ToArray(); //.Select(c => new GH_Curve(c)).ToArray();
  }

  Curve[] multi_arc_rectangle(double x, double y, double radA, double radB, double radC, double radD)
  {
    x *= 0.5;
    y *= 0.5;

    List<Curve> curves = new List<Curve>();
    if (radA != 0)
    {
      Curve c = new Arc(new Point3d(radA, 0, 0), -Vector3d.XAxis, new Point3d(0, radA, 0)).ToNurbsCurve();
      c.Transform(Transform.Translation(-x, -y, 0));
      curves.Add(c);
    }

    curves.Add(new Line(new Point3d(-x, radA - y, 0), new Point3d(-x, y - radB, 0)).ToNurbsCurve());

    if (radB != 0)
    {
      Curve c = new Arc(new Point3d(radB, 0, 0), -Vector3d.XAxis, new Point3d(0, radB, 0)).ToNurbsCurve();
      c.Transform(Transform.Rotation(Math.PI * 1.5, Point3d.Origin));
      c.Transform(Transform.Translation(-x, y, 0));
      curves.Add(c);
    }

    curves.Add(new Line(new Point3d(radB - x, y, 0), new Point3d(x - radC, y, 0)).ToNurbsCurve());

    if (radC != 0)
    {
      Curve c = new Arc(new Point3d(radC, 0, 0), -Vector3d.XAxis, new Point3d(0, radC, 0)).ToNurbsCurve();
      c.Transform(Transform.Rotation(Math.PI, Point3d.Origin));
      c.Transform(Transform.Translation(x, y, 0));
      curves.Add(c);
    }

    curves.Add(new Line(new Point3d(x, y - radC, 0), new Point3d(x, radD - y, 0)).ToNurbsCurve());

    if (radD != 0)
    {
      Curve c = new Arc(new Point3d(radD, 0, 0), -Vector3d.XAxis, new Point3d(0, radD, 0)).ToNurbsCurve();
      c.Transform(Transform.Rotation(Math.PI * 0.5, Point3d.Origin));
      c.Transform(Transform.Translation(x, -y, 0));
      curves.Add(c);
    }

    curves.Add(new Line(new Point3d(x - radD, -y, 0), new Point3d(radA - x, -y, 0)).ToNurbsCurve());

    Interval interval = new Interval(0, 1);

    for (int i = 0; i < curves.Count; i++)
    {
      curves[i].Domain = interval;
    }

    return curves.ToArray(); //.Select(c => new GH_Curve(c)).ToArray();

  }
# ---------- end rectangle ----------
number_slider_2 = Slider(6, range=0..100)
panel_2 = Panel(split_2.ListA)
rectangle_2 = Rectangle(X=split_2.ListA, Y=item_2, s=0)  # -> Curves, Joined, Points, Notes
number_slider_3 = Slider(44, range=0..100)
x = X(expr("-x", number_slider_2))
item_3 = ListItem(List=rectangle_2.Joined, Index=0, Wrap=True)  # -> Item, Item1, Item2, Item3, Item4, Item5, Item6, Item7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
panel_3 = Panel("""2,5
2,5
2,5""")
origin = Origin(Point(0, 0, 0))
number_slider_4 = Slider(500, range=0..1000)
subtraction = Subtraction(A=number_slider_4, B=item_2)
num = Number(subtraction)
panel_4 = Panel(num)
grid = CSharpScript(rect=rectangle.rect, inset=Slider(1.7, range=0..5), x_gap=Slider(3.2, range=0..5), x_num=Slider(9, range=0..25))  # -> graft(crvs), joined, centres; inputs rect: list of GeometryBase, inset: Double, x_gap: Double, y_gap: Double, x_num: Int32, y_num: Int32
# ---------- grid: C# ----------
    // Update 2025-06-17
    
    Component.Message = "Divide rectangle into grid";

    if (no_input("rect")) return;
    if (no_input("inset")) inset = 0;
    if (no_input("x_gap")) x_gap = 1;
    if (no_input("y_gap")) y_gap = 1;
    if (no_input("x_num")) x_num = 10;
    if (no_input("y_num")) y_num = 5;

    BoundingBox bb = boundingb(rect.ToArray());

    bb.Inflate(-inset);

    double total_width = bb.Max.X - bb.Min.X;
    double total_height = bb.Max.Y - bb.Min.Y;

    x_gap = Math.Min(x_gap, total_width / (x_num -1.0));
    y_gap = Math.Min(y_gap, total_height / (y_num -1.0));

    double width = (total_width - (x_gap * (x_num - 1))) / x_num;
    double height = (total_height - (y_gap * (y_num - 1))) / y_num;

    Point3d pt0 = bb.Min;
    Point3d pt1 = new Point3d(bb.Min.X + width, bb.Min.Y + height, bb.Min.Z);

    x_gap += width;
    y_gap += height;

    GH_Rectangle[] rectangles = new GH_Rectangle[x_num * y_num];
    GH_Point[] centre = new GH_Point[x_num * y_num];
    for (int i = 0; i < y_num; i++)
    {
      double y0 = pt0.Y + (y_gap * i);
      double y1 = pt1.Y + (y_gap * i);
      for (int j = 0; j < x_num; j++)
      {
        Point3d ptA = new Point3d(pt0.X + (x_gap * j), y0, pt0.Z);
        Point3d ptB = new Point3d(pt1.X + (x_gap * j), y1, pt1.Z);
        rectangles[(x_num * i) + j] = new GH_Rectangle(new Rectangle3d(Plane.WorldXY, ptA, ptB));
        centre[(x_num * i) + j] = new GH_Point(new Point3d(((ptA - ptB) * 0.5) + ptB));
      }
    }
    crvs = rectangles;
    centres = centre;
# ---------- grid: C# additional code ----------
  public static void TransformGeos(GeometryBase[] geos, Transform transform)
  {
    for (int i = 0; i < geos.Length; i++) geos[i].Transform(transform);
  }

private BoundingBox boundingb(GeometryBase[] geos)
  {
    BoundingBox bb = BoundingBox.Empty;
    for (int i = 0; i < geos.Length; i++) bb.Union(geos[i].GetBoundingBox(true));
    return bb;
  }

  private bool no_input(string name) => Component.Params.Input[Component.Params.IndexOfInputParam(name)].SourceCount == 0;
# ---------- end grid ----------
entwine = Entwine(
    Branch00=Slider(9, range=0..100),
    Branch01=Slider(19, range=0..100),
    Branch02=Slider(24, range=0..100),
    Branch03=Slider(24, range=0..100),
    Branch04=Slider(24, range=0..100),
    Branch05=Slider(21, range=0..100),
    FlattenInputs=True)
split_3 = TextSplit(Text=panel_3, Separators=",")
pres_grid = CSharpScript(
    rect=rectangle.joined,
    top_gap=Slider(100, range=0..100),
    gap=Slider(4, range=0..100),
    rad=number_slider_2,
    x_num=Slider(6, range=0..25),
    y_num=Slider(5, range=0..25),
    shapes=split_3)  # -> page, geos, centres, notes; inputs rect: list of GeometryBase, inset: Double, top_gap: Double, gap: Double, rad: Double, blend: Double, x_num: Int32, y_num: Int32, shapes: tree of Int32
# ---------- pres_grid: C# usings ----------
using System.Linq;
using Rhino.Display;
using System.Drawing;
using Rhino.UI;
using Rhino.Commands;
using System.Diagnostics.Metrics;
# ---------- pres_grid: C# ----------
    
    Component.Message = "Presentation Grid";

    if (no_input("inset")) inset = 0;
    if (no_input("top_gap")) top_gap = 0;
    if (no_input("gap")) gap = 25;
    if (no_input("rad")) rad = 0;
    if (no_input("blend")) blend = 0.72;
    if (no_input("x_num")) x_num = 5;
    if (no_input("y_num")) y_num = 5;
    if (no_input("shapes"))
    {
      shapes.Add(1, new GH_Path(0));
      shapes.Add(1, new GH_Path(0));
    }

    string[] note_list = {
      "negative 'rad' will give C2 corners that match arcs",
      "No 'rad' input, gives a Simple Rectangle",
      "Blend at 0, gives chamfered rectangles",
      "Blend at 1, gives rectangles with arc corners"
    };

    notes = note_list;


    // ---------- Bounding Box Rectangle ------------------------------------------------------------- //

    double initial_x = 1920;
    double initial_y = 1080;
    double width = initial_x - (inset * 2);
    double height = initial_y - (inset * 2) - top_gap;

    Vector3d centre_vec = new Vector3d(0, 0, 0);
    Vector3d box_centre = new Vector3d(0, -top_gap * 0.5, 0);

    if (!no_input("rect")) {
      BoundingBox bb = bb_union(rect.ToArray());

      initial_x = bb.Max.X - bb.Min.X;
      initial_y = bb.Max.Y - bb.Min.Y;

      width = initial_x - (inset * 2);
      height = initial_y - (inset * 2) - top_gap;
      
      centre_vec = new Vector3d(bb.Center);
      box_centre = centre_vec + box_centre;

    }
    Point3d pt = new Point3d(-width * 0.5, height * 0.5, 0);

    Transform move = Transform.Translation(centre_vec);
    Transform box_move = Transform.Translation(box_centre); //new Vector3d(0, 0, 0));// 



    // ---------- Setup ------------------------------------------------------------- //


    int ptnum = x_num * y_num;

    Plane pl = Plane.WorldXY;

    double wid = (width - (gap * (x_num - 1)))/x_num;
    double high = (height - (gap * (y_num - 1))) / y_num;

    double[] x_vals = new double[x_num];
    double[] y_vals = new double[y_num];

    for (int i = 0; i < x_num; i++) x_vals[i] = pt.X + (i * (wid + gap));
    for (int i = 0; i < y_num; i++) y_vals[i] = pt.Y - (i * (high + gap));

    List<Point3d> tops_pts = new List<Point3d>();
    List<Point3d> bots_pts = new List<Point3d>();

    for (int i = 0; i < y_num; i++)
    {
      for (int j = 0; j <  x_num; j++)
      {
        tops_pts.Add(new Point3d(x_vals[j], y_vals[i], 0));
        bots_pts.Add(new Point3d(x_vals[j] + wid, y_vals[i] - high, 0));
      }
    }


    // ---------- Rectangles ------------------------------------------------------------- //


    List<int> vals = Enumerable.Repeat(1, ptnum).ToList(); //Enumerable.Range(0, ptnum).ToList();
    DataTree<Curve> rects = new DataTree<Curve>();
    List<Point3d> cents = new List<Point3d>();


    // ---------- Rectangles ------------------------------------------------------------- //

    int start = 0;

    for (int i = 0; i < shapes.BranchCount; i++)
    {
      int a = new[] { shapes.Branch(i)[0], x_num }.Min();
      int b = new[] { shapes.Branch(i)[1], y_num }.Min();

      int loc = -1;
      int counter = 0;
      for (int j = start; j < ptnum; j++)
      {
        if (vals[j] == 1 && x_num - (j - counter) % x_num >= a) counter++; //
        else counter = 0;
        if (counter == a) { loc = j - (a - 1); start = loc; break; }
      }

      int end_loc = loc + (a - 1) + ((b - 1) * x_num);

      if (loc >= 0 && end_loc < ptnum)
      {
        Curve[] rect_crvs = placed_rect(tops_pts[loc], bots_pts[end_loc], rad, blend, out Point3d c_pt);
        for (int j = 0; j < rect_crvs.Length; j++) rect_crvs[j].Transform(box_move);
        rects.AddRange(rect_crvs,  new GH_Path(i));
        cents.Add(new Point3d(c_pt+box_centre));

        int[] culls = cullptnum(x_num, y_num, loc, a, b);
        culls.Reverse();
        for (int j = 0; j < culls.Length; j++) vals[culls[j]] = 0;
      }
    }

    int count = 0;
    for (int i = 0; i < ptnum; i++)
    {
      if (vals[i] == 1)
      {
        Curve[] rect_crvs = placed_rect(tops_pts[i], bots_pts[i], rad, blend, out Point3d c_pt);
        for (int j = 0; j < rect_crvs.Length; j++) rect_crvs[j].Transform(box_move);
        rects.AddRange(rect_crvs, new GH_Path(shapes.BranchCount + count));
        cents.Add(new Point3d(c_pt + box_centre));
        count++;
      }
    }


    Curve[] page_rect = rectangle(initial_x, initial_y);
    for (int i = 0; i < page_rect.Length; i++) page_rect[i].Transform(move);

    page = page_rect;
    geos = rects;
    centres = cents;
# ---------- pres_grid: C# additional code ----------
  private int[] consecutive(int[] input)
  {
    List<int> result = new List<int>();

    int count = 1;
    for (int i = 1; i < input.Length; i++)
    {
      if (input[i] == input[i - 1] + 1) count++;

      else
      {
        for (int j = i - count; j < i; j++) result.Add(count);
        count = 1;
      }
    }

    for (int j = input.Length - count; j < input.Length; j++)
    {
      result.Add(count);
    }
   return result.ToArray();

  }

private int[] cullptnum(int x_num, int y_num, int start_num, int a, int b)
  {
    int ptnum = x_num * y_num;

    List <int> culls = new List<int>();
    for (int j = 0; j < b; j++)
    {
      for (int k = 0; k < a; k++)
      {
        int val = ((start_num + k) + (j * x_num));
        if (val < ptnum) culls.Add(val);
      }
    }

    culls.Sort();

    return culls.ToArray();
  }

  private bool no_input(string name)
  {
    string[] names = Component.Params.Input.Select(x => x.NickName.Trim()).ToArray();
    int input_idx = Array.IndexOf(names, name);
    return Component.Params.Input[input_idx].SourceCount == 0;
  }

  private BoundingBox bb_union(GeometryBase[] geo, double inflate = 0)
  {
    BoundingBox bb = BoundingBox.Empty;
    for (int i = 0; i < geo.Length; i++) bb.Union(geo[i].GetBoundingBox(true));
    if (inflate != 0) bb.Inflate(inflate);
    return bb;
  }

  Curve[] placed_rect(Point3d top, Point3d bottom, double radius, double blend, out Point3d cent)
  {
    const int degree = 6;
    const int ptnum = 4;
    BoundingBox bb = new BoundingBox(new[] { top, bottom });
    Vector3d centre = new Vector3d(bottom) + ((top - bottom) * 0.5);

    double width = bb.Max.X - bb.Min.X;
    double height = bb.Max.Y - bb.Min.Y;

    cent = new Point3d(centre);

    if (radius == 0)
    {
      Curve[] rect = rectangle(width, height);
      for (int i = 0; i < rect.Length; i++) rect[i].Transform(Transform.Translation(centre));
      return rect;
    }
    if (radius > 0)
    {
      if (blend >= 1)
      {
        Curve[] rect = multi_arc_rectangle(width, height, radius, radius, radius, radius);
        for (int i = 0; i < rect.Length; i++) rect[i].Transform(Transform.Translation(centre));
        return rect;
      }
      else if (blend > 0)
      {
        Curve[] rect = multi_rectangle(width, height, radius, radius, radius, radius, blend, ptnum, degree);
        for (int i = 0; i < rect.Length; i++) rect[i].Transform(Transform.Translation(centre));
        return rect;
      }
      else
      {
        Curve[] rect = chamfer(width, height, radius, radius, radius, radius);
        for (int i = 0; i < rect.Length; i++) rect[i].Transform(Transform.Translation(centre));
        return rect;
      }
    }
    else 
    {
      radius *= -1.5;
      Curve[] rect = multi_rectangle(width, height, radius, radius, radius, radius, 0.72, ptnum, degree);
      for (int i = 0; i < rect.Length; i++) rect[i].Transform(Transform.Translation(centre));
      return rect;
    }


  }

  Curve[] rectangle(double x, double y)
  {
    x *= 0.5;
    y *= 0.5;

    Point3d[] pts = {
      new Point3d(-x, -y, 0),
      new Point3d(-x, y, 0),
      new Point3d(x, y, 0),
      new Point3d(x, -y, 0)
      };

    NurbsCurve[] lines = {
      new Line(pts[0], pts[1]).ToNurbsCurve(),
      new Line(pts[1], pts[2]).ToNurbsCurve(),
      new Line(pts[2], pts[3]).ToNurbsCurve(),
      new Line(pts[3], pts[0]).ToNurbsCurve(),
      };

    return lines;

  }

  Curve corner(double radius, double bend, int ptnum, int degree)
  {
    double offset = (radius * bend) / (ptnum - 1);

    Point3d[] corner_points = new Point3d[ptnum * 2];

    for (int i = 0; i < ptnum; i++)
    {
      double ratioA = radius - (i * offset);
      double ratioB = radius - ((ptnum - i - 1) * offset);
      corner_points[i] = new Point3d(ratioA, 0, 0);
      corner_points[i + ptnum] = new Point3d(0, ratioB, 0);
    }

    Curve c = NurbsCurve.Create(false, degree, corner_points);
    c.Domain = new Interval(0, 1);

    return c;
  }

  Curve[] multi_rectangle(double x, double y, double radA, double radB, double radC, double radD, double bend, int ptnum, int degree)
  {
    x *= 0.5;
    y *= 0.5;

    //Curve c = new Curve[8];
    List<Curve> curves = new List<Curve>();
    if (radA != 0)
    {
      Curve c = corner(radA, bend, ptnum, degree);
      c.Transform(Transform.Translation(-x, -y, 0));
      curves.Add(c);
    }

    curves.Add(new Line(new Point3d(-x, radA - y, 0), new Point3d(-x, y - radB, 0)).ToNurbsCurve());

    if (radB != 0)
    {
      Curve c = corner(radB, bend, ptnum, degree);
      c.Transform(Transform.Rotation(Math.PI * 1.5, Point3d.Origin));
      c.Transform(Transform.Translation(-x, y, 0));
      curves.Add(c);
    }

    curves.Add(new Line(new Point3d(radB - x, y, 0), new Point3d(x - radC, y, 0)).ToNurbsCurve());

    if (radC != 0)
    {
      Curve c = corner(radC, bend, ptnum, degree);
      c.Transform(Transform.Rotation(Math.PI, Point3d.Origin));
      c.Transform(Transform.Translation(x, y, 0));
      curves.Add(c);
    }

    curves.Add(new Line(new Point3d(x, y - radC, 0), new Point3d(x, radD - y, 0)).ToNurbsCurve());

    if (radD != 0)
    {
      Curve c = corner(radD, bend, ptnum, degree);
      c.Transform(Transform.Rotation(Math.PI * 0.5, Point3d.Origin));
      c.Transform(Transform.Translation(x, -y, 0));
      curves.Add(c);
    }

    curves.Add(new Line(new Point3d(x - radD, -y, 0), new Point3d(radA - x, -y, 0)).ToNurbsCurve());


    return curves.ToArray(); //.Select(c => new GH_Curve(c)).ToArray();
  }

  Curve[] multi_arc_rectangle(double x, double y, double radA, double radB, double radC, double radD)
  {
    x *= 0.5;
    y *= 0.5;

    List<Curve> curves = new List<Curve>();
    if (radA != 0)
    {
      Curve c = new Arc(new Point3d(radA, 0, 0), -Vector3d.XAxis, new Point3d(0, radA, 0)).ToNurbsCurve();
      c.Transform(Transform.Translation(-x, -y, 0));
      curves.Add(c);
    }

    curves.Add(new Line(new Point3d(-x, radA - y, 0), new Point3d(-x, y - radB, 0)).ToNurbsCurve());

    if (radB != 0)
    {
      Curve c = new Arc(new Point3d(radB, 0, 0), -Vector3d.XAxis, new Point3d(0, radB, 0)).ToNurbsCurve();
      c.Transform(Transform.Rotation(Math.PI * 1.5, Point3d.Origin));
      c.Transform(Transform.Translation(-x, y, 0));
      curves.Add(c);
    }

    curves.Add(new Line(new Point3d(radB - x, y, 0), new Point3d(x - radC, y, 0)).ToNurbsCurve());

    if (radC != 0)
    {
      Curve c = new Arc(new Point3d(radC, 0, 0), -Vector3d.XAxis, new Point3d(0, radC, 0)).ToNurbsCurve();
      c.Transform(Transform.Rotation(Math.PI, Point3d.Origin));
      c.Transform(Transform.Translation(x, y, 0));
      curves.Add(c);
    }

    curves.Add(new Line(new Point3d(x, y - radC, 0), new Point3d(x, radD - y, 0)).ToNurbsCurve());

    if (radD != 0)
    {
      Curve c = new Arc(new Point3d(radD, 0, 0), -Vector3d.XAxis, new Point3d(0, radD, 0)).ToNurbsCurve();
      c.Transform(Transform.Rotation(Math.PI * 0.5, Point3d.Origin));
      c.Transform(Transform.Translation(x, -y, 0));
      curves.Add(c);
    }

    curves.Add(new Line(new Point3d(x - radD, -y, 0), new Point3d(radA - x, -y, 0)).ToNurbsCurve());

    Interval interval = new Interval(0, 1);

    for (int i = 0; i < curves.Count; i++)
    {
      curves[i].Domain = interval;
    }

    return curves.ToArray(); //.Select(c => new GH_Curve(c)).ToArray();

  }

  private Curve[] chamfer(double x, double y, double radA, double radB, double radC, double radD)
  {

    x *= 0.5;
    y *= 0.5;

    //Curve c = new Curve[8];
    List<Curve> curves = new List<Curve>();
    if (radA != 0)
    {
      Curve c = new Line(new Point3d(radA, 0, 0), new Point3d(0, radA, 0)).ToNurbsCurve();
      c.Transform(Transform.Translation(-x, -y, 0));
      curves.Add(c);
    }

    curves.Add(new Line(new Point3d(-x, radA - y, 0), new Point3d(-x, y - radB, 0)).ToNurbsCurve());

    if (radB != 0)
    {
      Curve c = new Line(new Point3d(radB, 0, 0), new Point3d(0, radB, 0)).ToNurbsCurve();
      c.Transform(Transform.Rotation(Math.PI * 1.5, Point3d.Origin));
      c.Transform(Transform.Translation(-x, y, 0));
      curves.Add(c);
    }

    curves.Add(new Line(new Point3d(radB - x, y, 0), new Point3d(x - radC, y, 0)).ToNurbsCurve());

    if (radC != 0)
    {
      Curve c = new Line(new Point3d(radC, 0, 0), new Point3d(0, radC, 0)).ToNurbsCurve();
      c.Transform(Transform.Rotation(Math.PI, Point3d.Origin));
      c.Transform(Transform.Translation(x, y, 0));
      curves.Add(c);
    }

    curves.Add(new Line(new Point3d(x, y - radC, 0), new Point3d(x, radD - y, 0)).ToNurbsCurve());

    if (radD != 0)
    {
      Curve c = new Line(new Point3d(radD, 0, 0), new Point3d(0, radD, 0)).ToNurbsCurve();
      c.Transform(Transform.Rotation(Math.PI * 0.5, Point3d.Origin));
      c.Transform(Transform.Translation(x, -y, 0));
      curves.Add(c);
    }

    curves.Add(new Line(new Point3d(x - radD, -y, 0), new Point3d(radA - x, -y, 0)).ToNurbsCurve());


    return curves.ToArray(); //.Select(c => new GH_Curve(c)).ToArray();


  }



  List<Point3d> pt_list = new List<Point3d>();
  double text_size = 0.75;
  //Draw all wires and points in this method.
  public override void DrawViewportWires(IGH_PreviewArgs args)
  {
    RhinoDoc doc = RhinoDoc.ActiveDoc;
    RhinoView view = doc.Views.ActiveView;
    RhinoViewport vp = view.ActiveViewport;
    vp.GetCameraFrame(out Plane pl);

    for (int i = 0; i < pt_list.Count; i++)
    {

      Plane text_pl = pl;
      pl.Origin = pt_list[i];
      Text3d text = new Text3d(i.ToString(), pl, text_size);
      args.Display.Draw3dText(text, Color.White);
      args.Display.DrawPoint(pt_list[i], Color.White);

    }
  }
# ---------- end pres_grid ----------
series = Series(gap=number_slider_4, num=Slider(3, range=0..10), cent=Toggle(True))  # -> reverse(s), n; inputs gap: Double, num: Int32, cent: Boolean
# ---------- series: C# ----------
// Grasshopper Script Instance
#region Usings
using System;
using Rhino;
using Rhino.Geometry;
using Grasshopper;
using Grasshopper.Kernel;
#endregion

public class Script_Instance : GH_ScriptInstance
{
    private void RunScript(
		double gap,
		int num,
		bool cent,
		ref object s,
		ref object n)
    {
		// Updated 2026-02-09
		Component.Message = "centralized series";

		if (no_input("num")) return;
		if (no_input("gap")) gap = 1.0;
		if (no_input("cent")) cent = false;

       	double[] vals = new double[num];

        double step = gap;                    
        double start = cent ? -step * (num - 1) * 0.5 : 0;
		vals[0] = start;
		for (int i = 1; i < num; ++i) vals[i] = start + i * step;

 		s = vals;
        n = num - 1;
    }

	private bool no_input(string name)
    {
		int i = Component.Params.IndexOfInputParam(name);
		return i < 0 || Component.Params.Input[i].SourceCount == 0 || Component.Params.Input[i].VolatileDataCount == 0;
		}
}
# ---------- end series ----------
bb_pt = BoundingBoxPoint(geo=grid.crvs, loc=Slider(1, range=0..10))  # -> point, location; inputs geo: list of GeometryBase, loc: Int32
# ---------- bb_pt: C# ----------
    Component.Message = "Get Bounding Box Point";
    if (Component.Params.Input[1].SourceCount == 0) loc = 4;

    int x = loc%3;
    int y = (loc/3)%3;
    int z = loc/9;

    BoundingBox bb = BoundingBox.Empty;
    for (int i = 0; i < geo.Count; i++) bb.Union(geo[i].GetBoundingBox(true));


    double[] xvals =
      {
      bb.Min.X,
      ((bb.Max.X - bb.Min.X) * 0.5) + bb.Min.X,
      bb.Max.X
      };

    double[] yvals =
      {
      bb.Min.Y,
      ((bb.Max.Y - bb.Min.Y) * 0.5) + bb.Min.Y,
      bb.Max.Y
      };

    double[] zvals =
      {
      bb.Min.Z,
      ((bb.Max.Z - bb.Min.Z) * 0.5) + bb.Min.Z,
      bb.Max.Z
      };

    Point3d pt = new Point3d(xvals[x], yvals[y], zvals[z]);


    point = pt;

    string[] mcm = {" Min, ", " Centre, ", " Max, "};


    location = "X" + mcm[x] +"Y" + mcm[y] +"Z" + mcm[z];
# ---------- end bb_pt ----------
distribute = Distribute(
    Geometry=[item_3.Item, item_3.Item1, item_3.Item2, item_3.Item5],
    ReferenceGeo=origin,
    X=num,
    align=True,
    centre=0,
    order=False)  # -> Geometry, Moves, Notes
distribute_2 = Distribute(
    Geometry=[item_3.Item3, item_3.Item4, item_3.Item7, item_3.Item11],
    ReferenceGeo=origin,
    X=num,
    align=True,
    centre=0,
    order=False)  # -> Geometry, Moves, Notes
distribute_3 = Distribute(Geometry=[item_3.Item8, item_3.Item9, item_3.Item10], ReferenceGeo=origin, X=num, align=True, centre=0, order=False)  # -> Geometry, Moves, Notes
Y = UnitY(Factor=series.s)
set_dims = CSharpScript(geos=grid.crvs, pt=bb_pt.point, y=entwine)  # -> out, G, A, B; inputs geos: list of GeometryBase, pt: Point3d, x: Double, y: Double, z: Double
# ---------- set_dims: C# usings ----------
using System.Linq;
using Rhino.DocObjects;
# ---------- set_dims: C# ----------
    if (no_input("geos")) return;
    if (no_input("pt")) pt = Point3d.Origin;

    BoundingBox bb = bb_union(geos.ToArray());
    bb.Union(pt);


    double x_dim = bb.Max.X - bb.Min.X;
    double y_dim = bb.Max.Y - bb.Min.Y;
    double z_dim = bb.Max.Z - bb.Min.Z;

    Plane pl = new Plane(pt, Vector3d.ZAxis);

    double x_scale = 1;
    double y_scale = 1;
    double z_scale = 1;

    if (!no_input("x")) x_scale = x / x_dim;
    if (!no_input("y")) y_scale = y / y_dim;
    if (!no_input("z")) z_scale = z / z_dim;

    for (int i = 0; i < geos.Count; i++) geos[i].Transform(Transform.Scale(pl, x_scale, y_scale, z_scale));

    G = geos;
# ---------- set_dims: C# additional code ----------
  private bool no_input(string name)
  {
    string[] names = Component.Params.Input.Select(x => x.NickName.Trim()).ToArray();
    int input_idx = Array.IndexOf(names, name);
    return Component.Params.Input[input_idx].SourceCount == 0;
  }

  private BoundingBox bb_union(GeometryBase[] geo, double inflate = 0)
  {
    BoundingBox bb = BoundingBox.Empty;
    for (int i = 0; i < geo.Length; i++) bb.Union(geo[i].GetBoundingBox(true));
    if (inflate != 0) bb.Inflate(inflate);
    return bb;
  }
# ---------- end set_dims ----------
entwine_2 = Entwine(Branch00=distribute.Geometry, Branch01=distribute_2.Geometry, Branch02=distribute_3.Geometry, FlattenInputs=True)
move = Move(Geometry=entwine_2, Motion=graft(Y))  # -> Geometry, Transform
fillet = Fillet_curves(curves=set_dims.G)  # -> crvs, joined; inputs curves: list of Curve, radii: list of Double, bulge: list of Double
# ---------- fillet: C# usings ----------
using Rhino.Geometry.Intersect;
using System.Linq;
using System.Drawing;
using Rhino.Display;
# ---------- fillet: C# ----------
    if (Component.Params.Input[1].SourceCount == 0) radii.Add(0.5);
    if (Component.Params.Input[2].SourceCount == 0) bulge.Add(0.65);
    text_size = 0.75;

    const double tol = 0.01;

    //List<Curve> test_crvs = new List<Curve>();
    pt_list.Clear();
    List<Curve> crv_list = new List<Curve>();
    Curve[] joined_crvs = Curve.JoinCurves(curves, tol);


    for (int j = 0; j < joined_crvs.Length; j++)
    {
      bool curve_open = !joined_crvs[j].IsClosed;
      Curve[] crvs_segs = explode(joined_crvs[j]);  // joined_crvs[j].DuplicateSegments();

      crvs_segs = sort_crv(crvs_segs, tol);
      crvs_segs = clean_lines(crvs_segs);

      int count = crvs_segs.Length;
      if (curve_open) count -= 1;
      int crv_num = crvs_segs.Length;

      double last_rad = radii[radii.Count - 1];
      double last_bulge = bulge[bulge.Count - 1];
      for (int i = radii.Count; i < count; i++) radii.Add(last_rad);
      for (int i = bulge.Count; i < count; i++) bulge.Add(last_bulge);

      bool[] to_fillet = radii.Select(r => (r > 0)).ToArray();


      // --- Set up Points, Circles and Spheres for Intersection --- //


      int counter = 0;
      bool skip = false;
      bool add_first = false;
      for (int i = 0; i < count; i++)
      {
        Curve first = crvs_segs[i];
        Curve second = crvs_segs[(i + 1) % crv_num];

        if (Math.Abs(Vector3d.VectorAngle(first.TangentAtEnd, second.TangentAtStart)) > tol)
        {
          if (i == 0) add_first = true;
          pt_list.Add(first.PointAtEnd);
          if (radii[counter] > 0){



          Plane pl = Plane.WorldXY;
          Curve curve = Curve.JoinCurves(new[] { first, second }, tol)[0];
          bool curve_planar = curve.TryGetPlane(out pl);
          pl.Origin = first.PointAtEnd;
          NurbsCurve cir = new Circle(pl, radii[counter]).ToNurbsCurve();//test_crvs.Add(cir);
          NurbsSurface sph = new Sphere(pl.Origin, radii[counter]).ToNurbsSurface();

          CurveIntersections cc_event;
          if (curve_planar) cc_event = Intersection.CurveCurve(first, cir, tol, tol);
          else cc_event = Intersection.CurveSurface(first, sph, tol, tol);

          if (cc_event.Count == 0) first = crv_list[crv_list.Count - 1]; // crvs_segs[(i + crv_num - 1) % crv_num];
          else
          {
            double t = cc_event[0].ParameterA;
            first = first.Split(t)[0];
            crvs_segs[i] = first;
            if (curve_open) crv_list.Add(first);
            else if (i != 0) crv_list.Add(first);
          }

          if (curve_planar) cc_event = Intersection.CurveCurve(second, cir, tol, tol);
          else cc_event = Intersection.CurveSurface(second, sph, tol, tol);
          if (cc_event.Count == 0)
          {
            second = crvs_segs[(i + 2) % crv_num];
            skip = true;
          }
          else
          {
            double t = cc_event[0].ParameterA;
            second = second.Split(t)[1];
            crvs_segs[(i + 1) % crv_num] = second;
            skip = false;
          }

          Curve corner = Curve.CreateControlPointCurve(new[] { first.PointAtEnd, second.PointAtStart });
          if (bulge[counter] > 0 && bulge[counter] < 1) corner = Curve.CreateBlendCurve(first, second, BlendContinuity.Curvature, bulge[counter], bulge[counter]);
          else if (bulge[counter] >= 1) corner = new Arc(first.PointAtEnd, first.TangentAtEnd, second.PointAtStart).ToNurbsCurve();
          crv_list.Add(corner);
          counter++;
        } else {
            if (curve_open) crv_list.Add(first);
            else if (i != 0) crv_list.Add(first);
            counter++;
        }
        }
        else
        {
          if (skip) skip = false;
          else crv_list.Add(first);
        }
      }

      if (curve_open) crv_list.Add(crvs_segs[crv_num - 1]);
      else if (add_first) crv_list.Insert(0, crvs_segs[0]);
    }


    Curve[] final_crvs = sort_crv(crv_list.ToArray(), tol);

    crvs = final_crvs.Select(c => new GH_Curve(c));
    joined = Curve.JoinCurves(final_crvs, tol).Select(c => new GH_Curve(c));
    //points = pt_list.Select(p => new GH_Point(p));
# ---------- fillet: C# additional code ----------
  Curve[] clean_lines(Curve[] curves)
  {
    double tol = 0.01;

    List<int> remove_list = new List<int>();
    for (int i = 0; i < curves.Length; i++)
    {
      int next = (i + 1) % curves.Length;
      if (curves[i].IsLinear(tol) && curves[next].IsLinear(tol))
      {
        if (Math.Abs(Vector3d.VectorAngle(curves[i].PointAtEnd - curves[i].PointAtStart, curves[next].PointAtEnd - curves[next].PointAtStart)) < tol)
        {
          curves[i] = Curve.CreateControlPointCurve(new[] { curves[i].PointAtStart, curves[next].PointAtEnd });
          remove_list.Add(next);
        }
      }
    }

    remove_list.Sort();
    remove_list.Reverse();
    List<Curve> crv_list = new List<Curve>(curves);
    for (int i = 0; i < remove_list.Count; i++) crv_list.RemoveAt(remove_list[i]);


    return crv_list.ToArray();
  }

  Curve[] explode(Curve curve)
  {
    double tol = 0.01;
    Continuity cont = Continuity.Gsmooth_continuous;

    List<Curve> crv_list = new List<Curve>();
    Curve[] curves = curve.DuplicateSegments();
    for (int i = 0; i < curves.Length; i++)
    {
      if (curves[i].IsLinear(tol) || curves[i].IsArc(tol)) crv_list.Add(curves[i]);
      else crv_list.AddRange( split_crv(curves[i], cont));
    }

    List<int> remove_list = new List<int>();
    for (int i = 0; i < crv_list.Count; i++){
      int next =( i + 1)% crv_list.Count;
      if (crv_list[i].IsLinear(tol) && crv_list[next].IsLinear(tol))
      {
        if (Math.Abs(Vector3d.VectorAngle(crv_list[i].TangentAtEnd, crv_list[next].TangentAtStart)) < tol)
        {
          crv_list[i] = Curve.CreateControlPointCurve(new[] { crv_list[i].PointAtStart, crv_list[next].PointAtEnd });
          remove_list.Add(next);
        }
      }
    }

    remove_list.Sort();
    remove_list.Reverse();

    for (int i = 0; i< remove_list.Count; i++) crv_list.RemoveAt(remove_list[i]);

    return crv_list.ToArray();
  }

Curve[] split_crv( Curve curve, Continuity cont)
  {
    double t0 = curve.Domain.Min;
    double t1 = curve.Domain.Max;
    List<double> ts = new List<double>();
    bool test_crv = true;
    List<bool> bools = new List<bool>();

    if (!curve.IsClosed && cont == Continuity.G2_locus_continuous) cont = Continuity.G2_continuous;

    while (test_crv)
    {
      test_crv = curve.GetNextDiscontinuity(cont, t0, t1, out double t);
      bools.Add(test_crv);
      t0 = t;
      ts.Add(t);
    }

    if (bools[0]) return curve.Split(ts);
    else return new[] { curve };

  }


 Curve[] sort_crv(Curve[] curves, double tol)
  {

    List<Curve> crvs = curves.ToList();

    int count = curves.Length;

    Point3d start = Curve.JoinCurves(curves, tol)[0].PointAtStart;


    // ---------- First Curve ---------- //

    Point3d[] start_pts = curves.Select(c => c.PointAtStart).ToArray();
    Point3d[] end_pts = curves.Select(c => c.PointAtEnd).ToArray();

    int start_idx = Array.IndexOf(start_pts, start);
    bool flip_first_curve = false;

    if (start_idx< 0) {
      start_idx = Array.IndexOf(end_pts, start);
      flip_first_curve = true;
    }

    curves[0] = crvs[start_idx];
    if (flip_first_curve) curves[0].Reverse();
    crvs.RemoveAt(start_idx);


    // ---------- Sort Curves ---------- //

    for (int i = 0; i < count - 1; i++)
    {
      Point3d end = curves[i].PointAtEnd;
      for (int j = 0; j < crvs.Count; j++)
      {
        if (end.DistanceToSquared(crvs[j].PointAtStart) < tol)
        {
          curves[i + 1] = crvs[j];
          crvs.RemoveAt(j);
        }
        else if (end.DistanceToSquared(crvs[j].PointAtEnd) < tol)
        {
          crvs[j].Reverse();
          curves[i + 1] = crvs[j];
          crvs.RemoveAt(j);
        }
      }
    }

    return curves;

  }

  //Return a BoundingBox that contains all the geometry you are about to draw.
  public override BoundingBox ClippingBox
  {
    get
    {
      return BoundingBox.Empty;
    }
  }

  //Draw all meshes in this method.
  public override void DrawViewportMeshes(IGH_PreviewArgs args)
  {
  }
double text_size = 0.75;
  //Draw all wires and points in this method.
  public override void DrawViewportWires(IGH_PreviewArgs args)
  {
    RhinoDoc doc = RhinoDoc.ActiveDoc;
    RhinoView view = doc.Views.ActiveView;
    RhinoViewport vp = view.ActiveViewport;
    vp.GetCameraFrame(out Plane pl);

    for (int i = 0; i < pt_list.Count; i++) {

      Plane text_pl = pl;
      pl.Origin = pt_list[i];
      Text3d text = new Text3d(i.ToString(), pl, text_size);
      args.Display.Draw3dText(text, Color.White);
      args.Display.DrawPoint(pt_list[i], Color.White);

        }
  }
  List<Point3d> pt_list = new List<Point3d>();
# ---------- end fillet ----------
boundry = Bounding_curve(Geometry=flatten(move.Geometry), Inflate=0, Plane=3, s=0)  # -> Curves, Plane, Notes
