# Grasshopper definition examples.gh (Grasshopper 1.0.8)
# plug-ins: Design Tools

number_slider = Slider(50, range=0..100)
toggle = BooleanToggle(True)  # disabled
swatch = ColourSwatch(SwatchColor=RGB(65, 65, 65))  # disabled
swatch_2 = ColourSwatch(SwatchColor=RGB(50, 50, 50))  # disabled
number_slider_2 = Slider(100, range=0..100)
canvas = CSharpScript(background=swatch_2, grid=swatch, switcher=toggle)  # inputs background: Color, grid: Color, switcher: Boolean; disabled
# ---------- canvas: C# usings ----------
using System.Drawing;
# ---------- canvas: C# ----------
    Component.Message = "Changes Canvas Colour";

    if (switcher == true)
    {
      Grasshopper.GUI.Canvas.GH_Skin.canvas_grid = grid;
      Grasshopper.GUI.Canvas.GH_Skin.canvas_back = background;
      Grasshopper.GUI.Canvas.GH_Skin.canvas_edge = Color.FromArgb(255, 0, 0, 0);
      Grasshopper.GUI.Canvas.GH_Skin.canvas_shade = Color.FromArgb(80, 0, 0, 0);
    }
    else
    {
      //DEFAULTS
      Grasshopper.GUI.Canvas.GH_Skin.canvas_grid = Color.FromArgb(30, 0, 0, 0);
      Grasshopper.GUI.Canvas.GH_Skin.canvas_back  = Color.FromArgb(255, 212, 208, 200);
      Grasshopper.GUI.Canvas.GH_Skin.canvas_edge = Color.FromArgb(255, 0, 0, 0);
      Grasshopper.GUI.Canvas.GH_Skin.canvas_shade = Color.FromArgb(80, 0, 0, 0);
    }
# ---------- end canvas ----------
rectangle = Rectangle(X=number_slider, Y=number_slider, Radii=Slider(10, range=0..10), s=0)  # -> Curves, Joined, Points, Notes
srf = Surface(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)
resize = Resize(Geometry=srf, Y=Slider(100, range=0..200), align=False, match=True, union=False)  # -> Geometry, Planes, Scales, Moves, Notes
rectangle_2 = Rectangle(X=number_slider_2, Y=number_slider_2, Radii=Slider(15, range=0..100), s=0)  # -> Curves, Joined, Points, Notes
pt = ConstructPoint(XCoordinate=Slider(35, range=0..100), YCoordinate=0, ZCoordinate=Slider(15, range=0..100))
pt_2 = ConstructPoint(XCoordinate=Slider(25, range=0..100), YCoordinate=0, ZCoordinate=0)
pt_3 = ConstructPoint(XCoordinate=Slider(100, range=0..100), YCoordinate=0, ZCoordinate=Slider(20, range=0..100))
pt_4 = ConstructPoint(XCoordinate=0, YCoordinate=0, ZCoordinate=0)
scale = Scale(Geometry=srf, Center=Point(0, 0, 0), Factor=Slider(0.5, range=0..1))  # -> Geometry, Transform
neg = Negative(Value=Slider(34.7, range=0..200))
pt_5 = ConstructPoint(XCoordinate=0, YCoordinate=0, ZCoordinate=Slider(46, range=0..100))
extrude_indent = ExtrudeIndent(Curves=rectangle.Curves, Fillets=Slider(0.5, range=0..10), Extrude=Slider(50, range=0..100), Inset=0, Flip=False, s=0)  # -> Breps, Planes, EdgesA, EdgesB, Notes
pt_6 = ConstructPoint(XCoordinate=0, YCoordinate=0, ZCoordinate=neg)
Z = UnitZ(Factor=Slider(20, range=0..100))
rectangle_3 = Rectangle(X=Slider(70, range=0..100), Y=Slider(130, range=0..1000), Radii=Slider(20, range=0..100), s=0)  # -> Curves, Joined, Points, Notes
pill = Pill(X=Slider(50, range=0..100), Y=Slider(80, range=0..100), p_width=False, smooth=True)  # -> Curves, Joined, Pivots
pline = PolyLine(Vertices=[pt_4, pt_2, pt, pt_3], Closed=False)
neg_2 = Negative(Value=Slider(12, range=0..200))
geo = Geometry([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])
geo_2 = Geometry([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])
number_slider_3 = Slider(1.9, range=0..10)
xy = XYPlane(Origin=Z)
move = Move(Geometry=resize.Geometry, Motion=pt_6)  # -> Geometry, Transform
move_2 = Move(Geometry=rectangle_2.Curves, Motion=pt_5)  # -> Geometry, Transform
pt_7 = ConstructPoint(XCoordinate=0, YCoordinate=0, ZCoordinate=neg_2)
extend = Extend_Curve(Curve=pline, End=Slider(100, range=0..100), proportional=False)
number_slider_4 = Slider(1.8, range=0..3)
sweep = Sweep(Rails=rectangle_3.Curves, Profile=geo_2, Sectors=15, cap=True)  # -> Breps, Curves, Notes
move_3 = Move(Geometry=resize.Geometry, Motion=pt_7)  # -> Geometry, Transform
split_brep = SplitBrep(
    Brep=extrude_indent.Breps,
    Plane=xy,
    Fillet=Slider(0.1, range=0..1),
    Blend=0.68,
    Flip=Toggle(False),
    cap=True,
    match=False)  # -> Breps, Curves
split_brep_2 = SplitBrep(
    Brep=extrude_indent.Breps,
    Plane=xy,
    Fillet=Slider(0.1, range=0..1),
    Blend=0.68,
    Flip=Toggle(True),
    cap=True,
    match=False)  # -> Breps, Curves
number_slider_5 = Slider(20.2, range=0..100)
number_slider_6 = Slider(1.9, range=0..10)
item = ListItem(List=sweep.Breps, Index=Slider(5, range=0..15), Wrap=True)  # -> Item, Item1, Item2, Item3, Item4
fillet = FilletCurves(Curves=extend, Radii=Slider(5, range=0..10), all=False, bully=False, clean=False)  # -> Curves, Joined
extrude_punch = ExtrudeAndPunch(curves=pill.Curves, brep=move_3.Geometry, flip=Toggle(True))  # -> out, breps, planes, crvs_A, crvs_B, notes; inputs curves: list, brep: Brep, radii: list of Double, blends: list of Double, extrude: Double, inset: Double, flip: Boolean
# ---------- extrude_punch: C# ----------
// Grasshopper Script Instance
#region Usings
using System;
using System.Collections.Generic;

using Rhino;
using Rhino.Geometry;
using Rhino.Geometry.Intersect;

using Grasshopper;
using Grasshopper.Kernel;
using Grasshopper.Kernel.Types;

#r "ID_Tools_Library.dll"
using static ID_Tools_Library.ID_Tools_Class;


#endregion
public class Script_Instance : GH_ScriptInstance
{
	private void RunScript(
		List<object> curves,
		Brep brep,
		List<double> radii,
		List<double> blends,
		double extrude,
		double inset,
		bool flip,
		ref object breps,
		ref object planes,
		ref object crvs_A,
		ref object crvs_B,
		ref object notes)
    {

	// Updated 2026-03-24

    bool no_brep = no_input("brep");
    bool no_curves = no_input("curves");
    bool no_extrude = no_input("extrude");

    if (no_curves) { if (!no_brep) breps = new GH_Brep(brep); Component.Message = ""; return; }

    if (no_input("blends")) blends = new List<double>() { 0.68 };
    bool no_inset = no_input("inset");
    if (no_input("flip")) flip = false;

    if (!no_brep) brep.Faces.ShrinkFaces();
    
    bool hollow = !no_brep && !brep.IsSolid;      //   << ---------------------- Adjust This if necessary
    // bool hollow_inner = flip && !no_brep && !brep.IsSolid && no_extrude;

    double tol = 0.0001;
    int sectors = 27;
    Plane pln = Plane.WorldXY;


    // -------------------------------- Set Basic Conditions -------------------------------- //

    bool simple = no_input("radii");
    if (simple) radii = new List<double>() {0};
    if (radii.Count == 1) radii.Add(radii[0]);
    if (radii[0] == 0 && radii[1] == 0) simple = true;
    blends.Add(blends[0]);

    bool has_extrude = !no_extrude && Math.Abs(extrude) > tol;
    bool has_brep = !no_brep;

    bool hole = has_brep && has_extrude;
    bool through_hole = has_brep && !has_extrude;
    bool extrusion = !hole && !through_hole;

    bool quick = false;
    bool centre = extrusion && flip;

    bool simple_extrude = extrusion && simple;
    if (extrusion && !simple) quick = radii[0] == radii[1];

    bool inner_hole = false;
    bool inner_though = false;
    if (flip)
    {
      inner_hole = hole;
      inner_though = through_hole;
      hole = false;
      through_hole = false;
    }
    if (hole && !inner_hole && flip) { hole = false; inner_hole = true; }

    if (hollow)  // (!brep.IsSolid)
    {
      if (through_hole)
      {
        hole = true;
        through_hole = false;
      }
      else if (inner_though)
      {
        inner_hole = true;
        inner_though = false;
      }
    }


    // -------------------------------- Sort Curves -------------------------------- //

    Curve[] curve_list = object_curve_convert(curves);

    int[] keys = sort_crvs(curve_list, out bool[] crv_closed, out _, out _);

    int idx = crv_closed.Length;
    Plane[] plns = new Plane[idx];

    BoundingBox brep_bb = new();
    if (!no_brep) brep_bb = brep.GetBoundingBox(true);

    int counter = 0;
    for (int i = 0; i < idx; i++)
    {
        if (!crv_closed[i]) continue;

        Curve[] crvs = items_by_key(curve_list, keys, i);

        if (!no_inset && inset != 0) crvs = offset(crvs, -inset, out plns[i], tol);
        else plns[i] = curves_plane(crvs);
        if (!no_brep) plns[i] = plane_on_box(plns[i], brep_bb, 1); // if (!no_brep || hollow) ?

        TransformGeos(crvs, Transform.Scale(plns[i], 1, 1, 0));

        int count = crvs.Length;
        if (count > 1)
        {
            sort_crvs(crvs);
            clean_lines(ref crvs);
            match_crv_ends(crvs);
        }

        for (int j = 0; j < count; j++)    // Write directly back into curve_list and keys
        {
            curve_list[counter] = crvs[j];
            keys[counter] = i;
            counter++;
        }
    }

    Array.Resize(ref curve_list, counter);
    Array.Resize(ref keys, counter);


    // -------------------------------- Manage Empty Inputs -------------------------------- //

    if ((no_extrude || extrude == 0) && (no_curves || no_brep))
    {
		crvs_A = Array.ConvertAll(curve_list, c => new GH_Curve(c));
		Component.Message = "Surface";
		if (!no_brep) breps = new GH_Brep(brep);
		else breps = Array.ConvertAll(Brep.CreatePlanarBreps(curve_list, 0.001), b => new GH_Brep(b));
		return;
    }

    if (no_extrude && no_brep) { Component.Message = ""; return; }


    // --------------------------------  Sort incoming curves -------------------------------- //

    // List<Curve> test_crvs = new ();
	List<Curve> all_A = new();
	List<Curve> all_B = new();
	List<Brep> all_breps = new();
	List<Plane> plane_list = new();

    for (int i = 0; i < idx; i++)
    {
      Curve[] crvs = items_by_key(curve_list, keys, i);
      int count = crvs.Length;


      Plane base_plane = Plane.Unset;
      Plane plane = plns[i];
      Transform orient = Transform.PlaneToPlane(plane, pln);
      Transform reorient = Transform.PlaneToPlane(pln, plane);

      if (has_brep) brep.Transform(orient);
      TransformGeos(crvs, orient);
      
      // Check that the curve is inside the Brep's bounds
      double edge_inset_caution = (through_hole || hole) && !simple ? 0.2 + Math.Max(radii[0], radii[1]) : 0.2;  // <<<<<< ----------------------      Add Hollow?

      if (has_brep && !boxboxinside2D(brep.GetBoundingBox(true), bb_union(crvs, edge_inset_caution)))
      {
        brep.Transform(reorient);
        continue;
      }

      if (!no_extrude && extrude == 0 ) { brep.Transform(reorient); breps = brep; crvs_A = crvs; continue; }


      // -------------------------------- Construct Breps and Parts -------------------------------- //

      //Brep test_piece = new Brep();
      Curve[] edgA = new Curve[count];
      Curve[] edgB = new Curve[count];
      Brep part = new Brep();
      if (simple_extrude) part = capped_extrude(crvs, out edgA, out edgB, extrude, centre);
      else if (quick) part = quick_extrude(crvs, extrude, radii[0], blends[0], sectors, centre, tol, out edgA, out edgB);
      else if (extrusion) part = full_extrude(crvs, extrude, radii, blends, sectors, centre, tol, out edgA, out edgB);

      else if (hole) part = hole_extrude(crvs, brep, extrude, radii, blends, sectors, tol, out base_plane, out edgA, out edgB);     // <<<<<< -------- Add Hollow (IsSolid Test and use that to change how Extrude and Flip - OR!!! if Extrude = 0, then recalculate extrude and flip [DO THIS])
      else if (inner_hole) part = hole_inner(crvs, brep, extrude, radii, blends, sectors, tol, out base_plane, out edgA, out edgB);  // <<<<<< -------- Add Hollow (IsSolid Test and use that to change how Extrude and Flip - OR!!! if Extrude = 0, then recalculate extrude and flip [DO THIS])

      else if (through_hole) part = hole_through(crvs, brep, radii, blends, sectors, tol, out edgA, out edgB);
      else if (inner_though) part = through_inner(crvs, brep, radii, blends, sectors, tol, out edgA, out edgB);
      else continue;

      Curve[] edges_A = remove_nulls(edgA);
      Curve[] edges_B = remove_nulls(edgB);

      part.Transform(reorient);                                    

      if (through_hole || hole) brep = part;                       
      else
      {
        all_breps.Add(part);
        if (has_brep) brep.Transform(reorient);
      }
      if (base_plane.IsValid) 
      { 
        base_plane.Transform(reorient); 
        plane_list.Add(base_plane); 
        }
            if (edges_A.Length > 0) { 
                TransformGeos(edges_A, reorient); 
                all_A.AddRange(edges_A); 
            }
            if (edges_B.Length > 0)
            {
                TransformGeos(edges_B, reorient);
                all_B.AddRange(edges_B);
            }

        }


    if (all_breps.Count == 0) breps = new GH_Brep(brep);
    else{
      int brep_count = all_breps.Count;
      GH_Brep[] gh_brep = new GH_Brep[brep_count];
      for (int i = 0; i < brep_count; i++) gh_brep[i] = new GH_Brep(all_breps[i]);
      breps = gh_brep;
    }

    int all_A_count = all_A.Count;
    int all_B_count = all_B.Count;
    GH_Curve[] gh_crvs_A = new GH_Curve[all_A_count];
    for (int i = 0; i < all_A_count; i++) gh_crvs_A[i] = new GH_Curve(all_A[i]);
    GH_Curve[] gh_crvs_B = new GH_Curve[all_B_count];
    for (int i = 0; i < all_B_count; i++) gh_crvs_B[i] = new GH_Curve(all_A[i]);

    crvs_A = gh_crvs_A;
    crvs_B = gh_crvs_B;
    planes = plane_list;

    string identifier = "";
    if (simple_extrude) identifier = "Simple Extrude " + sectors.ToString();
    else if (quick) identifier = "Quick Extrude " + sectors.ToString();
    else if (extrusion) identifier = "Full Extrusion " + sectors.ToString();
    else if (hollow && hole) identifier = "Hollow " + sectors.ToString();
    else if (hollow && inner_hole) identifier = "Hollow Inner " + sectors.ToString();
    else if (hole) identifier = "Indent " + sectors.ToString();
    else if (inner_hole) identifier = "Indent Inner " + sectors.ToString();
    else if (through_hole) identifier = "Through Hole " + sectors.ToString();
    else if (inner_though) identifier = "Through Hole Inner " + sectors.ToString();

    Component.Message = identifier; // "Hello"; // 
    notes = new[] { identifier };

    }

	/*══════════════════════════════════════════════════════════════════════════════╗
	║                                                                               ║
	║                     Additional Functions + Classes Below                      ║
	║                                                                               ║
	╚══════════════════════════════════════════════════════════════════════════════*/


	private Brep through_inner(Curve[] curves, Brep brep, List<double> radii, List<double> bulges, int sectors, double tol, out Curve[] crv_listA, out Curve[] crv_listB)
		{
		//List<Curve> test_crvs = new List<Curve>();
		int count = curves.Length;
		if (count == 1) sectors = (sectors * 2) + 1;
		
		double gap = 1 / (sectors - 1.0);
		Plane pln = Plane.WorldXY;
		LoftType loft_s = LoftType.Straight;

		bool top_sharp = radii[0] == 0;
		bool bot_sharp = radii[1] == 0;

		bool top_chamfer = bulges[0] == 0;
		bool bot_chamfer = bulges[1] == 0;

		int cross_numA = top_chamfer ? 2 : 4;
		int cross_numB = bot_chamfer ? 2 : 4;

		bool remirror = brep.GetBoundingBox(true).Center.Z < 0;  // Put Brep above Plane.XY
		Transform mirror = Transform.Mirror(pln);
		if (remirror) brep.Transform(mirror);


		// ------- Setup Curves ------- //
	
		double radA = -radii[0];
		double radB = -radii[1];

		Curve[] crvA = (top_sharp)
		? Array.ConvertAll(curves, c => c.DuplicateCurve())
		: offset(curves, radA, out _, tol);

		Curve[] crvB = Array.ConvertAll(curves, c => c.DuplicateCurve());
		Curve[] crvC = Array.ConvertAll(curves, c => c.DuplicateCurve());

		Curve[] crvD = (bot_sharp)
			? Array.ConvertAll(curves, c => c.DuplicateCurve())
			: offset(curves, radB, out _, tol);

		Point3d pt_on_other_side = new Point3d(0, 0, brep.GetBoundingBox(true).Max.Z + 1);
		Transform move_to_other_sides = Transform.Translation(new Vector3d(pt_on_other_side));
		TransformGeos(crvC, move_to_other_sides);
		TransformGeos(crvD, move_to_other_sides);


		// ------- Separate BrepFaces ------- //

		Brep[] final_breps = new Brep[count * 3];
		separate_brepfaces(brep, crvA, Z_up, out Brep brep_halfA, out Brep brep_out, out _);
		separate_brepfaces(brep_out, crvD, -Z_up, out Brep brep_halfB, out brep_out, out _);

		double[] ts = new double[sectors];
		for (int i = 0; i < sectors; i++) ts[i] = i * gap;


		// ------- Project Curves ------- //

		crvA = Array.ConvertAll(crvA, c => project_closest(c, brep_halfA, Z_up, tol));
		crvB = (top_sharp)
			? Array.ConvertAll(crvA, c => c.DuplicateCurve())
			: Array.ConvertAll(crvB, c => project_closest(c, brep_halfA, Z_up, tol));

		crvD = Array.ConvertAll(crvD, c => project_closest(c, brep_halfB, -Z_up, tol));
		crvC = (bot_sharp)
			? Array.ConvertAll(crvD, c => c.DuplicateCurve())
			: Array.ConvertAll(crvC, c => project_closest(c, brep_halfB, -Z_up, tol));

		match_sort_crvs(curves, crvA, false);
		match_sort_crvs(curves, crvB, false);
		match_sort_crvs(curves, crvC, false);
		match_sort_crvs(curves, crvD, false);

		Point3d central_ptA = project_point(Point3d.Origin, brep_halfA, Z_up);
		Point3d central_ptB = project_point(pt_on_other_side, brep_halfB, -Z_up);

				Curve[] final_crvsA = new Curve[count];
				Curve[] final_crvsB = new Curve[count];

				Array.Copy(Array.ConvertAll(crvB, c => c.DuplicateCurve()), final_crvsA, count);
				Array.Copy(Array.ConvertAll(crvC, c => c.DuplicateCurve()), final_crvsB, count);

		TransformGeos(crvB, Transform.Translation(0, 0, radii[0]));
		TransformGeos(crvC, Transform.Translation(0, 0, -radii[1]));


		// ---------------------------------------- main loop ---------------------------------------- //

		Curve[] edges_A = new Curve[sectors];
		Curve[] edges_B = new Curve[sectors];

		for (int i = 0; i < count; i++)
		{
			bool straightA = crvA[i].IsLinear(0.01);  //crvA[i].IsLinear(0.01) && crvB[i].IsLinear(0.01);
			bool straightB = crvD[i].IsLinear(0.01);

			for (int j = 0; j < sectors; j++)
			{
			crvB[i].NormalizedLengthParameter(ts[j], out double tB, 1E-03);
			Point3d pB = crvB[i].PointAt(tB);
			crvC[i].NormalizedLengthParameter(ts[j], out double tC, 1E-03);
			Point3d pC = crvC[i].PointAt(tC);

			Curve ln = new LineCurve(pC, pB);

			bool straight_checkA = !straightA || (straightA && (j == 0 || j == sectors - 1));
			bool straight_checkB = !straightB || (straightB && (j == 0 || j == sectors - 1));

			if (!top_sharp && straight_checkA && !top_chamfer)
			{
				crvA[i].NormalizedLengthParameter(ts[j], out double tA, 1E-03);
				Point3d pA = crvA[i].PointAt(tA);
				Vector3d vec = pA - pB;
				vec.Z = 0;

				brep_halfA.ClosestPoint(pA, out _, out ComponentIndex ci, out _, out _, 0.1, out _);
				BrepFace B_face = brep_halfA.Faces[ci.Index];
				Curve cx_crv = GetSurfaceProxyCurve(B_face, pA, vec);

				if (IsClose(pA, cx_crv.PointAtEnd)) cx_crv.Reverse();
				edges_A[j] = Curve.CreateBlendCurve(ln, cx_crv, BlendContinuity.Curvature, bulges[0], bulges[0]);
			}

			if (!bot_sharp && straight_checkB && !bot_chamfer)
			{
				crvD[i].NormalizedLengthParameter(ts[j], out double tD, 1E-03);
				Point3d pD = crvD[i].PointAt(tD);
				Vector3d vec = pD - pC;
				vec.Z = 0;

				brep_halfB.ClosestPoint(pD, out _, out ComponentIndex ci, out _, out _, 0.1, out _);
				BrepFace B_face = brep_halfB.Faces[ci.Index];
				Curve cx_crv = GetSurfaceProxyCurve(B_face, pD, vec);

				if (IsClose(pD, cx_crv.PointAtStart)) cx_crv.Reverse();
				edges_B[j] = Curve.CreateBlendCurve(cx_crv, ln, BlendContinuity.Curvature, bulges[1], bulges[1]);
			}
			}


			if (!top_sharp)
			{
			if (straightA) final_breps[i] = (top_chamfer)
				? Brep.CreateFromLoft(new[] { crvA[i], crvB[i] }, pu, pu, loft_s, false)[0]
				: Brep.CreateFromLoft(new[] { edges_A[0], edges_A[sectors - 1] }, pu, pu, loft_s, false)[0];
			else final_breps[i] = (top_chamfer)
				? Brep.CreateFromLoft(new[] { crvB[i], crvA[i] }, pu, pu, loft_s, false)[0]
				: edge_srf(crvB[i], crvA[i], edges_A, cross_numA);
			}
			if (!bot_sharp)
			{
			if (straightB) final_breps[(count * 2) + i] = (bot_chamfer)
				? Brep.CreateFromLoft(new[] { crvC[i], crvD[i] }, pu, pu, loft_s, false)[0]
				: Brep.CreateFromLoft(new[] { edges_B[0], edges_B[sectors - 1] }, pu, pu, loft_s, false)[0];
			else final_breps[(count * 2) + i] = (bot_chamfer)
				? Brep.CreateFromLoft(new[] { crvD[i], crvC[i] }, pu, pu, loft_s, false)[0]
				: edge_srf(crvD[i], crvC[i], edges_B, cross_numB);
			}
			final_breps[count + i] = Brep.CreateFromLoft(new[] { crvB[i], crvC[i] }, pu, pu, loft_s, false)[0];
		}

		Brep final_brep = BuildFinalBrep(brep_halfA, crvA, brep_halfB, crvD, final_breps, true);

		if (remirror)
		{
			brep.Transform(mirror);
			final_brep.Transform(mirror);
					TransformGeos(final_crvsA, mirror);
					TransformGeos(final_crvsB, mirror);
			//brep.Transform(mirror);
			//for (int i = 0; i < test_crvs.Count; i++) if (test_crvs[i] != null) test_crvs[i].Transform(mirror);
		}

		if (final_brep.SolidOrientation == BrepSolidOrientation.Inward) final_brep.Flip();

				crv_listA = final_crvsA;
				crv_listB = final_crvsB; // .Concat(test_crvs).ToArray();

		return final_brep;
		}
	
	private Brep hole_through(Curve[] curves, Brep brep, List<double> radii, List<double> bulges, int sectors, double tol, out Curve[] crv_listA, out Curve[] crv_listB)
		{
			//List<Curve> test_crvs = new List<Curve>();
			int count = curves.Length;
			if (count == 1) sectors = (sectors * 2) + 1;
			
			double gap = 1 / (sectors - 1.0);
			Plane pln = Plane.WorldXY;
			LoftType loft_s = LoftType.Straight;

			bool top_sharp = radii[0] == 0;
			bool bot_sharp = radii[1] == 0;

			bool top_chamfer = bulges[0] == 0;
			bool bot_chamfer = bulges[1] == 0;

			int cross_numA = top_chamfer ? 2 : 4;
			int cross_numB = bot_chamfer ? 2 : 4;

			bool remirror = brep.GetBoundingBox(true).Center.Z < 0;  // Put Brep above Plane.XY
			Transform mirror = Transform.Mirror(pln);
			if (remirror) brep.Transform(mirror);


			// ------- Setup Curves ------- //
		
			double radA = radii[0];
			double radB = radii[1];

			Curve[] crvA = (top_sharp)
			? Array.ConvertAll(curves, c => c.DuplicateCurve())
			: offset(curves, radA, out _, tol);

			Curve[] crvB = Array.ConvertAll(curves, c => c.DuplicateCurve());
			Curve[] crvC = Array.ConvertAll(curves, c => c.DuplicateCurve());

			Curve[] crvD = (bot_sharp)
			? Array.ConvertAll(curves, c => c.DuplicateCurve())
			: offset(curves, radB, out _, tol);

			Point3d pt_on_other_side = new Point3d(0, 0, brep.GetBoundingBox(true).Max.Z + 1);
			Transform move_to_other_sides = Transform.Translation(new Vector3d(pt_on_other_side));
			TransformGeos(crvC, move_to_other_sides);
			TransformGeos(crvD, move_to_other_sides);


			// ------- Separate BrepFaces ------- //

			Brep[] final_breps = new Brep[count * 3 + 1];
			separate_brepfaces(brep, crvA, Z_up, out Brep brep_halfA, out Brep brep_out, out _);
			separate_brepfaces(brep_out, crvD, -Z_up, out Brep brep_halfB, out final_breps[count * 3], out _);

			double[] ts = new double[sectors];
			for (int i = 0; i < sectors; i++) ts[i] = i * gap;


			// ------- Project Curves ------- //

			crvA = Array.ConvertAll(crvA, c => project_closest(c, brep_halfA, Z_up, tol));
			crvB = (top_sharp)
			? Array.ConvertAll(crvA, c => c.DuplicateCurve())
			: Array.ConvertAll(crvB, c => project_closest(c, brep_halfA, Z_up, tol));

			crvD = Array.ConvertAll(crvD, c => project_closest(c, brep_halfB, -Z_up, tol));
			crvC = (bot_sharp)
			? Array.ConvertAll(crvD, c => c.DuplicateCurve())
			: Array.ConvertAll(crvC, c => project_closest(c, brep_halfB, -Z_up, tol));

			match_sort_crvs(curves, crvA, false);
			match_sort_crvs(curves, crvB, false);
			match_sort_crvs(curves, crvC, false);
			match_sort_crvs(curves, crvD, false);

			Point3d central_ptA = project_point(Point3d.Origin, brep_halfA, Z_up);
			Point3d central_ptB = project_point(pt_on_other_side, brep_halfB, -Z_up);

			Curve[] final_crvsA = new Curve[count];
			Curve[] final_crvsB = new Curve[count];

			Array.Copy(Array.ConvertAll(crvB, c => c.DuplicateCurve()), final_crvsA, count);
			Array.Copy(Array.ConvertAll(crvC, c => c.DuplicateCurve()), final_crvsB, count);

			TransformGeos(crvB, Transform.Translation(0, 0, radii[0]));
			TransformGeos(crvC, Transform.Translation(0, 0, -radii[1]));


			// ---------------------------------------- main loop ---------------------------------------- //

			Curve[] edges_A = new Curve[sectors];
			Curve[] edges_B = new Curve[sectors];

			for (int i = 0; i < count; i++)
			{
			bool straightA = crvA[i].IsLinear(0.01);  //crvA[i].IsLinear(0.01) && crvB[i].IsLinear(0.01);
			bool straightB = crvD[i].IsLinear(0.01);

			for (int j = 0; j < sectors; j++)
			{
				crvB[i].NormalizedLengthParameter(ts[j], out double tB, 1E-03);
				Point3d pB = crvB[i].PointAt(tB);
				crvC[i].NormalizedLengthParameter(ts[j], out double tC, 1E-03);
				Point3d pC = crvC[i].PointAt(tC);
				Curve ln = new LineCurve(pC, pB);

				bool straight_checkA = !straightA || (straightA && (j == 0 || j == sectors - 1));
				bool straight_checkB = !straightB || (straightB && (j == 0 || j == sectors - 1));

				if (!top_sharp && straight_checkA && !top_chamfer)
				{
				crvA[i].NormalizedLengthParameter(ts[j], out double tA, 1E-03);
				Point3d pA = crvA[i].PointAt(tA);
				Vector3d vec = pA - pB;
				vec.Z = 0;

				brep_halfA.ClosestPoint(pA, out _, out ComponentIndex ci, out _, out _, 0.1, out _);
				BrepFace B_face = brep_halfA.Faces[ci.Index];
				Curve cx_crv = GetSurfaceProxyCurve(B_face, pA, vec);

				if (IsClose(pA, cx_crv.PointAtEnd)) cx_crv.Reverse();
				edges_A[j] = Curve.CreateBlendCurve(ln, cx_crv, BlendContinuity.Curvature, bulges[0], bulges[0]);
				}

				if (!bot_sharp && straight_checkB && !bot_chamfer)
				{
				crvD[i].NormalizedLengthParameter(ts[j], out double tD, 1E-03);
				Point3d pD = crvD[i].PointAt(tD);
				Vector3d vec = pD - pC;
				vec.Z = 0;

				brep_halfB.ClosestPoint(pD, out _, out ComponentIndex ci, out _, out _, 0.1, out _);
				BrepFace B_face = brep_halfB.Faces[ci.Index];
				Curve cx_crv = GetSurfaceProxyCurve(B_face, pD, vec);

				if (IsClose(pD, cx_crv.PointAtStart)) cx_crv.Reverse();
				edges_B[j] = Curve.CreateBlendCurve(cx_crv, ln, BlendContinuity.Curvature, bulges[1], bulges[1]);
				}
			}


			if (!top_sharp)
			{
				if (straightA) final_breps[i] = (top_chamfer)
					? Brep.CreateFromLoft(new[] { crvA[i], crvB[i] }, pu, pu, loft_s, false)[0]
					: Brep.CreateFromLoft(new[] { edges_A[0], edges_A[sectors - 1] }, pu, pu, loft_s, false)[0];
				else final_breps[i] = (top_chamfer)
				? Brep.CreateFromLoft(new[] { crvB[i], crvA[i] }, pu, pu, loft_s, false)[0]
				: edge_srf(crvB[i], crvA[i], edges_A, cross_numA);
			}
			if (!bot_sharp)
			{
				if (straightB) final_breps[(count * 2) + i] = (bot_chamfer)
					? Brep.CreateFromLoft(new[] { crvC[i], crvD[i] }, pu, pu, loft_s, false)[0]
					: Brep.CreateFromLoft(new[] { edges_B[0], edges_B[sectors - 1] }, pu, pu, loft_s, false)[0];
				else final_breps[(count * 2) + i] = (bot_chamfer)
				? Brep.CreateFromLoft(new[] { crvD[i], crvC[i] }, pu, pu, loft_s, false)[0]
				: edge_srf(crvD[i], crvC[i], edges_B, cross_numB);
			}
			final_breps[count + i] = Brep.CreateFromLoft(new[] { crvB[i], crvC[i] }, pu, pu, loft_s, false)[0];
			}


			Brep final_brep = BuildFinalBrep(brep_halfA, crvA, brep_halfB, crvD, final_breps, false);

			if (remirror)
			{
			brep.Transform(mirror);
			final_brep.Transform(mirror);
						TransformGeos(final_crvsA, mirror);
						TransformGeos(final_crvsB, mirror);

			//for (int i = 0; i < test_crvs.Count; i++) if (test_crvs[i] != null) test_crvs[i].Transform(mirror);
			}

			if (final_brep.SolidOrientation == BrepSolidOrientation.Inward) final_brep.Flip();

					crv_listA = final_crvsA;
					crv_listB = final_crvsB; //.Concat(test_crvs).ToArray();

			return final_brep;
		}
  
	private Brep hole_inner(Curve[] curves, Brep brep, double extrude, List<double> radii, List<double> bulges, int sectors, double tol, out Plane pl, out Curve[] crv_listA, out Curve[] crv_listB)
		{
			// List<Curve> test_crvs = new();
			bool hollow = extrude == 0;
			
					if (curves.Length == 1) sectors = (sectors * 2) + 1;
			
			double gap = 1 / (sectors - 1.0);
			Plane pln = Plane.WorldXY;
			int count = curves.Length;

			bool top_sharp = radii[0] == 0;
			bool bot_sharp = radii[1] == 0;

			bool top_chamfer = bulges[0] == 0;
			bool bot_chamfer = bulges[1] == 0;

			int cross_numA = top_chamfer ? 2 : 4;
			int cross_numB = bot_chamfer ? 2 : 4;

			bool remirror = brep.GetBoundingBox(true).Center.Z < 0;  // Put Brep above Plane.XY
			Transform mirror = Transform.Mirror(pln);
			if (remirror) brep.Transform(mirror);


			// ------- Setup Planes ------- //

			Plane base_plane = pln;
			Plane inside_plane = pln;
					Point3d central_pt = curves_central_point(curves, brep, Z_up);

					if (hollow && central_pt.Z == 0) { pl = pln; crv_listA = curves; crv_listB = curves; return brep; }
					if (hollow)
					{    // ------- For Hollow Extrude to Surface (no Extrude Input)
			extrude = central_pt.Z;
			extrude *= (extrude < 0) ? 1 : -1;
			}

			double flip = (extrude < 0) ? -1 : 1;

			base_plane.Origin = central_pt;
			base_plane.Transform(Transform.Translation(0, 0, extrude));
			

			// ------- Setup Curves ------- //
		
			double radA = -radii[0];
			double radB = -radii[1];

			Curve[] crvA = (top_sharp)
			? Array.ConvertAll(curves, c => c.DuplicateCurve())
			: offset(curves, radA, out _, tol);


			// ------- Separate BrepFaces ------- //

			Brep[] final_breps = new Brep[count * 3 + 1];
			separate_brepfaces(brep, crvA, Z_up, out Brep brep_half, out Brep brep_out, out Point3d[] flat_pts);  //  , out Curve[] pro_crvs, out Point3d[] pro_pts


			// ------- Test Flat - Use Z Height because Brep is already oriented to the XY Plane ------- //

			BoundingBox flat_bb = new BoundingBox(flat_pts);
			bool flat_srf = flat_bb.Max.Z - flat_bb.Min.Z < tol;

			//Curve[] test_flat_crvs = new Curve[count * 2];
			//Array.Copy(offset(curves, radA - 0.1, out _, tol), test_flat_crvs, count);
			//Array.Copy(crvA, 0, test_flat_crvs, count, count);
			//bool flat_srf = test_flat(test_flat_crvs, brep_half, tol); 

			if (flat_srf)
			{
			Curve[] quick_crvs = new Curve[count];
			for (int i = 0; i < count; i++) quick_crvs[i] = project_closest(curves[i], brep_half, Z_up, tol);
						Brep quick_brep = full_extrude(quick_crvs, extrude, radii, bulges, sectors, false, tol, out Curve[] f_crvsA, out Curve[] f_crvsB);

			if (remirror) 
				{
				quick_brep.Transform(mirror);
				brep.Transform(mirror);
				base_plane.Transform(mirror);
				TransformGeos(quick_crvs, mirror);
							TransformGeos(f_crvsA, mirror);
							TransformGeos(f_crvsB, mirror);
				}

						pl = base_plane; // new Plane(new Point3d(0, 0, extrude), Vector3d.XAxis, Vector3d.YAxis); //
						crv_listA = f_crvsA;
						crv_listB = f_crvsB; // quick_crvs; // 
			return quick_brep;
			}


			// ------- Setup Curves ------- //

			Curve[] crvD = (bot_sharp)
			? Array.ConvertAll(curves, c => c.DuplicateCurve())
			: offset(curves, radB, out _, tol);

			crvA = Array.ConvertAll(crvA, c => project_closest(c, brep_half, Z_up, tol));
			Curve[] crvB = (top_sharp)
			? Array.ConvertAll(crvA, c => c.DuplicateCurve())
			: Array.ConvertAll(curves, c => project_closest(c, brep_half, Z_up, tol));

			if (crvA.Length == 1) align_crvs(crvA[0], crvB[0]);
			match_sort_crvs(crvA, crvB);

			Curve[] crvC = Array.ConvertAll(curves, c => c.DuplicateCurve());
			Curve[] crvE = Array.ConvertAll(crvB, c => c.DuplicateCurve());
					Curve[] final_crvsA = Array.ConvertAll(crvB, c => c.DuplicateCurve());

			double z_move = base_plane.OriginZ;
			double inside_z = base_plane.OriginZ - (radii[1] * flip);
			inside_plane.OriginZ = inside_z;
			TransformGeos(crvB, Transform.Translation(0, 0, radii[0] * flip));
			TransformGeos(crvC, Transform.Scale(inside_plane, 1, 1, 0));
			TransformGeos(crvD, Transform.Scale(base_plane, 1, 1, 0));
			TransformGeos(crvE, Transform.Scale(inside_plane, 1, 1, 0));

					Curve[] final_crvsB = Array.ConvertAll(crvC, c => c.DuplicateCurve());
					TransformGeos(final_crvsB, Transform.Scale(base_plane, 1, 1, 0));

			// ------- main loop ------- //

			BlendContinuity curvature = BlendContinuity.Curvature;
			LoftType straight_loft = LoftType.Straight;

			double[] ts = new double[sectors];
			for (int i = 0; i < sectors; i++) ts[i] = i * gap;

			for (int i = 0; i < count; i++)
			{
			bool straight = crvA[i].IsLinear(0.01);

			Curve[] edges_A = new Curve[sectors];
			Curve[] edges_B = new Curve[sectors];

			for (int j = 0; j < sectors; j++)
			{
				bool straight_check = !straight || (straight && (j == 0 || j == sectors - 1));

				if (!top_sharp && straight_check && !top_chamfer)
				{
				crvA[i].NormalizedLengthParameter(ts[j], out double tA, 1E-03);
				Point3d pA = crvA[i].PointAt(tA);
				crvB[i].NormalizedLengthParameter(ts[j], out double tB, 1E-03);
				Point3d pB = crvB[i].PointAt(tB);

								Point3d pE = new(pB.X, pB.Y, inside_z);
				Curve lnA = new LineCurve(pB, pE);
				Vector3d vec = pA - pB;
				vec.Z = 0;

				brep_half.ClosestPoint(pA, out _, out ComponentIndex ci, out _, out _, 0.1, out _);
				BrepFace B_face = brep_half.Faces[ci.Index];
				Curve cx_crv = GetSurfaceProxyCurve(B_face, pA, vec);

				if (IsClose(pA, cx_crv.PointAtStart)) cx_crv.Reverse();
				edges_A[j] = Curve.CreateBlendCurve(cx_crv, lnA, curvature, bulges[0], bulges[0]);
				}

				if (!bot_sharp && straight_check && !bot_chamfer)
				{
				crvC[i].NormalizedLengthParameter(ts[j], out double tC, 1E-03);
				Point3d pC = crvC[i].PointAt(tC);

				Curve lnC = new LineCurve(new Point3d(pC - Z_up * flip), pC);
				crvD[i].NormalizedLengthParameter(ts[j], out double tD, 1E-03);
				Point3d pD = crvD[i].PointAt(tD);

				Vector3d vec = pD - pC;
				vec.Z = 0;
				Curve lnB = new LineCurve(pD, new Point3d(pD + vec));
				edges_B[j] = Curve.CreateBlendCurve(lnC, lnB, curvature, bulges[1], bulges[1]);
				}
			}

			if (!top_sharp)
			{
				if (straight) final_breps[i] = (top_chamfer)
					? Brep.CreateFromLoft(new[] { crvA[i], crvB[i] }, pu, pu, straight_loft, false)[0]
					: Brep.CreateFromLoft(new[] { edges_A[0], edges_A[sectors - 1] }, pu, pu, straight_loft, false)[0];
				else final_breps[i] = (top_chamfer)
				? Brep.CreateFromLoft(new[] { crvA[i], crvB[i] }, pu, pu, straight_loft, false)[0]
				: edge_srf(crvA[i], crvB[i], edges_A, cross_numA);
			}

			if (!bot_sharp)
			{
				if (straight) final_breps[(count * 2) + i] = (bot_chamfer)
					? Brep.CreateFromLoft(new[] { crvC[i], crvD[i] }, pu, pu, straight_loft, false)[0]
					: Brep.CreateFromLoft(new[] { edges_B[0], edges_B[sectors - 1] }, pu, pu, straight_loft, false)[0];
				else final_breps[(count * 2) + i] = (bot_chamfer)
				? Brep.CreateFromLoft(new[] { crvC[i], crvD[i] }, pu, pu, straight_loft, false)[0]
				: edge_srf(crvC[i], crvD[i], edges_B, cross_numB);
			}

			final_breps[count + i] = Brep.CreateFromLoft(new[] { crvB[i], crvE[i] }, pu, pu, straight_loft, false)[0];
			}


			// ------- Re-Assemble parts ------- //

			final_breps[count * 3] = Brep.CreatePlanarBreps(crvD, 0.001)[0];
			Brep final_brep = BuildFinalBrep(brep_half, crvA, final_breps, true);

			//test_crvs.AddRange(crvA);

			base_plane = orient_plane(base_plane);

			if (remirror)
			{
			//brep_half.Transform(mirror);
			brep.Transform(mirror);
			final_brep.Transform(mirror);
			base_plane.Transform(mirror);
						TransformGeos(final_crvsA, mirror);
						TransformGeos(final_crvsB, mirror);
			}
			else base_plane = new Plane(base_plane.Origin, -Vector3d.ZAxis);


			pl = base_plane; //   Plane.WorldXY;  //  
					crv_listA = final_crvsA; // .Concat(test_crvs).ToArray(); // new[] { new LineCurve(Point3d.Origin, new Point3d(0, 0, 1)) }; // crvA.Concat(crvB).Concat(crvC).Concat(crvD).ToArray(); //  crvD; // test_crvs.ToArray(); // 
					crv_listB = final_crvsB;
			if (final_brep.SolidOrientation == BrepSolidOrientation.Inward) final_brep.Flip();
			
			return final_brep; // brep_half; //  new Brep(); // 
		}

	private Brep hole_extrude(Curve[] curves, Brep brep, double extrude, List<double> radii, List<double> bulges, int sectors, double tol, out Plane pl, out Curve[] crv_listA, out Curve[] crv_listB)
		{
			// List<Curve> test_crvs = new();
			bool hollow = extrude == 0;

			if (curves.Length == 1) sectors = (sectors * 2) + 1;
			
			double gap = 1 / (sectors - 1.0);
			Plane pln = Plane.WorldXY;
			int count = curves.Length;

			bool top_sharp = radii[0] == 0;
			bool bot_sharp = radii[1] == 0;

			bool top_chamfer = bulges[0] == 0;
			bool bot_chamfer = bulges[1] == 0;

			int cross_numA = top_chamfer ? 2 : 4;
			int cross_numB = bot_chamfer ? 2 : 4;

			bool remirror = brep.GetBoundingBox(true).Center.Z < 0;  // Put Brep above Plane.XY
			Transform mirror = Transform.Mirror(pln);
			if (remirror) brep.Transform(mirror);


			// ------- Setup Curves ------- //
		
			double radA = radii[0];
			double radB = -radii[1];

			Curve[] crvA = (top_sharp)
			? Array.ConvertAll(curves, c => c.DuplicateCurve())
			: offset(curves, radA, out _, tol);


			// ------- Separate BrepFaces ------- //

			Brep[] final_breps = new Brep[count * 3 + 2];
			separate_brepfaces(brep, crvA, Z_up, out Brep brep_half, out final_breps[count * 3 + 1], out _);  //  , out Curve[] pro_crvs, out Point3d[] pro_pts


			// ------- Setup Curves ------- //

			Curve[] crvD = bot_sharp
			? Array.ConvertAll(curves, c => c.DuplicateCurve())
			: offset(curves, radB, out _, tol);

			crvA = Array.ConvertAll(crvA, c => project_closest(c, brep_half, Z_up, tol));
			Curve[] crvB = top_sharp
			? Array.ConvertAll(crvA, c => c.DuplicateCurve())
			: Array.ConvertAll(curves, c => project_closest(c, brep_half, Z_up, tol));

			if (crvA.Length == 1) align_crvs(crvA[0], crvB[0]);
			match_sort_crvs(crvA, crvB);

			Curve[] crvC = Array.ConvertAll(curves, c => c.DuplicateCurve());
			Curve[] crvE = Array.ConvertAll(crvB, c => c.DuplicateCurve());
			Curve[] final_crvsA = Array.ConvertAll(crvB, c => c.DuplicateCurve());


			// ------- Setup Planes ------- //

			Plane base_plane = pln;
			Plane inside_plane = pln;
					Point3d central_pt = curves_central_point(curves, brep, Z_up);

			if (hollow && central_pt.Z == 0) { pl = pln; crv_listA = curves; crv_listB = curves; return brep; }
			if (hollow)
			{    // ------- For Hollow Extrude to Surface (no Extrude Input)
			extrude = central_pt.Z;
			extrude *= (extrude < 0) ? 1 : -1;
			}

			double flip = (extrude < 0) ? -1 : 1;

			base_plane.Origin = central_pt;
			base_plane.Transform(Transform.Translation(0, 0, extrude));   
			double z_move = base_plane.OriginZ;                           

			double inside_z = base_plane.OriginZ - (radii[1] * flip);
			inside_plane.OriginZ = inside_z;
			TransformGeos(crvB, Transform.Translation(0, 0, radii[0] * flip));
			TransformGeos(crvC, Transform.Scale(inside_plane, 1, 1, 0));
			TransformGeos(crvD, Transform.Scale(base_plane, 1, 1, 0));
			TransformGeos(crvE, Transform.Scale(inside_plane, 1, 1, 0));

			Curve[] final_crvsB = Array.ConvertAll(crvC, c => c.DuplicateCurve());
			TransformGeos(final_crvsB, Transform.Scale(base_plane, 1, 1, 0));

			// ------- main loop ------- //

			BlendContinuity curvature = BlendContinuity.Curvature;
			LoftType straight_loft = LoftType.Straight;

			double[] ts = new double[sectors];
			for (int i = 0; i < sectors; i++) ts[i] = i * gap;

			for (int i = 0; i < count; i++)
			{
			bool straight = crvA[i].IsLinear(0.01);

			Curve[] edges_A = new Curve[sectors];
			Curve[] edges_B = new Curve[sectors];

			for (int j = 0; j < sectors; j++)
			{
				bool straight_check = !straight || (straight && (j == 0 || j == sectors - 1));

				if (!top_sharp && straight_check && !top_chamfer)
				{
				crvA[i].NormalizedLengthParameter(ts[j], out double tA, 1E-03);
				Point3d pA = crvA[i].PointAt(tA);
				crvB[i].NormalizedLengthParameter(ts[j], out double tB, 1E-03);
				Point3d pB = crvB[i].PointAt(tB);

				Point3d pE = new (pB.X, pB.Y, inside_z);
				Curve lnA = new LineCurve(pB, pE);
				Vector3d vec = pA - pB;
				vec.Z = 0;

				brep_half.ClosestPoint(pA, out _, out ComponentIndex ci, out _, out _, 0.1, out _);
				BrepFace B_face = brep_half.Faces[ci.Index];
				Curve cx_crv = GetSurfaceProxyCurve(B_face, pA, vec);

				if (IsClose(pA, cx_crv.PointAtStart)) cx_crv.Reverse();
				edges_A[j] = Curve.CreateBlendCurve(cx_crv, lnA, curvature, bulges[0], bulges[0]);
				}

				if (!bot_sharp && straight_check && !bot_chamfer)
				{
				crvC[i].NormalizedLengthParameter(ts[j], out double tC, 1E-03);
				Point3d pC = crvC[i].PointAt(tC);
				Curve lnC =  new LineCurve(new Point3d(pC - Z_up * flip), pC);

				crvD[i].NormalizedLengthParameter(ts[j], out double tD, 1E-03);
				Point3d pD = crvD[i].PointAt(tD);

				Vector3d vec = pD - pC;
				vec.Z = 0;
				Curve lnB = new LineCurve(pD, new Point3d(pD + vec));
				edges_B[j] = Curve.CreateBlendCurve(lnC, lnB, curvature, bulges[1], bulges[1]);
				}
			}

			if (!top_sharp)
			{
				if (straight) final_breps[i] = (top_chamfer)
					? Brep.CreateFromLoft(new[] { crvA[i], crvB[i] }, pu, pu, straight_loft, false)[0]
					: Brep.CreateFromLoft(new[] { edges_A[0], edges_A[sectors - 1] }, pu, pu, straight_loft, false)[0];
				else final_breps[i] = (top_chamfer)
				? Brep.CreateFromLoft(new[] { crvA[i], crvB[i] }, pu, pu, straight_loft, false)[0]
				: edge_srf(crvA[i], crvB[i], edges_A, cross_numA);
			}

			if (!bot_sharp)
			{
				if (straight) final_breps[(count * 2) + i] = (bot_chamfer)
					? Brep.CreateFromLoft(new[] { crvC[i], crvD[i] }, pu, pu, straight_loft, false)[0]
					: Brep.CreateFromLoft(new[] { edges_B[0], edges_B[sectors - 1] }, pu, pu, straight_loft, false)[0];
				else final_breps[(count * 2) + i] = (bot_chamfer)
				? Brep.CreateFromLoft(new[] { crvC[i], crvD[i] }, pu, pu, straight_loft, false)[0]
				: edge_srf(crvC[i], crvD[i], edges_B, cross_numB);
			}

			final_breps[count + i] = Brep.CreateFromLoft(new[] { crvB[i], crvE[i] }, pu, pu, straight_loft, false)[0];
			}


			// ------- Re-Assemble parts ------- //

			final_breps[count * 3] = Brep.CreatePlanarBreps(crvD, 0.001)[0];

			Brep final_brep = BuildFinalBrep(brep_half, crvA, final_breps, false);

			base_plane = orient_plane(base_plane);

			if (remirror)
			{
			final_brep.Transform(mirror);
			brep.Transform(mirror);  //  **** Might need to re-comment this out if soemthing strange happens.  I uncommented it because the other methods did too...

			base_plane.Transform(mirror);
			TransformGeos(final_crvsA, mirror);
			TransformGeos(final_crvsB, mirror);

			//for (int i = 0; i < test_crvs.Count; i++) if (test_crvs[i] != null) test_crvs[i].Transform(mirror);
			}
			else base_plane = new Plane(base_plane.Origin, -Vector3d.ZAxis);
			
			pl = base_plane; //   Plane.WorldXY;  //  
			crv_listA = final_crvsA; // .Concat(test_crvs).ToArray(); // new[] { new LineCurve(Point3d.Origin, new Point3d(0, 0, 1)) }; // crvA.Concat(crvB).Concat(crvC).Concat(crvD).ToArray(); //  crvD; //
			crv_listB = final_crvsB;

			if (final_brep.SolidOrientation == BrepSolidOrientation.Inward) final_brep.Flip();
			
			return final_brep; // test_box.ToBrep(); // brep_half; // new Brep(); //  
		}


        // ------------------------------------ Basic Extrudes ------------------------------------ //

	private static Brep full_extrude(Curve[] crvs, double extrude, List<double> rads, List<double> bulges, int sectors, bool centre, double tol, out Curve[] crv_listA, out Curve[] crv_listB)
		{
			// List<Curve> test_crvs = new();
	  		sort_crvs(crvs);
			Plane plane = curves_plane(crvs);
			Transform orient = Transform.PlaneToPlane(plane, Plane.WorldXY);
			Transform reorient = Transform.PlaneToPlane(Plane.WorldXY, plane);

			TransformGeos(crvs, orient);

			// -------  Set Up Standard Variables  ------- //

			int count = crvs.Length;
			int v_num = (count == 1) ? v_num = sectors - 1 : sectors;

			bool loop = count == 1 && crvs[0].IsClosed;

			bool mirror = !centre && extrude != Math.Abs(extrude);
			extrude = Math.Abs(extrude);

			// -------  Set Up Radii and Decide if should add Sides  ------- //

			double[] radii = { Math.Max(rads[0], 0), Math.Max(rads[1], 0) };

			bool has_sides = radii[0] < extrude;
			if (!has_sides) { radii[0] = extrude; radii[1] = 0; }
			if (radii[1] > extrude - radii[0])
			{
			radii[1] = extrude - radii[0];
			has_sides = false;
			}

			bool C2arcA = bulges[0] <= -1 && (radii[0] * 1.5) <= extrude - radii[1];
			bool C2arcB = bulges[1] <= -1 && (radii[1] * 1.5) <= extrude - radii[0];
			if (C2arcA) { radii[0] *= 1.5; bulges[0] = 0.72; }
			if (C2arcB) { radii[1] *= 1.5; bulges[1] = 0.72; }

			bool has_radA = radii[0] != 0;
			bool has_radB = radii[1] != 0;


			// -------  Set Up Curves  ------- //

			Curve[] crvA = offset(crvs, -radii[0], out _, tol);
			Curve[] crvB = Array.ConvertAll(crvs, c => c.DuplicateCurve());
			Curve[] crvC = Array.ConvertAll(crvs, c => c.DuplicateCurve());
			Curve[] crvD = offset(crvs, -radii[1], out _, tol);

			if (Math.Abs(crvA[0].PointAtStart.DistanceTo(crvB[0].PointAtStart) - radii[0]) > tol) match_sort_crvs(crvA, crvB);
			if (Math.Abs(crvD[0].PointAtStart.DistanceTo(crvB[0].PointAtStart) - radii[1]) > tol) match_sort_crvs(crvD, crvB);

			Transform moveA = Transform.Translation(0, 0, radii[0]);
			Transform moveB = Transform.Translation(0, 0, radii[1]);
			Transform moveC = Transform.Translation(0, 0, extrude - (radii[1] * 2));
			Transform moveD = Transform.Translation(0, 0, extrude);

			Transform mirror_trans = Transform.Mirror(Plane.WorldXY);
			Transform centre_trans = Transform.Translation(0, 0, -(extrude * 0.5));


			// -------  Setup Output Curves  ------- //

			Curve[] final_crvsA = Array.ConvertAll(crvs, c => c.DuplicateCurve());
			Curve[] final_crvsB = Array.ConvertAll(crvs, c => c.DuplicateCurve());


			// -------  Main Loop - Build Surfaces  ------- //

			Brep[] srfs = new Brep[(count * 3) + 2];
			Curve[] side_crvs = new Curve[2];
			LoftType lt = LoftType.Straight;

			for (int i = 0; i < count; i++)
			{
			crvB[i].Transform(moveA);  // ---- Arrange Curves---- //
			crvC[i].Transform(moveB);
			int edge_num = crvB[i].IsLinear(0.01) ? 2 : sectors;

			if (has_radA)
			{
				int cross_num = (bulges[0] == 0) ? 2 : 4;
				Curve[] edge_curves = simple_edges(crvA[i], crvB[i], bulges[0], edge_num);
				srfs[count + i] = edge_srf(crvA[i], crvB[i], edge_curves, cross_num);
			}

			if (has_radB)
			{
				int cross_num = (bulges[1] == 0) ? 2 : 4;
				Curve[] edge_curves = simple_edges(crvD[i], crvC[i], bulges[1], edge_num);
				srfs[(count * 2) + i] = edge_srf(crvD[i], crvC[i], edge_curves, cross_num);
				srfs[(count * 2) + i].Transform(mirror_trans);
				srfs[(count * 2) + i].Transform(moveD);
			}

			crvC[i].Transform(moveC);

			if (has_sides)
			{
					side_crvs[0] = crvB[i];
					side_crvs[1] = crvC[i];
					srfs[i] = Brep.CreateFromLoft(side_crvs, pu, pu, lt, false)[0];
				}
			final_crvsB[i].Transform(moveD);
			}

			srfs[count * 3] = Brep.CreatePlanarBreps(crvA, 0.01)[0];
			srfs[(count * 3) + 1] = Brep.CreatePlanarBreps(crvD, 0.01)[0];
			srfs[(count * 3) + 1].Transform(moveD);

			Brep brep = Brep.JoinBreps(srfs, 0.1, 0.1)[0];

				if (mirror) { 
					brep.Transform(mirror_trans); 
					TransformGeos(final_crvsA, mirror_trans);
					TransformGeos(final_crvsB, mirror_trans);
				}
				if (centre) { 
					brep.Transform(centre_trans); 
					TransformGeos(final_crvsA, centre_trans);
					TransformGeos(final_crvsB, centre_trans);
				}

			brep.Transform(reorient);
			TransformGeos(final_crvsA, reorient);
			TransformGeos(final_crvsB, reorient);

			crv_listA = final_crvsA;
			crv_listB = final_crvsB;
			return brep; // new Brep();// 
		}
		
        private static Brep quick_extrude(Curve[] crvs, double extrude, double radius, double bulge, int sectors, bool centre, double tol, out Curve[] crv_listA, out Curve[] crv_listB)
  {
    // -------  Set Up Conditions  ------- //
    // List<Curve> test_crvs = new();

    int count = crvs.Length;
    bool loop = count == 1 && crvs[0].IsClosed;
    bool mirror = !centre && extrude != Math.Abs(extrude);
    extrude = Math.Abs(extrude);
    int cross_num = (bulge == 0) ? 2 : 4;

    bool has_sides = radius < extrude * 0.5;
    if (!has_sides) radius = extrude * 0.5;

    bool C2arc = bulge <= -1 && (radius * 3) + tol < extrude; // bulge is less than one and does not make the radius bigger than half the extrude
    if (C2arc)
    {
      radius *= 1.5;
      bulge = 0.72;
    }

    // -------  Set Up Standard Variables  ------- //

    Curve[] crvA = offset(crvs, -radius, out _, tol);

    // test_crvs.AddRange(crvA);

    Curve[] crvC = Array.ConvertAll(crvs, c => c.DuplicateCurve());
    if (Math.Abs(crvA[0].PointAtStart.DistanceTo(crvs[0].PointAtStart) - radius) > tol) match_sort_crvs(crvA, crvs);

    Transform moveB = Transform.Translation(0, 0, radius);
    Transform moveC = Transform.Translation(0, 0, extrude - radius);
    Transform moveD = Transform.Translation(0, 0, extrude);
    Transform moveC2 = Transform.Translation(0, 0, radius);

    Transform mirror_trans = Transform.Mirror(Plane.WorldXY);
    Transform centre_trans = Transform.Translation(0, 0, -(extrude * 0.5));


    // -------  Setup Output Curves  ------- //

    Curve[] final_crvsA = Array.ConvertAll(crvs, c => c.DuplicateCurve());
    Curve[] final_crvsB = Array.ConvertAll(crvs, c => c.DuplicateCurve());


    // -------  Main Loop - Build Surfaces  ------- //

    Brep[] srfs = new Brep[(count * 3) + 2];

	LoftType lt = LoftType.Straight;
	Curve[] crv_sides = new Curve[2];

    for (int i = 0; i < count; i++)
    {
		bool straight = crvs[i].IsLinear(0.01);
		crvs[i].Transform(moveB);  // ---- Arrange Curves---- //
		crvC[i].Transform(moveC);
		crv_sides[0] = crvs[i];
		crv_sides[1] = crvC[i];
    if (has_sides) srfs[i] = Brep.CreateFromLoft(crv_sides, pu, pu, lt, false)[0];
		srfs[i].Flip();
		int edge_num = straight ? 2 : sectors;

      Curve[] edges = simple_edges(crvA[i], crvs[i], bulge, edge_num);
      srfs[count + i] = edge_srf(crvs[i], crvA[i], edges, cross_num);

      srfs[(count * 2) + i] = srfs[count + i].DuplicateBrep();
      srfs[(count * 2) + i].Transform(mirror_trans);
      srfs[(count * 2) + i].Transform(moveD);
      
      final_crvsB[i].Transform(moveD);
      //test_crvs.AddRange(edges);
    }

    // Curve[] tc = test_crvs.ToArray();

    srfs[count * 3] = Brep.CreatePlanarBreps(crvA, 0.001)[0];
    srfs[(count * 3) + 1] = srfs[count * 3].DuplicateBrep();
    srfs[(count * 3) + 1].Transform(moveD);

    Brep brep = Brep.JoinBreps(remove_nulls(srfs), 0.001, 0.1)[0];

            if (mirror)
            {
                brep.Transform(mirror_trans);
                TransformGeos(final_crvsA, mirror_trans);
                TransformGeos(final_crvsB, mirror_trans);
            }
            if (centre)
            {
                brep.Transform(centre_trans);
                TransformGeos(final_crvsA, centre_trans);
                TransformGeos(final_crvsB, centre_trans);
            }

            crv_listA = final_crvsA;
            crv_listB = final_crvsB;
    return brep;
  }

private static Brep capped_extrude(Curve[] crvs, out Curve[] crv_listA, out Curve[] crv_listB, double length = 5.0, bool centre = false)
  {
    int count = crvs.Length;
	Plane pl = curves_plane(crvs);
    Vector3d dir = pl.Normal * length;
            Transform move = Transform.Translation(dir);
            if (centre)
            {
		TransformGeos(crvs, Transform.Translation(-dir * 0.5));
		pl.Transform(Transform.Translation(-dir * 0.5));
	}

            Curve[] final_crvsA = Array.ConvertAll(crvs, c => c.DuplicateCurve());
            Curve[] final_crvsB = Array.ConvertAll(crvs, c => c.DuplicateCurve());
            TransformGeos(final_crvsB, move);

    Brep[] sides = new Brep[count + 2];
	LoftType lt = LoftType.Straight;
	Curve[] crv_sides = new Curve[2];
    for (int i = 0; i < count; i++)
    {
                crv_sides[0] = final_crvsA[i];
                crv_sides[1] = final_crvsB[i];
		sides[i + 1] = Brep.CreateFromLoft(crv_sides, pu, pu, lt, false)[0]; // Surface.CreateExtrusion(crvs[i], dir).ToBrep();
    }
	sides[0] = Brep.CreatePlanarBreps(crvs, 0.001)[0];
    sides[count + 1] = sides[0].DuplicateBrep();
    sides[count + 1].Transform(move);

    Brep body = Brep.JoinBreps(sides, 0.001, 0.1)[0];
    if (body.SolidOrientation == BrepSolidOrientation.Inward) body.Flip();

            crv_listA = final_crvsA;
            crv_listB = final_crvsB;
    return body;
  }


        // ------------------------------------ Sub Constructions ------------------------------------ //

private static Brep BuildFinalBrep(Brep brep_half, Curve[] curves, Brep[] final_breps, bool inside = false)
        {
            Brep[] final_joined = Brep.JoinBreps(final_breps, 0.001, 0.1);
            if (final_joined.Length > 1) final_joined = Brep.JoinBreps(final_joined, 0.01, 0.1);

            BoundingBox test_box = bb_union(curves, 0.1);

            Brep[] split = brep_half.Split(curves, 0.001);
            int spl_len = split.Length;
            int fj_len = final_joined.Length;

            int maxCount = spl_len + fj_len;
            Brep[] pieces = new Brep[maxCount];
            int piece_count = 0;

            for (int i = 0; i < spl_len; ++i)
            {
                bool condition = boxboxinside2D(test_box, split[i].GetBoundingBox(true));
                if ((inside && condition) || (!inside && !condition)) pieces[piece_count++] = split[i];
            }

            for (int i = 0; i < fj_len; ++i) pieces[piece_count++] = final_joined[i];

            Brep[] joined = Brep.JoinBreps(remove_nulls(pieces), 0.001, 0.1);
            if (joined.Length > 1 || !joined[0].IsSolid) joined = Brep.JoinBreps(joined, 0.01, 0.1);

            return joined[0];
        }

        private static Brep BuildFinalBrep(Brep brep_halfA, Curve[] curves_A, Brep brep_halfB, Curve[] curves_B, Brep[] final_breps, bool inside = false)
        {
            // First join the existing final breps
            Brep[] final_joined = Brep.JoinBreps(final_breps, 0.001, 0.1);

            // Compute bounding boxes for each curve set
            BoundingBox test_boxA = bb_union(curves_A, 0.1);
            BoundingBox test_boxB = bb_union(curves_B, 0.1);

            // Split each half with its curve set
            Brep[] splitA = brep_halfA.Split(curves_A, 0.01);
            Brep[] splitB = brep_halfB.Split(curves_B, 0.01);

            int spl_A_len = splitA.Length;
            int spl_B_len = splitB.Length;
            int fj_len = final_joined.Length;

            int maxCount = spl_A_len + spl_B_len + fj_len;
            Brep[] pieces = new Brep[maxCount];
            int piece_count = 0;

            // Collect pieces from splitA
            for (int i = 0; i < spl_A_len; ++i)
            {
                bool condition = boxboxinside2D(test_boxA, splitA[i].GetBoundingBox(true));
                if ((inside && condition) || (!inside && !condition)) pieces[piece_count++] = splitA[i];
            }

            // Collect pieces from splitB
            for (int i = 0; i < spl_B_len; ++i)
            {
                bool condition = boxboxinside2D(test_boxB, splitB[i].GetBoundingBox(true));
                if ((inside && condition) || (!inside && !condition))
                    pieces[piece_count++] = splitB[i];
            }

            // Add existing final breps
            for (int i = 0; i < fj_len; ++i) pieces[piece_count++] = final_joined[i];

            // Remove nulls and join
            Brep[] joined = Brep.JoinBreps(remove_nulls(pieces), 0.001, 0.1);
            if (joined.Length > 1 || !joined[0].IsSolid) joined = Brep.JoinBreps(joined, 0.01, 0.1);

            return joined[0];
        }



// ------------------------------------ Updated Needs Checking ------------------------------------ //

        private static void align_crvs(Curve crvA, Curve crvB)
    {
        if (crvA.PointAtStart.DistanceToSquared(crvB.PointAtStart) > crvA.PointAtStart.DistanceToSquared(crvB.PointAtEnd)) crvB.Reverse();
    }



  // ------------------------------------ Optimized Already ------------------------------------ //


private static Point3d project_point(Point3d pt, Brep brep, Vector3d direction) // Optimised
  {
    pt = new Point3d(pt - direction);
    Point3d[] pts = Intersection.RayShoot(new Ray3d(pt, direction), new[] { brep }, 1);
    return pts[0];
  }


  private static Point3d curves_central_point(Curve[] curves, Brep brep, Vector3d direction)
  {
      double minZ = double.MaxValue;                     // initialise to largest possible value

      for (int i = 0, n = curves.Length; i < n; ++i)
      {
          double projZ = project_point(curves[i].PointAtMid, brep, direction).Z;          // project the curve’s midpoint onto the brep and get its Z‑value
          if (projZ < minZ) minZ = projZ;                // keep the smallest Z seen
      }
      return new Point3d(0.0, 0.0, minZ);
  }


  private static Curve project_closest(Curve crv, Brep brep, Vector3d dir, double tol)  // Optimised
  {
    crv.Transform(Transform.Translation(-dir));
    Curve[] projected_curves = Curve.ProjectToBrep(crv, brep, dir, tol);
    Curve[] projected_joined = Curve.JoinCurves(projected_curves, tol, false);

    Point3d centre = crv.PointAtMid;
    int closestIndex = 0;
    double minDistance = double.MaxValue;

    for (int i = 0; i < projected_joined.Length; i++)
    {
      double distance = centre.DistanceToSquared(projected_joined[i].PointAtMid);
      if (distance < minDistance)
      {
        minDistance = distance;
        closestIndex = i;
      }
    }

    return projected_joined[closestIndex];
  }
  
  private static Brep edge_srf(Curve top, Curve bottom, Curve[] edge_curves, int num, bool loop = false, double tol = 0.001)
  {
    if (num < 3 || edge_curves == null)
    {
      return Brep.CreateFromLoft(new[] { top, bottom }, pu, pu, LoftType.Straight, false)[0];
    }

    double ang_tol = 0.1;
    double cos_tol = Math.Cos(ang_tol);

    Vector3d[] axes = new Vector3d[] { Vector3d.XAxis, -Vector3d.XAxis, Vector3d.YAxis, -Vector3d.YAxis, Vector3d.ZAxis, -Vector3d.ZAxis };

    Vector3d start = top.TangentAtStart;
    Vector3d end = top.TangentAtEnd;
    for (int i = 0; i < 6; i++)
    {
      if (start * axes[i] > cos_tol) { start = axes[i]; break; }
    }
    for (int i = 0; i < 6; i++)
    {
      if (end * axes[i] > cos_tol) { end = axes[i]; break; }
    }

    int count = edge_curves.Length;
    double gap = 1 / (num - 1.0);

    Curve[] curves = new Curve[num];

    if (IsClose(edge_curves[0].PointAtStart, top.PointAtStart) || IsClose(edge_curves[0].PointAtStart, top.PointAtEnd))
         { curves[0] = top; curves[num - 1] = bottom; }
    else { curves[0] = bottom; curves[num - 1] = top; }


    int pt_num = loop ? count + 1 : count;
    Point3d[] edge_mid_pts = new Point3d[pt_num];

    // Pre-calculate parameters
    double[,] parameters = new double[num, count];
    for (int i = 1; i < num - 1; i++)
    {
        double gap_size = gap * i;
        for (int j = 0; j < count; j++) edge_curves[j].NormalizedLengthParameter(gap_size, out parameters[i, j], 1E-03);
    }

    for (int i = 1; i < num - 1; i++)
    {
      for (int j = 0; j < count; j++)
      {
        edge_mid_pts[j] = edge_curves[j].PointAt(parameters[i, j]);
      }

      if (loop) edge_mid_pts[count] = edge_mid_pts[0];

      Curve edge_mid = Curve.CreateInterpolatedCurve(edge_mid_pts, 3, CurveKnotStyle.Uniform, start, end);
      if (loop) 
      {
        if (edge_mid.IsCircle(0.01)) edge_mid = new ArcCurve(new Circle(edge_mid_pts[0], edge_mid_pts[1], edge_mid_pts[2])); //circle_check(edge_mid, edge_mid_pts);
        else edge_mid = square_crv(edge_mid);
      }
      else edge_mid = square_crv(edge_mid);
      curves[i] = edge_mid;
    }

    if (top.IsClosed) Array.Resize(ref edge_curves, edge_curves.Length - 1);

    NurbsSurface surface = NurbsSurface.CreateNetworkSurface(curves, 3, 3, edge_curves, 3, 3, tol, tol, tol, out _);
    surface ??= NurbsSurface.CreateNetworkSurface(new[] { top, bottom }, 3, 3, edge_curves, 3, 3, tol, tol, tol, out _);

    return surface.ToBrep(); // new Brep(); //
  }  // optimized
  
  private static Curve[] simple_edges(Curve crvA, Curve crvB, double bulge, int sectors)
	{
		double gap = 1.0 / (sectors - 1.0);
		Point3d[] ptsA = new Point3d[sectors];
		Point3d[] ptsB = new Point3d[sectors];
		for (int i = 0; i < sectors; ++i)
		{
			double t = gap * i;
      		crvA.NormalizedLengthParameter(t, out double tA, 1E-03);
			ptsA[i] = crvA.PointAt(tA);
      		crvB.NormalizedLengthParameter(t, out double tB, 1E-03);
			ptsB[i] = crvB.PointAt(tB);
		}

		Curve[] edge_curves = new Curve[sectors];

		// Output Chamfers    
            if (bulge == 0)
            {
                for (int i = 0; i < sectors; ++i) edge_curves[i] = new LineCurve(ptsA[i], ptsB[i]);
				return edge_curves;
			}

		// Output Arcs
            if (bulge < 0)
            {
                for (int i = 0; i < sectors; ++i) edge_curves[i] = new ArcCurve(new Arc(ptsB[i], -Vector3d.ZAxis, ptsA[i]));
				return edge_curves;
			}

		// Output Blends
		//Curve side_ln = new LineCurve(new Point3d(0, 0, 1), Point3d.Origin);
			for (int i = 0; i < sectors; ++i)
			{
				Vector3d vec = ptsA[i] - ptsB[i];
				vec.Z = 0;
				Curve crv0 = new LineCurve(ptsA[i], ptsA[i] + vec);

				Curve side_ln = new LineCurve(new Point3d(ptsB[i].X, ptsB[i].Y, ptsB[i].Z + 1), ptsB[i]);
				edge_curves[i] = Curve.CreateBlendCurve(side_ln, crv0, BlendContinuity.Curvature, bulge, bulge);

			}
		return edge_curves;
	}
  

// ------------------------------------ Copied from ID_Tools_Library.ID_Tools_Class ------------------------------------ //
  




	// public static Curve[] offset(Curve[] curves, double fillet, out Plane pln, double tol = 0.01, double arc_tol = 0.05)
	// {
	// 	int num = curves.Length;
	// 	Plane plane = curves_plane(curves);
	// 	pln = orient_plane(plane);
	// 	Point3d origin = plane.Origin;
	// 	Vector3d normal = plane.Normal;
	// 	CurveOffsetCornerStyle cornerStyle = CurveOffsetCornerStyle.Smooth;
	// 	CurveOffsetEndStyle endStyle = CurveOffsetEndStyle.None;
	// 	Curve[] array = new Curve[num];
	// 	if (fillet == 0.0)
	// 	{
	// 		for (int i = 0; i < num; i++)
	// 		{
	// 			array[i] = curves[i].DuplicateCurve();
	// 		}
	// 		return array;
	// 	}
	// 	if (num == 1)
	// 	{
	// 		bool loose = !arc_test(curves[0]);
	// 		Curve[] array2 = curves[0].Offset(origin, normal, fillet, tol, tol, loose, cornerStyle, endStyle);
	// 		if (curves[0].IsClosed)
	// 		{
	// 			double length = curves[0].GetBoundingBox(accurate: true).Diagonal.Length;
	// 			GeometryBase[] geos = array2;
	// 			double length2 = bb_union(geos).Diagonal.Length;
	// 			if ((fillet > 0.0 && length2 < length) || (fillet < 0.0 && length2 > length))
	// 			{
	// 				fillet = 0.0 - fillet;
	// 				array2 = curves[0].Offset(origin, normal, fillet, tol, tol, loose, cornerStyle, endStyle);
	// 			}
	// 		}
	// 		return array2;
	// 	}
	// 	bool flag = IsClose(curves[0].PointAtStart, curves[^1].PointAtEnd);
	// 	for (int j = 0; j < num; j++)
	// 	{
	// 		Curve[] array3 = curves[j].Offset(origin, normal, 0.0 - fillet, tol, tol, loose: false, cornerStyle, endStyle);
	// 		array[j] = ((array3.Length > 1) ? Curve.JoinCurves(array3, tol, preserveDirection: false)[0] : array3[0]);
	// 	}
	// 	if (flag)
	// 	{
	// 		GeometryBase[] geos = curves;
	// 		double length3 = bb_union(geos).Diagonal.Length;
	// 		geos = array;
	// 		double length4 = bb_union(geos).Diagonal.Length;
	// 		if ((fillet > 0.0 && length4 < length3) || (fillet < 0.0 && length4 > length3))
	// 		{
	// 			fillet = 0.0 - fillet;
	// 			for (int k = 0; k < num; k++)
	// 			{
	// 				Curve[] array4 = curves[k].Offset(origin, normal, 0.0 - fillet, tol, tol, loose: false, cornerStyle, endStyle);
	// 				array[k] = ((array4.Length > 1) ? Curve.JoinCurves(array4, tol, preserveDirection: false)[0] : array4[0]);
	// 			}
	// 		}
	// 	}
	// 	array = loop_crv(array, fillet, flag);
	// 	clean_offset(array);
	// 	return array;
	// }

	// public static Curve[] loop_crv(Curve[] curves, double radius, bool closed_loop = true, double tol = 0.0001, double arc_tol = 0.03)
	// {
	// 	int num = curves.Length;
	// 	double length = Math.Abs(radius) * 1.1;
	// 	int num2 = (closed_loop ? num : (num - 1));



	// 	Console.WriteLine(" - " + curves[2].GetLength().ToString());
	// 	for (int i = 0; i < num2; i++)
	// 	{
	// 		int num3 = (closed_loop ? ((i + 1) % num) : (i + 1));
	// 		Console.WriteLine(i.ToString() + ", " + num3.ToString());
	// 		if (!IsClose(curves[i].PointAtEnd, curves[num3].PointAtStart))
	// 		{
	// 			Curve curve = curves[i].Extend(CurveEnd.End, length, CurveExtensionStyle.Smooth);
	// 			Curve curve2 = curves[num3].Extend(CurveEnd.Start, length, CurveExtensionStyle.Smooth);
	// 			CurveIntersections curveIntersections = Intersection.CurveCurve(curve, curve2, tol, tol);
	// 			if (curveIntersections != null && curveIntersections.Count != 0)
	// 			{
	// 				curves[i] = curve.Trim(curve.Domain.Min, curveIntersections[0].ParameterA);
	// 				curves[num3] = curve2.Trim(curveIntersections[0].ParameterB, curve2.Domain.Max);
	// 			}
	// 		}
	// 	}
	// 	for (int j = 0; j < num; j++)
	// 	{
	// 		Vector3d tangentAtStart = curves[j].TangentAtStart;
	// 		Vector3d tangentAtEnd = curves[j].TangentAtEnd;
	// 		Point3d pointAtStart = curves[j].PointAtStart;
	// 		Point3d pointAtEnd = curves[j].PointAtEnd;
	// 		if (IsCloseVec(tangentAtStart, tangentAtEnd) && curves[j].IsLinear(0.01))
	// 		{
	// 			curves[j] = new LineCurve(pointAtStart, pointAtEnd);
	// 		}
	// 		else if (arc_test(curves[j], arc_tol))
	// 		{
	// 			Curve curve3 = new ArcCurve(new Arc(pointAtStart, curves[j].PointAtMid, pointAtEnd));
	// 			if (IsCloseVec(tangentAtStart, curve3.TangentAtStart) && IsCloseVec(tangentAtEnd, curve3.TangentAtEnd))
	// 			{
	// 				curves[j] = curve3;
	// 			}
	// 		}
	// 		else
	// 		{
	// 			if (!(curves[j].CurvatureAt(curves[j].Domain.Mid).SquareLength > 200.0) && !(curves[j] is PolyCurve))
	// 			{
	// 				continue;
	// 			}
	// 			curves[j] = curves[j].Smooth(0.5, bXSmooth: true, bYSmooth: true, bZSmooth: true, bFixBoundaries: true, SmoothingCoordinateSystem.World, Plane.WorldXY);
	// 			BoundingBox boundingBox = curves[j].GetBoundingBox(accurate: true);
	// 			double num4 = boundingBox.Max.X - boundingBox.Min.X;
	// 			double num5 = boundingBox.Max.Y - boundingBox.Min.Y;
	// 			double num6 = Math.Sqrt(num4 * num4 + num5 * num5) * 0.005;
	// 			if (num6 < 0.001)
	// 			{
	// 				num6 = 0.001;
	// 			}
	// 			int degree = curves[j].Degree;
	// 			Point3d[] array = rebuild_crv_pts(curves[j], 7);
	// 			int num7 = array.Length;
	// 			double x = boundingBox.Min.X;
	// 			double y = boundingBox.Min.Y;
	// 			double z = boundingBox.Min.Z;
	// 			double x2 = boundingBox.Max.X;
	// 			double y2 = boundingBox.Max.Y;
	// 			double z2 = boundingBox.Max.Z;
	// 			for (int k = 0; k < num7; k++)
	// 			{
	// 				double num8 = array[k].X;
	// 				double num9 = array[k].Y;
	// 				double num10 = array[k].Z;
	// 				if (num8 < x + num6)
	// 				{
	// 					num8 = x;
	// 				}
	// 				else if (num8 > x2 - num6)
	// 				{
	// 					num8 = x2;
	// 				}
	// 				if (num9 < y + num6)
	// 				{
	// 					num9 = y;
	// 				}
	// 				else if (num9 > y2 - num6)
	// 				{
	// 					num9 = y2;
	// 				}
	// 				if (num10 < z + num6)
	// 				{
	// 					num10 = z;
	// 				}
	// 				else if (num10 > z2 - num6)
	// 				{
	// 					num10 = z2;
	// 				}
	// 				array[k].X = num8;
	// 				array[k].Y = num9;
	// 				array[k].Z = num10;
	// 			}
	// 			curves[j] = Curve.CreateControlPointCurve(array, degree);
	// 		}
	// 	}
	// 	return curves;
	// }











// ------------------------------------ Helpers ------------------------------------ //

private bool no_input(string name)
    {
    int i = Component.Params.IndexOfInputParam(name);
    return i < 0 || Component.Params.Input[i].SourceCount == 0 || Component.Params.Input[i].VolatileDataCount == 0;
    }

public static Interval interval = new(0, 1);
public static Point3d pu = Point3d.Unset;

Vector3d Z_up = Vector3d.ZAxis;
}
# ---------- end extrude_punch ----------
number_slider_7 = Slider(25, range=0..100)
extrude_indent_2 = ExtrudeIndent(Curves=pill.Curves, Brep=move_3.Geometry, Fillets=number_slider_4, Inset=0, Flip=Toggle(True), s=4)  # -> Breps, Planes, EdgesA, EdgesB, Notes
text_style = TextStyle(
    Font="Barlow",
    TextCase=Slider(1, range=0..10),
    Height=Slider(1.5, range=0..10),
    HorizontalAlign=Slider(1, range=0..2),
    VerticalAlign=Slider(1, range=0..2))
locate = Locate(Geometry=split_brep.Breps, InsetU=0, InsetV=0, OffsetW=0, box=True, simple=False)  # -> Plane, Surface, Edges, Body, Notes
number_slider_8 = Slider(6.1, range=0..100)
geo_3 = Geometry(item.Item)
groove = Groove(
    Length=Slider(0, range=0..100),
    Radius=Slider(3, range=0..100),
    Depth=Slider(1.1, range=-3..3),
    Fillet=Slider(0.3, range=0..10),
    Blend=0.5,
    smooth=False)  # -> Brep, Curves, Profile
locate_2 = Locate(Geometry=split_brep_2.Breps, Face=Slider(16, range=0..20), InsetU=0, InsetV=0, OffsetW=0, box=False, simple=False)  # -> Plane, Surface, Edges, Body, Notes
revolve = Revolve(Curves=fillet.Curves, end_cap=False, start_cap=False)  # -> Revolve, Joined
rectangle_4 = Rectangle(X=number_slider_7, Y=number_slider_7, Radii=Slider(7.6, range=0..10), s=0)  # -> Curves, Joined, Points, Notes
extrude_punch_2 = ExtrudeAndPunch(curves=move_2.Geometry, brep=revolve.Joined, radii=number_slider_6, flip=Toggle(True))  # -> out, breps, planes, crvs_A, crvs_B, notes; inputs curves: list, brep: Brep, radii: list of Double, blends: list of Double, extrude: Double, inset: Double, flip: Boolean
# ---------- extrude_punch_2: C# ----------
// Grasshopper Script Instance
#region Usings
using System;
using System.Collections.Generic;

using Rhino;
using Rhino.Geometry;
using Rhino.Geometry.Intersect;

using Grasshopper;
using Grasshopper.Kernel;
using Grasshopper.Kernel.Types;

#r "ID_Tools_Library.dll"
using static ID_Tools_Library.ID_Tools_Class;


#endregion
public class Script_Instance : GH_ScriptInstance
{

	private void RunScript(
		List<object> curves,
		Brep brep,
		List<double> radii,
		List<double> blends,
		double extrude,
		double inset,
		bool flip,
		ref object breps,
		ref object planes,
		ref object crvs_A,
		ref object crvs_B,
		ref object notes)
    {

	// Updated 2026-03-24

    bool no_brep = no_input("brep");
    bool no_curves = no_input("curves");
    bool no_extrude = no_input("extrude");

    if (no_curves) { if (!no_brep) breps = new GH_Brep(brep); Component.Message = ""; return; }

    if (no_input("blends")) blends = new List<double>() { 0.68 };
    bool no_inset = no_input("inset");
    if (no_input("flip")) flip = false;

    if (!no_brep) brep.Faces.ShrinkFaces();
    
    bool hollow = !no_brep && !brep.IsSolid;      //   << ---------------------- Adjust This if necessary
    // bool hollow_inner = flip && !no_brep && !brep.IsSolid && no_extrude;

    double tol = 0.0001;
    int sectors = 27;
    Plane pln = Plane.WorldXY;


    // -------------------------------- Set Basic Conditions -------------------------------- //

    bool simple = no_input("radii");
    if (simple) radii = new List<double>() {0};
    if (radii.Count == 1) radii.Add(radii[0]);
    if (radii[0] == 0 && radii[1] == 0) simple = true;
    blends.Add(blends[0]);

    bool has_extrude = !no_extrude && Math.Abs(extrude) > tol;
    bool has_brep = !no_brep;

    bool hole = has_brep && has_extrude;
    bool through_hole = has_brep && !has_extrude;
    bool extrusion = !hole && !through_hole;

    bool quick = false;
    bool centre = extrusion && flip;

    bool simple_extrude = extrusion && simple;
    if (extrusion && !simple) quick = radii[0] == radii[1];

    bool inner_hole = false;
    bool inner_though = false;
    if (flip)
    {
      inner_hole = hole;
      inner_though = through_hole;
      hole = false;
      through_hole = false;
    }
    if (hole && !inner_hole && flip) { hole = false; inner_hole = true; }

    if (hollow)  // (!brep.IsSolid)
    {
      if (through_hole)
      {
        hole = true;
        through_hole = false;
      }
      else if (inner_though)
      {
        inner_hole = true;
        inner_though = false;
      }
    }


    // -------------------------------- Sort Curves -------------------------------- //

    Curve[] curve_list = object_curve_convert(curves);

    int[] keys = sort_crvs(curve_list, out bool[] crv_closed, out _, out _);

    int idx = crv_closed.Length;
    Plane[] plns = new Plane[idx];

    BoundingBox brep_bb = new();
    if (!no_brep) brep_bb = brep.GetBoundingBox(true);

    int counter = 0;
    for (int i = 0; i < idx; i++)
    {
        if (!crv_closed[i]) continue;

        Curve[] crvs = items_by_key(curve_list, keys, i);

        if (!no_inset && inset != 0) crvs = offset(crvs, -inset, out plns[i], tol);
        else plns[i] = curves_plane(crvs);
        if (!no_brep) plns[i] = plane_on_box(plns[i], brep_bb, 1); // if (!no_brep || hollow) ?

        TransformGeos(crvs, Transform.Scale(plns[i], 1, 1, 0));

        int count = crvs.Length;
        if (count > 1)
        {
            sort_crvs(crvs);
            clean_lines(ref crvs);
            match_crv_ends(crvs);
        }

        for (int j = 0; j < count; j++)    // Write directly back into curve_list and keys
        {
            curve_list[counter] = crvs[j];
            keys[counter] = i;
            counter++;
        }
    }

    Array.Resize(ref curve_list, counter);
    Array.Resize(ref keys, counter);


    // -------------------------------- Manage Empty Inputs -------------------------------- //

    if ((no_extrude || extrude == 0) && (no_curves || no_brep))
    {
      crvs_A = Array.ConvertAll(curve_list, c => new GH_Curve(c));
      Component.Message = "Surface";
      if (!no_brep) breps = new GH_Brep(brep);
      else breps = Array.ConvertAll(Brep.CreatePlanarBreps(curve_list, 0.001), b => new GH_Brep(b));
      return;
    }

    if (no_extrude && no_brep) { Component.Message = ""; return; }


    // --------------------------------  Sort incoming curves -------------------------------- //

    // List<Curve> test_crvs = new ();
            List<Curve> all_A = new();
            List<Curve> all_B = new();
            List<Brep> all_breps = new();
            List<Plane> plane_list = new();

    for (int i = 0; i < idx; i++)
    {
      Curve[] crvs = items_by_key(curve_list, keys, i);
      int count = crvs.Length;

      Plane base_plane = Plane.Unset;
      Plane plane = plns[i];
      Transform orient = Transform.PlaneToPlane(plane, pln);
      Transform reorient = Transform.PlaneToPlane(pln, plane);

      if (has_brep) brep.Transform(orient);
      TransformGeos(crvs, orient);
      
      // Check that the curve is inside the Brep's bounds
      double edge_inset_caution = (through_hole || hole) && !simple ? 0.2 + Math.Max(radii[0], radii[1]) : 0.2;  // <<<<<< ----------------------      Add Hollow?

      if (has_brep && !boxboxinside2D(brep.GetBoundingBox(true), bb_union(crvs, edge_inset_caution)))
      {
        brep.Transform(reorient);
        continue;
      }

      if (!no_extrude && extrude == 0 ) { brep.Transform(reorient); breps = brep; crvs_A = crvs; continue; }


      // -------------------------------- Construct Breps and Parts -------------------------------- //

      //Brep test_piece = new Brep();
      Curve[] edgA = new Curve[count];
      Curve[] edgB = new Curve[count];
      Brep part = new Brep();
      if (simple_extrude) part = capped_extrude(crvs, out edgA, out edgB, extrude, centre);
      else if (quick) part = quick_extrude(crvs, extrude, radii[0], blends[0], sectors, centre, tol, out edgA, out edgB);
      else if (extrusion) part = full_extrude(crvs, extrude, radii, blends, sectors, centre, tol, out edgA, out edgB);

      else if (hole) part = hole_extrude(crvs, brep, extrude, radii, blends, sectors, tol, out base_plane, out edgA, out edgB);     // <<<<<< -------- Add Hollow (IsSolid Test and use that to change how Extrude and Flip - OR!!! if Extrude = 0, then recalculate extrude and flip [DO THIS])
      else if (inner_hole) part = hole_inner(crvs, brep, extrude, radii, blends, sectors, tol, out base_plane, out edgA, out edgB);  // <<<<<< -------- Add Hollow (IsSolid Test and use that to change how Extrude and Flip - OR!!! if Extrude = 0, then recalculate extrude and flip [DO THIS])

      else if (through_hole) part = hole_through(crvs, brep, radii, blends, sectors, tol, out edgA, out edgB);
      else if (inner_though) part = through_inner(crvs, brep, radii, blends, sectors, tol, out edgA, out edgB);
      else continue;

      Curve[] edges_A = remove_nulls(edgA);
      Curve[] edges_B = remove_nulls(edgB);

      part.Transform(reorient);                                    

      if (through_hole || hole) brep = part;                       
      else
      {
        all_breps.Add(part);
        if (has_brep) brep.Transform(reorient);
      }
      if (base_plane.IsValid) 
      { 
        base_plane.Transform(reorient); 
        plane_list.Add(base_plane); 
        }
            if (edges_A.Length > 0) { 
                TransformGeos(edges_A, reorient); 
                all_A.AddRange(edges_A); 
            }
            if (edges_B.Length > 0)
            {
                TransformGeos(edges_B, reorient);
                all_B.AddRange(edges_B);
            }

        }


    if (all_breps.Count == 0) breps = new GH_Brep(brep);
    else{
      int brep_count = all_breps.Count;
      GH_Brep[] gh_brep = new GH_Brep[brep_count];
      for (int i = 0; i < brep_count; i++) gh_brep[i] = new GH_Brep(all_breps[i]);
      breps = gh_brep;
    }

    int all_A_count = all_A.Count;
    int all_B_count = all_B.Count;
    GH_Curve[] gh_crvs_A = new GH_Curve[all_A_count];
    for (int i = 0; i < all_A_count; i++) gh_crvs_A[i] = new GH_Curve(all_A[i]);
    GH_Curve[] gh_crvs_B = new GH_Curve[all_B_count];
    for (int i = 0; i < all_B_count; i++) gh_crvs_B[i] = new GH_Curve(all_A[i]);

    crvs_A = gh_crvs_A;
    crvs_B = gh_crvs_B;
    planes = plane_list;

    string identifier = "";
    if (simple_extrude) identifier = "Simple Extrude " + sectors.ToString();
    else if (quick) identifier = "Quick Extrude " + sectors.ToString();
    else if (extrusion) identifier = "Full Extrusion " + sectors.ToString();
    else if (hollow && hole) identifier = "Hollow " + sectors.ToString();
    else if (hollow && inner_hole) identifier = "Hollow Inner " + sectors.ToString();
    else if (hole) identifier = "Indent " + sectors.ToString();
    else if (inner_hole) identifier = "Indent Inner " + sectors.ToString();
    else if (through_hole) identifier = "Through Hole " + sectors.ToString();
    else if (inner_though) identifier = "Through Hole Inner " + sectors.ToString();

    Component.Message = identifier; // "Hello"; // 
    notes = new[] { identifier };

    }

	/*══════════════════════════════════════════════════════════════════════════════╗
	║                                                                               ║
	║                     Additional Functions + Classes Below                      ║
	║                                                                               ║
	╚══════════════════════════════════════════════════════════════════════════════*/


  private Brep through_inner(Curve[] curves, Brep brep, List<double> radii, List<double> bulges, int sectors, double tol, out Curve[] crv_listA, out Curve[] crv_listB)
    {
      //List<Curve> test_crvs = new List<Curve>();
      int count = curves.Length;
      if (count == 1) sectors = (sectors * 2) + 1;
      
      double gap = 1 / (sectors - 1.0);
      Plane pln = Plane.WorldXY;
      LoftType loft_s = LoftType.Straight;

      bool top_sharp = radii[0] == 0;
      bool bot_sharp = radii[1] == 0;

      bool top_chamfer = bulges[0] == 0;
      bool bot_chamfer = bulges[1] == 0;

      int cross_numA = top_chamfer ? 2 : 4;
      int cross_numB = bot_chamfer ? 2 : 4;

      bool remirror = brep.GetBoundingBox(true).Center.Z < 0;  // Put Brep above Plane.XY
      Transform mirror = Transform.Mirror(pln);
      if (remirror) brep.Transform(mirror);


      // ------- Setup Curves ------- //
  
      double radA = -radii[0];
      double radB = -radii[1];

      Curve[] crvA = (top_sharp)
      ? Array.ConvertAll(curves, c => c.DuplicateCurve())
      : offset(curves, radA, out _, tol);

      Curve[] crvB = Array.ConvertAll(curves, c => c.DuplicateCurve());
      Curve[] crvC = Array.ConvertAll(curves, c => c.DuplicateCurve());


      Curve[] crvD = (bot_sharp)
        ? Array.ConvertAll(curves, c => c.DuplicateCurve())
        : offset(curves, radB, out _, tol);

      Point3d pt_on_other_side = new Point3d(0, 0, brep.GetBoundingBox(true).Max.Z + 1);
      Transform move_to_other_sides = Transform.Translation(new Vector3d(pt_on_other_side));
      TransformGeos(crvC, move_to_other_sides);
      TransformGeos(crvD, move_to_other_sides);


      // ------- Separate BrepFaces ------- //

      Brep[] final_breps = new Brep[count * 3];
      separate_brepfaces(brep, crvA, Z_up, out Brep brep_halfA, out Brep brep_out, out _);
      separate_brepfaces(brep_out, crvD, -Z_up, out Brep brep_halfB, out brep_out, out _);

      double[] ts = new double[sectors];
      for (int i = 0; i < sectors; i++) ts[i] = i * gap;


      // ------- Project Curves ------- //

      crvA = Array.ConvertAll(crvA, c => project_closest(c, brep_halfA, Z_up, tol));
      crvB = (top_sharp)
        ? Array.ConvertAll(crvA, c => c.DuplicateCurve())
        : Array.ConvertAll(crvB, c => project_closest(c, brep_halfA, Z_up, tol));

      crvD = Array.ConvertAll(crvD, c => project_closest(c, brep_halfB, -Z_up, tol));
      crvC = (bot_sharp)
        ? Array.ConvertAll(crvD, c => c.DuplicateCurve())
        : Array.ConvertAll(crvC, c => project_closest(c, brep_halfB, -Z_up, tol));

      match_sort_crvs(curves, crvA, false);
      match_sort_crvs(curves, crvB, false);
      match_sort_crvs(curves, crvC, false);
      match_sort_crvs(curves, crvD, false);

      Point3d central_ptA = project_point(Point3d.Origin, brep_halfA, Z_up);
      Point3d central_ptB = project_point(pt_on_other_side, brep_halfB, -Z_up);

              Curve[] final_crvsA = new Curve[count];
              Curve[] final_crvsB = new Curve[count];

              Array.Copy(Array.ConvertAll(crvB, c => c.DuplicateCurve()), final_crvsA, count);
              Array.Copy(Array.ConvertAll(crvC, c => c.DuplicateCurve()), final_crvsB, count);

      TransformGeos(crvB, Transform.Translation(0, 0, radii[0]));
      TransformGeos(crvC, Transform.Translation(0, 0, -radii[1]));


      // ---------------------------------------- main loop ---------------------------------------- //

      Curve[] edges_A = new Curve[sectors];
      Curve[] edges_B = new Curve[sectors];

      for (int i = 0; i < count; i++)
      {
        bool straightA = crvA[i].IsLinear(0.01);  //crvA[i].IsLinear(0.01) && crvB[i].IsLinear(0.01);
        bool straightB = crvD[i].IsLinear(0.01);

        for (int j = 0; j < sectors; j++)
        {
          crvB[i].NormalizedLengthParameter(ts[j], out double tB, 1E-03);
          Point3d pB = crvB[i].PointAt(tB);
          crvC[i].NormalizedLengthParameter(ts[j], out double tC, 1E-03);
          Point3d pC = crvC[i].PointAt(tC);

          Curve ln = new LineCurve(pC, pB);

          bool straight_checkA = !straightA || (straightA && (j == 0 || j == sectors - 1));
          bool straight_checkB = !straightB || (straightB && (j == 0 || j == sectors - 1));

          if (!top_sharp && straight_checkA && !top_chamfer)
          {
            crvA[i].NormalizedLengthParameter(ts[j], out double tA, 1E-03);
            Point3d pA = crvA[i].PointAt(tA);
            Vector3d vec = pA - pB;
            vec.Z = 0;

            brep_halfA.ClosestPoint(pA, out _, out ComponentIndex ci, out _, out _, 0.1, out _);
            BrepFace B_face = brep_halfA.Faces[ci.Index];
            Curve cx_crv = GetSurfaceProxyCurve(B_face, pA, vec);

            if (IsClose(pA, cx_crv.PointAtEnd)) cx_crv.Reverse();
            edges_A[j] = Curve.CreateBlendCurve(ln, cx_crv, BlendContinuity.Curvature, bulges[0], bulges[0]);
          }

          if (!bot_sharp && straight_checkB && !bot_chamfer)
          {
            crvD[i].NormalizedLengthParameter(ts[j], out double tD, 1E-03);
            Point3d pD = crvD[i].PointAt(tD);
            Vector3d vec = pD - pC;
            vec.Z = 0;

            brep_halfB.ClosestPoint(pD, out _, out ComponentIndex ci, out _, out _, 0.1, out _);
            BrepFace B_face = brep_halfB.Faces[ci.Index];
            Curve cx_crv = GetSurfaceProxyCurve(B_face, pD, vec);

            if (IsClose(pD, cx_crv.PointAtStart)) cx_crv.Reverse();
            edges_B[j] = Curve.CreateBlendCurve(cx_crv, ln, BlendContinuity.Curvature, bulges[1], bulges[1]);
          }
        }


        if (!top_sharp)
        {
          if (straightA) final_breps[i] = (top_chamfer)
              ? Brep.CreateFromLoft(new[] { crvA[i], crvB[i] }, pu, pu, loft_s, false)[0]
              : Brep.CreateFromLoft(new[] { edges_A[0], edges_A[sectors - 1] }, pu, pu, loft_s, false)[0];
          else final_breps[i] = (top_chamfer)
            ? Brep.CreateFromLoft(new[] { crvB[i], crvA[i] }, pu, pu, loft_s, false)[0]
            : edge_srf(crvB[i], crvA[i], edges_A, cross_numA);
        }
        if (!bot_sharp)
        {
          if (straightB) final_breps[(count * 2) + i] = (bot_chamfer)
              ? Brep.CreateFromLoft(new[] { crvC[i], crvD[i] }, pu, pu, loft_s, false)[0]
              : Brep.CreateFromLoft(new[] { edges_B[0], edges_B[sectors - 1] }, pu, pu, loft_s, false)[0];
          else final_breps[(count * 2) + i] = (bot_chamfer)
            ? Brep.CreateFromLoft(new[] { crvD[i], crvC[i] }, pu, pu, loft_s, false)[0]
            : edge_srf(crvD[i], crvC[i], edges_B, cross_numB);
        }
        final_breps[count + i] = Brep.CreateFromLoft(new[] { crvB[i], crvC[i] }, pu, pu, loft_s, false)[0];
      }

      Brep final_brep = BuildFinalBrep(brep_halfA, crvA, brep_halfB, crvD, final_breps, true);

      if (remirror)
      {
        brep.Transform(mirror);
        final_brep.Transform(mirror);
                  TransformGeos(final_crvsA, mirror);
                  TransformGeos(final_crvsB, mirror);
        //brep.Transform(mirror);
        //for (int i = 0; i < test_crvs.Count; i++) if (test_crvs[i] != null) test_crvs[i].Transform(mirror);
      }

      if (final_brep.SolidOrientation == BrepSolidOrientation.Inward) final_brep.Flip();

              crv_listA = final_crvsA;
              crv_listB = final_crvsB; // .Concat(test_crvs).ToArray();

      return final_brep;
    }
  
  private Brep hole_through(Curve[] curves, Brep brep, List<double> radii, List<double> bulges, int sectors, double tol, out Curve[] crv_listA, out Curve[] crv_listB)
	{
		//List<Curve> test_crvs = new List<Curve>();
		int count = curves.Length;
		if (count == 1) sectors = (sectors * 2) + 1;
		
		double gap = 1 / (sectors - 1.0);
		Plane pln = Plane.WorldXY;
		LoftType loft_s = LoftType.Straight;

		bool top_sharp = radii[0] == 0;
		bool bot_sharp = radii[1] == 0;

		bool top_chamfer = bulges[0] == 0;
		bool bot_chamfer = bulges[1] == 0;

		int cross_numA = top_chamfer ? 2 : 4;
		int cross_numB = bot_chamfer ? 2 : 4;

		bool remirror = brep.GetBoundingBox(true).Center.Z < 0;  // Put Brep above Plane.XY
		Transform mirror = Transform.Mirror(pln);
		if (remirror) brep.Transform(mirror);


		// ------- Setup Curves ------- //
	
		double radA = radii[0];
		double radB = radii[1];

		Curve[] crvA = (top_sharp)
		? Array.ConvertAll(curves, c => c.DuplicateCurve())
		: offset(curves, radA, out _, tol);

		Curve[] crvB = Array.ConvertAll(curves, c => c.DuplicateCurve());
		Curve[] crvC = Array.ConvertAll(curves, c => c.DuplicateCurve());

		Curve[] crvD = (bot_sharp)
		? Array.ConvertAll(curves, c => c.DuplicateCurve())
		: offset(curves, radB, out _, tol);

		Point3d pt_on_other_side = new Point3d(0, 0, brep.GetBoundingBox(true).Max.Z + 1);
		Transform move_to_other_sides = Transform.Translation(new Vector3d(pt_on_other_side));
		TransformGeos(crvC, move_to_other_sides);
		TransformGeos(crvD, move_to_other_sides);


		// ------- Separate BrepFaces ------- //

		Brep[] final_breps = new Brep[count * 3 + 1];
		separate_brepfaces(brep, crvA, Z_up, out Brep brep_halfA, out Brep brep_out, out _);
		separate_brepfaces(brep_out, crvD, -Z_up, out Brep brep_halfB, out final_breps[count * 3], out _);

		double[] ts = new double[sectors];
		for (int i = 0; i < sectors; i++) ts[i] = i * gap;


		// ------- Project Curves ------- //

		crvA = Array.ConvertAll(crvA, c => project_closest(c, brep_halfA, Z_up, tol));
		crvB = (top_sharp)
		? Array.ConvertAll(crvA, c => c.DuplicateCurve())
		: Array.ConvertAll(crvB, c => project_closest(c, brep_halfA, Z_up, tol));

		crvD = Array.ConvertAll(crvD, c => project_closest(c, brep_halfB, -Z_up, tol));
		crvC = (bot_sharp)
		? Array.ConvertAll(crvD, c => c.DuplicateCurve())
		: Array.ConvertAll(crvC, c => project_closest(c, brep_halfB, -Z_up, tol));

		match_sort_crvs(curves, crvA, false);
		match_sort_crvs(curves, crvB, false);
		match_sort_crvs(curves, crvC, false);
		match_sort_crvs(curves, crvD, false);

		Point3d central_ptA = project_point(Point3d.Origin, brep_halfA, Z_up);
		Point3d central_ptB = project_point(pt_on_other_side, brep_halfB, -Z_up);

		Curve[] final_crvsA = new Curve[count];
		Curve[] final_crvsB = new Curve[count];

		Array.Copy(Array.ConvertAll(crvB, c => c.DuplicateCurve()), final_crvsA, count);
		Array.Copy(Array.ConvertAll(crvC, c => c.DuplicateCurve()), final_crvsB, count);

		TransformGeos(crvB, Transform.Translation(0, 0, radii[0]));
		TransformGeos(crvC, Transform.Translation(0, 0, -radii[1]));


		// ---------------------------------------- main loop ---------------------------------------- //

		Curve[] edges_A = new Curve[sectors];
		Curve[] edges_B = new Curve[sectors];

		for (int i = 0; i < count; i++)
		{
		bool straightA = crvA[i].IsLinear(0.01);  //crvA[i].IsLinear(0.01) && crvB[i].IsLinear(0.01);
		bool straightB = crvD[i].IsLinear(0.01);

		for (int j = 0; j < sectors; j++)
		{
			crvB[i].NormalizedLengthParameter(ts[j], out double tB, 1E-03);
			Point3d pB = crvB[i].PointAt(tB);
			crvC[i].NormalizedLengthParameter(ts[j], out double tC, 1E-03);
			Point3d pC = crvC[i].PointAt(tC);
			Curve ln = new LineCurve(pC, pB);

			bool straight_checkA = !straightA || (straightA && (j == 0 || j == sectors - 1));
			bool straight_checkB = !straightB || (straightB && (j == 0 || j == sectors - 1));

			if (!top_sharp && straight_checkA && !top_chamfer)
			{
			crvA[i].NormalizedLengthParameter(ts[j], out double tA, 1E-03);
			Point3d pA = crvA[i].PointAt(tA);
			Vector3d vec = pA - pB;
			vec.Z = 0;

			brep_halfA.ClosestPoint(pA, out _, out ComponentIndex ci, out _, out _, 0.1, out _);
			BrepFace B_face = brep_halfA.Faces[ci.Index];
			Curve cx_crv = GetSurfaceProxyCurve(B_face, pA, vec);

			if (IsClose(pA, cx_crv.PointAtEnd)) cx_crv.Reverse();
			edges_A[j] = Curve.CreateBlendCurve(ln, cx_crv, BlendContinuity.Curvature, bulges[0], bulges[0]);
			}

			if (!bot_sharp && straight_checkB && !bot_chamfer)
			{
			crvD[i].NormalizedLengthParameter(ts[j], out double tD, 1E-03);
			Point3d pD = crvD[i].PointAt(tD);
			Vector3d vec = pD - pC;
			vec.Z = 0;

			brep_halfB.ClosestPoint(pD, out _, out ComponentIndex ci, out _, out _, 0.1, out _);
			BrepFace B_face = brep_halfB.Faces[ci.Index];
			Curve cx_crv = GetSurfaceProxyCurve(B_face, pD, vec);

			if (IsClose(pD, cx_crv.PointAtStart)) cx_crv.Reverse();
			edges_B[j] = Curve.CreateBlendCurve(cx_crv, ln, BlendContinuity.Curvature, bulges[1], bulges[1]);
			}
		}


		if (!top_sharp)
		{
			if (straightA) final_breps[i] = (top_chamfer)
				? Brep.CreateFromLoft(new[] { crvA[i], crvB[i] }, pu, pu, loft_s, false)[0]
				: Brep.CreateFromLoft(new[] { edges_A[0], edges_A[sectors - 1] }, pu, pu, loft_s, false)[0];
			else final_breps[i] = (top_chamfer)
			? Brep.CreateFromLoft(new[] { crvB[i], crvA[i] }, pu, pu, loft_s, false)[0]
			: edge_srf(crvB[i], crvA[i], edges_A, cross_numA);
		}
		if (!bot_sharp)
		{
			if (straightB) final_breps[(count * 2) + i] = (bot_chamfer)
				? Brep.CreateFromLoft(new[] { crvC[i], crvD[i] }, pu, pu, loft_s, false)[0]
				: Brep.CreateFromLoft(new[] { edges_B[0], edges_B[sectors - 1] }, pu, pu, loft_s, false)[0];
			else final_breps[(count * 2) + i] = (bot_chamfer)
			? Brep.CreateFromLoft(new[] { crvD[i], crvC[i] }, pu, pu, loft_s, false)[0]
			: edge_srf(crvD[i], crvC[i], edges_B, cross_numB);
		}
		final_breps[count + i] = Brep.CreateFromLoft(new[] { crvB[i], crvC[i] }, pu, pu, loft_s, false)[0];
		}


		Brep final_brep = BuildFinalBrep(brep_halfA, crvA, brep_halfB, crvD, final_breps, false);

		if (remirror)
		{
		brep.Transform(mirror);
		final_brep.Transform(mirror);
					TransformGeos(final_crvsA, mirror);
					TransformGeos(final_crvsB, mirror);

		//for (int i = 0; i < test_crvs.Count; i++) if (test_crvs[i] != null) test_crvs[i].Transform(mirror);
		}

		if (final_brep.SolidOrientation == BrepSolidOrientation.Inward) final_brep.Flip();

				crv_listA = final_crvsA;
				crv_listB = final_crvsB; //.Concat(test_crvs).ToArray();

		return final_brep;
	}
  
	private Brep hole_inner(Curve[] curves, Brep brep, double extrude, List<double> radii, List<double> bulges, int sectors, double tol, out Plane pl, out Curve[] crv_listA, out Curve[] crv_listB)
		{
			// List<Curve> test_crvs = new();
			bool hollow = extrude == 0;
			
			if (curves.Length == 1) sectors = (sectors * 2) + 1;
			
			double gap = 1 / (sectors - 1.0);
			Plane pln = Plane.WorldXY;
			int count = curves.Length;

			bool top_sharp = radii[0] == 0;
			bool bot_sharp = radii[1] == 0;

			bool top_chamfer = bulges[0] == 0;
			bool bot_chamfer = bulges[1] == 0;

			int cross_numA = top_chamfer ? 2 : 4;
			int cross_numB = bot_chamfer ? 2 : 4;

			bool remirror = brep.GetBoundingBox(true).Center.Z < 0;  // Put Brep above Plane.XY
			Transform mirror = Transform.Mirror(pln);
			if (remirror) brep.Transform(mirror);


			// ------- Setup Planes ------- //

			Plane base_plane = pln;
			Plane inside_plane = pln;
			Point3d central_pt = curves_central_point(curves, brep, Z_up);

			if (hollow && central_pt.Z == 0) { pl = pln; crv_listA = curves; crv_listB = curves; return brep; }
			if (hollow)
			{    // ------- For Hollow Extrude to Surface (no Extrude Input)
				extrude = central_pt.Z;
				extrude *= (extrude < 0) ? 1 : -1;
			}

			double flip = (extrude < 0) ? -1 : 1;

			base_plane.Origin = central_pt;
			base_plane.Transform(Transform.Translation(0, 0, extrude));
			

			// ------- Setup Curves ------- //
		
			double radA = -radii[0];
			double radB = -radii[1];

			Curve[] crvA = (top_sharp)
			? Array.ConvertAll(curves, c => c.DuplicateCurve())
			: offset(curves, radA, out _, tol);


			// ------- Separate BrepFaces ------- //

			Brep[] final_breps = new Brep[count * 3 + 1];
			separate_brepfaces(brep, crvA, Z_up, out Brep brep_half, out Brep brep_out, out Point3d[] flat_pts);  //  , out Curve[] pro_crvs, out Point3d[] pro_pts


			// ------- Test Flat - Use Z Height because Brep is already oriented to the XY Plane ------- //

			BoundingBox flat_bb = new BoundingBox(flat_pts);
			bool flat_srf = flat_bb.Max.Z - flat_bb.Min.Z < tol;

			//Curve[] test_flat_crvs = new Curve[count * 2];
			//Array.Copy(offset(curves, radA - 0.1, out _, tol), test_flat_crvs, count);
			//Array.Copy(crvA, 0, test_flat_crvs, count, count);
			//bool flat_srf = test_flat(test_flat_crvs, brep_half, tol); 

			if (flat_srf)
			{
				Curve[] quick_crvs = new Curve[count];
				for (int i = 0; i < count; i++) quick_crvs[i] = project_closest(curves[i], brep_half, Z_up, tol);
				Brep quick_brep = full_extrude(quick_crvs, extrude, radii, bulges, sectors, false, tol, out Curve[] f_crvsA, out Curve[] f_crvsB);

				if (remirror) 
				{
					quick_brep.Transform(mirror);
					brep.Transform(mirror);
					base_plane.Transform(mirror);
					TransformGeos(quick_crvs, mirror);
								TransformGeos(f_crvsA, mirror);
								TransformGeos(f_crvsB, mirror);
				}

				pl = base_plane; // new Plane(new Point3d(0, 0, extrude), Vector3d.XAxis, Vector3d.YAxis); //
				crv_listA = f_crvsA;
				crv_listB = f_crvsB; // quick_crvs; // 
				return quick_brep;
			}


			// ------- Setup Curves ------- //

			Curve[] crvD = (bot_sharp)
			? Array.ConvertAll(curves, c => c.DuplicateCurve())
			: offset(curves, radB, out _, tol);

			crvA = Array.ConvertAll(crvA, c => project_closest(c, brep_half, Z_up, tol));
			Curve[] crvB = (top_sharp)
			? Array.ConvertAll(crvA, c => c.DuplicateCurve())
			: Array.ConvertAll(curves, c => project_closest(c, brep_half, Z_up, tol));

			if (crvA.Length == 1) align_crvs(crvA[0], crvB[0]);
			match_sort_crvs(crvA, crvB);

			Curve[] crvC = Array.ConvertAll(curves, c => c.DuplicateCurve());
			Curve[] crvE = Array.ConvertAll(crvB, c => c.DuplicateCurve());
					Curve[] final_crvsA = Array.ConvertAll(crvB, c => c.DuplicateCurve());

			double z_move = base_plane.OriginZ;
			double inside_z = base_plane.OriginZ - (radii[1] * flip);
			inside_plane.OriginZ = inside_z;
			TransformGeos(crvB, Transform.Translation(0, 0, radii[0] * flip));
			TransformGeos(crvC, Transform.Scale(inside_plane, 1, 1, 0));
			TransformGeos(crvD, Transform.Scale(base_plane, 1, 1, 0));
			TransformGeos(crvE, Transform.Scale(inside_plane, 1, 1, 0));

			Curve[] final_crvsB = Array.ConvertAll(crvC, c => c.DuplicateCurve());
			TransformGeos(final_crvsB, Transform.Scale(base_plane, 1, 1, 0));

			// ------- main loop ------- //

			BlendContinuity curvature = BlendContinuity.Curvature;
			LoftType straight_loft = LoftType.Straight;

			double[] ts = new double[sectors];
			for (int i = 0; i < sectors; i++) ts[i] = i * gap;

			for (int i = 0; i < count; i++)
			{
			bool straight = crvA[i].IsLinear(0.01);

			Curve[] edges_A = new Curve[sectors];
			Curve[] edges_B = new Curve[sectors];

			for (int j = 0; j < sectors; j++)
			{
				bool straight_check = !straight || (straight && (j == 0 || j == sectors - 1));

				if (!top_sharp && straight_check && !top_chamfer)
				{
					crvA[i].NormalizedLengthParameter(ts[j], out double tA, 1E-03);
					Point3d pA = crvA[i].PointAt(tA);
					crvB[i].NormalizedLengthParameter(ts[j], out double tB, 1E-03);
					Point3d pB = crvB[i].PointAt(tB);

									Point3d pE = new(pB.X, pB.Y, inside_z);
					Curve lnA = new LineCurve(pB, pE);
					Vector3d vec = pA - pB;
					vec.Z = 0;

					brep_half.ClosestPoint(pA, out _, out ComponentIndex ci, out _, out _, 0.1, out _);
					BrepFace B_face = brep_half.Faces[ci.Index];
					Curve cx_crv = GetSurfaceProxyCurve(B_face, pA, vec);

					if (IsClose(pA, cx_crv.PointAtStart)) cx_crv.Reverse();
					edges_A[j] = Curve.CreateBlendCurve(cx_crv, lnA, curvature, bulges[0], bulges[0]);
				}

				if (!bot_sharp && straight_check && !bot_chamfer)
				{
					crvC[i].NormalizedLengthParameter(ts[j], out double tC, 1E-03);
					Point3d pC = crvC[i].PointAt(tC);

					Curve lnC = new LineCurve(new Point3d(pC - Z_up * flip), pC);
					crvD[i].NormalizedLengthParameter(ts[j], out double tD, 1E-03);
					Point3d pD = crvD[i].PointAt(tD);

					Vector3d vec = pD - pC;
					vec.Z = 0;
					Curve lnB = new LineCurve(pD, new Point3d(pD + vec));
					edges_B[j] = Curve.CreateBlendCurve(lnC, lnB, curvature, bulges[1], bulges[1]);
				}
			}

			if (!top_sharp)
			{
				if (straight) final_breps[i] = (top_chamfer)
					? Brep.CreateFromLoft(new[] { crvA[i], crvB[i] }, pu, pu, straight_loft, false)[0]
					: Brep.CreateFromLoft(new[] { edges_A[0], edges_A[sectors - 1] }, pu, pu, straight_loft, false)[0];
				else final_breps[i] = (top_chamfer)
				? Brep.CreateFromLoft(new[] { crvA[i], crvB[i] }, pu, pu, straight_loft, false)[0]
				: edge_srf(crvA[i], crvB[i], edges_A, cross_numA);
			}

			if (!bot_sharp)
			{
				if (straight) final_breps[(count * 2) + i] = (bot_chamfer)
					? Brep.CreateFromLoft(new[] { crvC[i], crvD[i] }, pu, pu, straight_loft, false)[0]
					: Brep.CreateFromLoft(new[] { edges_B[0], edges_B[sectors - 1] }, pu, pu, straight_loft, false)[0];
				else final_breps[(count * 2) + i] = (bot_chamfer)
				? Brep.CreateFromLoft(new[] { crvC[i], crvD[i] }, pu, pu, straight_loft, false)[0]
				: edge_srf(crvC[i], crvD[i], edges_B, cross_numB);
			}

			final_breps[count + i] = Brep.CreateFromLoft(new[] { crvB[i], crvE[i] }, pu, pu, straight_loft, false)[0];
			}


			// ------- Re-Assemble parts ------- //

			final_breps[count * 3] = Brep.CreatePlanarBreps(crvD, 0.001)[0];
			Brep final_brep = BuildFinalBrep(brep_half, crvA, final_breps, true);

			//test_crvs.AddRange(crvA);

			base_plane = orient_plane(base_plane);

			if (remirror)
			{
				//brep_half.Transform(mirror);
				brep.Transform(mirror);
				final_brep.Transform(mirror);
				base_plane.Transform(mirror);
				TransformGeos(final_crvsA, mirror);
				TransformGeos(final_crvsB, mirror);
			}
			else base_plane = new Plane(base_plane.Origin, -Vector3d.ZAxis);

			pl = base_plane; //   Plane.WorldXY;  //  
			crv_listA = final_crvsA; // .Concat(test_crvs).ToArray(); // new[] { new LineCurve(Point3d.Origin, new Point3d(0, 0, 1)) }; // crvA.Concat(crvB).Concat(crvC).Concat(crvD).ToArray(); //  crvD; // test_crvs.ToArray(); // 
			crv_listB = final_crvsB;
			if (final_brep.SolidOrientation == BrepSolidOrientation.Inward) final_brep.Flip();
			
			return final_brep; // brep_out; // brep_half; //  new Brep(); // 
		}

private Brep hole_extrude(Curve[] curves, Brep brep, double extrude, List<double> radii, List<double> bulges, int sectors, double tol, out Plane pl, out Curve[] crv_listA, out Curve[] crv_listB)
	{
		// List<Curve> test_crvs = new();
		bool hollow = extrude == 0;

		if (curves.Length == 1) sectors = (sectors * 2) + 1;
		
		double gap = 1 / (sectors - 1.0);
		Plane pln = Plane.WorldXY;
		int count = curves.Length;

		bool top_sharp = radii[0] == 0;
		bool bot_sharp = radii[1] == 0;

		bool top_chamfer = bulges[0] == 0;
		bool bot_chamfer = bulges[1] == 0;

		int cross_numA = top_chamfer ? 2 : 4;
		int cross_numB = bot_chamfer ? 2 : 4;

		bool remirror = brep.GetBoundingBox(true).Center.Z < 0;  // Put Brep above Plane.XY
		Transform mirror = Transform.Mirror(pln);
		if (remirror) brep.Transform(mirror);


		// ------- Setup Curves ------- //
	
		double radA = radii[0];
		double radB = -radii[1];

		Curve[] crvA = (top_sharp)
		? Array.ConvertAll(curves, c => c.DuplicateCurve())
		: offset(curves, radA, out _, tol);


		// ------- Separate BrepFaces ------- //

		Brep[] final_breps = new Brep[count * 3 + 2];
		separate_brepfaces(brep, crvA, Z_up, out Brep brep_half, out final_breps[count * 3 + 1], out _);  //  , out Curve[] pro_crvs, out Point3d[] pro_pts


		// ------- Setup Curves ------- //

		Curve[] crvD = bot_sharp
		? Array.ConvertAll(curves, c => c.DuplicateCurve())
		: offset(curves, radB, out _, tol);

		crvA = Array.ConvertAll(crvA, c => project_closest(c, brep_half, Z_up, tol));
		Curve[] crvB = top_sharp
		? Array.ConvertAll(crvA, c => c.DuplicateCurve())
		: Array.ConvertAll(curves, c => project_closest(c, brep_half, Z_up, tol));

		if (crvA.Length == 1) align_crvs(crvA[0], crvB[0]);
		match_sort_crvs(crvA, crvB);

		Curve[] crvC = Array.ConvertAll(curves, c => c.DuplicateCurve());
		Curve[] crvE = Array.ConvertAll(crvB, c => c.DuplicateCurve());
		Curve[] final_crvsA = Array.ConvertAll(crvB, c => c.DuplicateCurve());


		// ------- Setup Planes ------- //

		Plane base_plane = pln;
		Plane inside_plane = pln;
				Point3d central_pt = curves_central_point(curves, brep, Z_up);

		if (hollow && central_pt.Z == 0) { pl = pln; crv_listA = curves; crv_listB = curves; return brep; }
		if (hollow)
		{    // ------- For Hollow Extrude to Surface (no Extrude Input)
			extrude = central_pt.Z;
			extrude *= (extrude < 0) ? 1 : -1;
		}

		double flip = (extrude < 0) ? -1 : 1;

		base_plane.Origin = central_pt;
		base_plane.Transform(Transform.Translation(0, 0, extrude));   
		double z_move = base_plane.OriginZ;                           

		double inside_z = base_plane.OriginZ - (radii[1] * flip);
		inside_plane.OriginZ = inside_z;
		TransformGeos(crvB, Transform.Translation(0, 0, radii[0] * flip));
		TransformGeos(crvC, Transform.Scale(inside_plane, 1, 1, 0));
		TransformGeos(crvD, Transform.Scale(base_plane, 1, 1, 0));
		TransformGeos(crvE, Transform.Scale(inside_plane, 1, 1, 0));

		Curve[] final_crvsB = Array.ConvertAll(crvC, c => c.DuplicateCurve());
		TransformGeos(final_crvsB, Transform.Scale(base_plane, 1, 1, 0));

		// ------- main loop ------- //

		BlendContinuity curvature = BlendContinuity.Curvature;
		LoftType straight_loft = LoftType.Straight;

		double[] ts = new double[sectors];
		for (int i = 0; i < sectors; i++) ts[i] = i * gap;

		for (int i = 0; i < count; i++)
		{
		bool straight = crvA[i].IsLinear(0.01);

		Curve[] edges_A = new Curve[sectors];
		Curve[] edges_B = new Curve[sectors];

		for (int j = 0; j < sectors; j++)
		{
			bool straight_check = !straight || (straight && (j == 0 || j == sectors - 1));

			if (!top_sharp && straight_check && !top_chamfer)
			{
			crvA[i].NormalizedLengthParameter(ts[j], out double tA, 1E-03);
			Point3d pA = crvA[i].PointAt(tA);
			crvB[i].NormalizedLengthParameter(ts[j], out double tB, 1E-03);
			Point3d pB = crvB[i].PointAt(tB);

			Point3d pE = new (pB.X, pB.Y, inside_z);
			Curve lnA = new LineCurve(pB, pE);
			Vector3d vec = pA - pB;
			vec.Z = 0;

			brep_half.ClosestPoint(pA, out _, out ComponentIndex ci, out _, out _, 0.1, out _);
			BrepFace B_face = brep_half.Faces[ci.Index];
			Curve cx_crv = GetSurfaceProxyCurve(B_face, pA, vec);

			if (IsClose(pA, cx_crv.PointAtStart)) cx_crv.Reverse();
			edges_A[j] = Curve.CreateBlendCurve(cx_crv, lnA, curvature, bulges[0], bulges[0]);
			}

			if (!bot_sharp && straight_check && !bot_chamfer)
			{
			crvC[i].NormalizedLengthParameter(ts[j], out double tC, 1E-03);
			Point3d pC = crvC[i].PointAt(tC);
			Curve lnC =  new LineCurve(new Point3d(pC - Z_up * flip), pC);

			crvD[i].NormalizedLengthParameter(ts[j], out double tD, 1E-03);
			Point3d pD = crvD[i].PointAt(tD);

			Vector3d vec = pD - pC;
			vec.Z = 0;
			Curve lnB = new LineCurve(pD, new Point3d(pD + vec));
			edges_B[j] = Curve.CreateBlendCurve(lnC, lnB, curvature, bulges[1], bulges[1]);
			}
		}

		if (!top_sharp)
		{
			if (straight) final_breps[i] = (top_chamfer)
				? Brep.CreateFromLoft(new[] { crvA[i], crvB[i] }, pu, pu, straight_loft, false)[0]
				: Brep.CreateFromLoft(new[] { edges_A[0], edges_A[sectors - 1] }, pu, pu, straight_loft, false)[0];
			else final_breps[i] = (top_chamfer)
			? Brep.CreateFromLoft(new[] { crvA[i], crvB[i] }, pu, pu, straight_loft, false)[0]
			: edge_srf(crvA[i], crvB[i], edges_A, cross_numA);
		}

		if (!bot_sharp)
		{
			if (straight) final_breps[(count * 2) + i] = (bot_chamfer)
				? Brep.CreateFromLoft(new[] { crvC[i], crvD[i] }, pu, pu, straight_loft, false)[0]
				: Brep.CreateFromLoft(new[] { edges_B[0], edges_B[sectors - 1] }, pu, pu, straight_loft, false)[0];
			else final_breps[(count * 2) + i] = (bot_chamfer)
			? Brep.CreateFromLoft(new[] { crvC[i], crvD[i] }, pu, pu, straight_loft, false)[0]
			: edge_srf(crvC[i], crvD[i], edges_B, cross_numB);
		}

		final_breps[count + i] = Brep.CreateFromLoft(new[] { crvB[i], crvE[i] }, pu, pu, straight_loft, false)[0];
		}


		// ------- Re-Assemble parts ------- //

		final_breps[count * 3] = Brep.CreatePlanarBreps(crvD, 0.001)[0];

		Brep final_brep = BuildFinalBrep(brep_half, crvA, final_breps, false);

		base_plane = orient_plane(base_plane);

		if (remirror)
		{
		final_brep.Transform(mirror);
		brep.Transform(mirror);  //  **** Might need to re-comment this out if soemthing strange happens.  I uncommented it because the other methods did too...

		base_plane.Transform(mirror);
		TransformGeos(final_crvsA, mirror);
		TransformGeos(final_crvsB, mirror);

		//for (int i = 0; i < test_crvs.Count; i++) if (test_crvs[i] != null) test_crvs[i].Transform(mirror);
		}
		else base_plane = new Plane(base_plane.Origin, -Vector3d.ZAxis);
		
		pl = base_plane; //   Plane.WorldXY;  //  
		crv_listA = final_crvsA; // .Concat(test_crvs).ToArray(); // new[] { new LineCurve(Point3d.Origin, new Point3d(0, 0, 1)) }; // crvA.Concat(crvB).Concat(crvC).Concat(crvD).ToArray(); //  crvD; //
		crv_listB = final_crvsB;

		if (final_brep.SolidOrientation == BrepSolidOrientation.Inward) final_brep.Flip();
		
		return final_brep; // test_box.ToBrep(); // brep_half; // new Brep(); //  
	}


// ------------------------------------ Basic Extrudes ------------------------------------ //

  private static Brep full_extrude(Curve[] crvs, double extrude, List<double> rads, List<double> bulges, int sectors, bool centre, double tol, out Curve[] crv_listA, out Curve[] crv_listB)
	{
		// List<Curve> test_crvs = new();
		Plane plane = curves_plane(crvs);
		Transform orient = Transform.PlaneToPlane(plane, Plane.WorldXY);
		Transform reorient = Transform.PlaneToPlane(Plane.WorldXY, plane);

		TransformGeos(crvs, orient);


		// -------  Set Up Standard Variables  ------- //

		int count = crvs.Length;
		int v_num = (count == 1) ? v_num = sectors - 1 : sectors;

		bool loop = count == 1 && crvs[0].IsClosed;

		bool mirror = !centre && extrude != Math.Abs(extrude);
		extrude = Math.Abs(extrude);

		// -------  Set Up Radii and Decide if should add Sides  ------- //

				double[] radii = { Math.Max(rads[0], 0), Math.Max(rads[1], 0) };

		bool has_sides = radii[0] < extrude;
		if (!has_sides) { radii[0] = extrude; radii[1] = 0; }
		if (radii[1] > extrude - radii[0])
		{
		radii[1] = extrude - radii[0];
		has_sides = false;
		}

		bool C2arcA = bulges[0] <= -1 && (radii[0] * 1.5) <= extrude - radii[1];
		bool C2arcB = bulges[1] <= -1 && (radii[1] * 1.5) <= extrude - radii[0];
		if (C2arcA) { radii[0] *= 1.5; bulges[0] = 0.72; }
		if (C2arcB) { radii[1] *= 1.5; bulges[1] = 0.72; }

		bool has_radA = radii[0] != 0;
		bool has_radB = radii[1] != 0;


		// -------  Set Up Curves  ------- //


		Curve[] crvA = offset(crvs, -radii[0], out _, tol);
		Curve[] crvB = Array.ConvertAll(crvs, c => c.DuplicateCurve());
		Curve[] crvC = Array.ConvertAll(crvs, c => c.DuplicateCurve());
		Curve[] crvD = offset(crvs, -radii[1], out _, tol);

		if (Math.Abs(crvA[0].PointAtStart.DistanceTo(crvB[0].PointAtStart) - radii[0]) > tol) match_sort_crvs(crvA, crvB);
		if (Math.Abs(crvD[0].PointAtStart.DistanceTo(crvB[0].PointAtStart) - radii[1]) > tol) match_sort_crvs(crvD, crvB);

		Transform moveA = Transform.Translation(0, 0, radii[0]);
		Transform moveB = Transform.Translation(0, 0, radii[1]);
		Transform moveC = Transform.Translation(0, 0, extrude - (radii[1] * 2));
		Transform moveD = Transform.Translation(0, 0, extrude);

		Transform mirror_trans = Transform.Mirror(Plane.WorldXY);
		Transform centre_trans = Transform.Translation(0, 0, -(extrude * 0.5));


		// -------  Setup Output Curves  ------- //

		Curve[] final_crvsA = Array.ConvertAll(crvs, c => c.DuplicateCurve());
		Curve[] final_crvsB = Array.ConvertAll(crvs, c => c.DuplicateCurve());


		// -------  Main Loop - Build Surfaces  ------- //

		Brep[] srfs = new Brep[(count * 3) + 2];
		Curve[] side_crvs = new Curve[2];
		LoftType lt = LoftType.Straight;

		for (int i = 0; i < count; i++)
		{
		crvB[i].Transform(moveA);  // ---- Arrange Curves---- //
		crvC[i].Transform(moveB);
		int edge_num = crvB[i].IsLinear(0.01) ? 2 : sectors;

		if (has_radA)
		{
			int cross_num = (bulges[0] == 0) ? 2 : 4;
			Curve[] edge_curves = simple_edges(crvA[i], crvB[i], bulges[0], edge_num);
			srfs[count + i] = edge_srf(crvA[i], crvB[i], edge_curves, cross_num);
		}

		if (has_radB)
		{
			int cross_num = (bulges[1] == 0) ? 2 : 4;
			Curve[] edge_curves = simple_edges(crvD[i], crvC[i], bulges[1], edge_num);
			srfs[(count * 2) + i] = edge_srf(crvD[i], crvC[i], edge_curves, cross_num);
			srfs[(count * 2) + i].Transform(mirror_trans);
			srfs[(count * 2) + i].Transform(moveD);
		}

		crvC[i].Transform(moveC);

		if (has_sides)
		{
				side_crvs[0] = crvB[i];
				side_crvs[1] = crvC[i];
				srfs[i] = Brep.CreateFromLoft(side_crvs, pu, pu, lt, false)[0];
			}
		final_crvsB[i].Transform(moveD);
		}

		srfs[count * 3] = Brep.CreatePlanarBreps(crvA, 0.01)[0];
		srfs[(count * 3) + 1] = Brep.CreatePlanarBreps(crvD, 0.01)[0];
		srfs[(count * 3) + 1].Transform(moveD);

		Brep brep = Brep.JoinBreps(srfs, 0.1, 0.1)[0];

			if (mirror) { 
				brep.Transform(mirror_trans); 
				TransformGeos(final_crvsA, mirror_trans);
				TransformGeos(final_crvsB, mirror_trans);
			}
			if (centre) { 
				brep.Transform(centre_trans); 
				TransformGeos(final_crvsA, centre_trans);
				TransformGeos(final_crvsB, centre_trans);
			}

		brep.Transform(reorient);
		TransformGeos(final_crvsA, reorient);
		TransformGeos(final_crvsB, reorient);

		crv_listA = final_crvsA;
		crv_listB = final_crvsB;
		return brep; // new Brep();// 
	}	
  
	private static Brep quick_extrude(Curve[] crvs, double extrude, double radius, double bulge, int sectors, bool centre, double tol, out Curve[] crv_listA, out Curve[] crv_listB)
		{
			// -------  Set Up Conditions  ------- //
			// List<Curve> test_crvs = new();

			int count = crvs.Length;
			bool loop = count == 1 && crvs[0].IsClosed;
			bool mirror = !centre && extrude != Math.Abs(extrude);
			extrude = Math.Abs(extrude);
			int cross_num = (bulge == 0) ? 2 : 4;

			bool has_sides = radius < extrude * 0.5;
			if (!has_sides) radius = extrude * 0.5;

			bool C2arc = bulge <= -1 && (radius * 3) + tol < extrude; // bulge is less than one and does not make the radius bigger than half the extrude
			if (C2arc)
			{
			radius *= 1.5;
			bulge = 0.72;
			}

			// -------  Set Up Standard Variables  ------- //

			Curve[] crvA = offset(crvs, -radius, out _, tol);

			// test_crvs.AddRange(crvA);

			Curve[] crvC = Array.ConvertAll(crvs, c => c.DuplicateCurve());
			if (Math.Abs(crvA[0].PointAtStart.DistanceTo(crvs[0].PointAtStart) - radius) > tol) match_sort_crvs(crvA, crvs);

			Transform moveB = Transform.Translation(0, 0, radius);
			Transform moveC = Transform.Translation(0, 0, extrude - radius);
			Transform moveD = Transform.Translation(0, 0, extrude);
			Transform moveC2 = Transform.Translation(0, 0, radius);

			Transform mirror_trans = Transform.Mirror(Plane.WorldXY);
			Transform centre_trans = Transform.Translation(0, 0, -(extrude * 0.5));


			// -------  Setup Output Curves  ------- //

			Curve[] final_crvsA = Array.ConvertAll(crvs, c => c.DuplicateCurve());
			Curve[] final_crvsB = Array.ConvertAll(crvs, c => c.DuplicateCurve());


			// -------  Main Loop - Build Surfaces  ------- //

			Brep[] srfs = new Brep[(count * 3) + 2];

			LoftType lt = LoftType.Straight;
			Curve[] crv_sides = new Curve[2];

			for (int i = 0; i < count; i++)
			{
				bool straight = crvs[i].IsLinear(0.01);
				crvs[i].Transform(moveB);  // ---- Arrange Curves---- //
				crvC[i].Transform(moveC);
				crv_sides[0] = crvs[i];
				crv_sides[1] = crvC[i];
			if (has_sides) srfs[i] = Brep.CreateFromLoft(crv_sides, pu, pu, lt, false)[0];
				srfs[i].Flip();
				int edge_num = straight ? 2 : sectors;

			Curve[] edges = simple_edges(crvA[i], crvs[i], bulge, edge_num);
			srfs[count + i] = edge_srf(crvs[i], crvA[i], edges, cross_num);

			srfs[(count * 2) + i] = srfs[count + i].DuplicateBrep();
			srfs[(count * 2) + i].Transform(mirror_trans);
			srfs[(count * 2) + i].Transform(moveD);
			
			final_crvsB[i].Transform(moveD);
			//test_crvs.AddRange(edges);
			}

			// Curve[] tc = test_crvs.ToArray();

			srfs[count * 3] = Brep.CreatePlanarBreps(crvA, 0.001)[0];
			srfs[(count * 3) + 1] = srfs[count * 3].DuplicateBrep();
			srfs[(count * 3) + 1].Transform(moveD);

			Brep brep = Brep.JoinBreps(remove_nulls(srfs), 0.001, 0.1)[0];

					if (mirror)
					{
						brep.Transform(mirror_trans);
						TransformGeos(final_crvsA, mirror_trans);
						TransformGeos(final_crvsB, mirror_trans);
					}
					if (centre)
					{
						brep.Transform(centre_trans);
						TransformGeos(final_crvsA, centre_trans);
						TransformGeos(final_crvsB, centre_trans);
					}

					crv_listA = final_crvsA;
					crv_listB = final_crvsB;
			return brep;
		}

	private static Brep capped_extrude(Curve[] crvs, out Curve[] crv_listA, out Curve[] crv_listB, double length = 5.0, bool centre = false)
		{
			int count = crvs.Length;
			Plane pl = curves_plane(crvs);
			Vector3d dir = pl.Normal * length;
					Transform move = Transform.Translation(dir);
					if (centre)
					{
				TransformGeos(crvs, Transform.Translation(-dir * 0.5));
				pl.Transform(Transform.Translation(-dir * 0.5));
			}

					Curve[] final_crvsA = Array.ConvertAll(crvs, c => c.DuplicateCurve());
					Curve[] final_crvsB = Array.ConvertAll(crvs, c => c.DuplicateCurve());
					TransformGeos(final_crvsB, move);

			Brep[] sides = new Brep[count + 2];
			LoftType lt = LoftType.Straight;
			Curve[] crv_sides = new Curve[2];
			for (int i = 0; i < count; i++)
			{
						crv_sides[0] = final_crvsA[i];
						crv_sides[1] = final_crvsB[i];
				sides[i + 1] = Brep.CreateFromLoft(crv_sides, pu, pu, lt, false)[0]; // Surface.CreateExtrusion(crvs[i], dir).ToBrep();
			}
			sides[0] = Brep.CreatePlanarBreps(crvs, 0.001)[0];
			sides[count + 1] = sides[0].DuplicateBrep();
			sides[count + 1].Transform(move);

			Brep body = Brep.JoinBreps(sides, 0.001, 0.1)[0];
			if (body.SolidOrientation == BrepSolidOrientation.Inward) body.Flip();

					crv_listA = final_crvsA;
					crv_listB = final_crvsB;
			return body;
		}


        // ------------------------------------ Sub Constructions ------------------------------------ //

	private static Brep BuildFinalBrep(Brep brep_half, Curve[] curves, Brep[] final_breps, bool inside = false)
        {
            Brep[] final_joined = Brep.JoinBreps(final_breps, 0.001, 0.1);
            if (final_joined.Length > 1) final_joined = Brep.JoinBreps(final_joined, 0.01, 0.1);

            BoundingBox test_box = bb_union(curves, 0.1);

            Brep[] split = brep_half.Split(curves, 0.001);
            int spl_len = split.Length;
            int fj_len = final_joined.Length;

            int maxCount = spl_len + fj_len;
            Brep[] pieces = new Brep[maxCount];
            int piece_count = 0;

            for (int i = 0; i < spl_len; ++i)
            {
                bool condition = boxboxinside2D(test_box, split[i].GetBoundingBox(true));
                if ((inside && condition) || (!inside && !condition)) pieces[piece_count++] = split[i];
            }

            for (int i = 0; i < fj_len; ++i) pieces[piece_count++] = final_joined[i];

            Brep[] joined = Brep.JoinBreps(remove_nulls(pieces), 0.001, 0.1);
            if (joined.Length > 1 || !joined[0].IsSolid) joined = Brep.JoinBreps(joined, 0.01, 0.1);

            return joined[0];
        }

        private static Brep BuildFinalBrep(Brep brep_halfA, Curve[] curves_A, Brep brep_halfB, Curve[] curves_B, Brep[] final_breps, bool inside = false)
        {
            // First join the existing final breps
            Brep[] final_joined = Brep.JoinBreps(final_breps, 0.001, 0.1);

            // Compute bounding boxes for each curve set
            BoundingBox test_boxA = bb_union(curves_A, 0.1);
            BoundingBox test_boxB = bb_union(curves_B, 0.1);

            // Split each half with its curve set
            Brep[] splitA = brep_halfA.Split(curves_A, 0.01);
            Brep[] splitB = brep_halfB.Split(curves_B, 0.01);

            int spl_A_len = splitA.Length;
            int spl_B_len = splitB.Length;
            int fj_len = final_joined.Length;

            int maxCount = spl_A_len + spl_B_len + fj_len;
            Brep[] pieces = new Brep[maxCount];
            int piece_count = 0;

            // Collect pieces from splitA
            for (int i = 0; i < spl_A_len; ++i)
            {
                bool condition = boxboxinside2D(test_boxA, splitA[i].GetBoundingBox(true));
                if ((inside && condition) || (!inside && !condition)) pieces[piece_count++] = splitA[i];
            }

            // Collect pieces from splitB
            for (int i = 0; i < spl_B_len; ++i)
            {
                bool condition = boxboxinside2D(test_boxB, splitB[i].GetBoundingBox(true));
                if ((inside && condition) || (!inside && !condition))
                    pieces[piece_count++] = splitB[i];
            }

            // Add existing final breps
            for (int i = 0; i < fj_len; ++i) pieces[piece_count++] = final_joined[i];

            // Remove nulls and join
            Brep[] joined = Brep.JoinBreps(remove_nulls(pieces), 0.001, 0.1);
            if (joined.Length > 1 || !joined[0].IsSolid) joined = Brep.JoinBreps(joined, 0.01, 0.1);

            return joined[0];
        }



// ------------------------------------ Updated Needs Checking ------------------------------------ //

        private static void align_crvs(Curve crvA, Curve crvB)
    {
        if (crvA.PointAtStart.DistanceToSquared(crvB.PointAtStart) > crvA.PointAtStart.DistanceToSquared(crvB.PointAtEnd)) crvB.Reverse();
    }



  // ------------------------------------ Optimized Already ------------------------------------ //


private static Point3d project_point(Point3d pt, Brep brep, Vector3d direction) // Optimised
  {
    pt = new Point3d(pt - direction);
    Point3d[] pts = Intersection.RayShoot(new Ray3d(pt, direction), new[] { brep }, 1);
    return pts[0];
  }


  private static Point3d curves_central_point(Curve[] curves, Brep brep, Vector3d direction)
  {
      double minZ = double.MaxValue;                     // initialise to largest possible value

      for (int i = 0, n = curves.Length; i < n; ++i)
      {
          double projZ = project_point(curves[i].PointAtMid, brep, direction).Z;          // project the curve’s midpoint onto the brep and get its Z‑value
          if (projZ < minZ) minZ = projZ;                // keep the smallest Z seen
      }
      return new Point3d(0.0, 0.0, minZ);
  }


  private static Curve project_closest(Curve crv, Brep brep, Vector3d dir, double tol)  // Optimised
  {
    crv.Transform(Transform.Translation(-dir));
    Curve[] projected_curves = Curve.ProjectToBrep(crv, brep, dir, tol);
    Curve[] projected_joined = Curve.JoinCurves(projected_curves, tol, false);

    Point3d centre = crv.PointAtMid;
    int closestIndex = 0;
    double minDistance = double.MaxValue;

    for (int i = 0; i < projected_joined.Length; i++)
    {
      double distance = centre.DistanceToSquared(projected_joined[i].PointAtMid);
      if (distance < minDistance)
      {
        minDistance = distance;
        closestIndex = i;
      }
    }

    return projected_joined[closestIndex];
  }
  
  private static Brep edge_srf(Curve top, Curve bottom, Curve[] edge_curves, int num, bool loop = false, double tol = 0.001)
  {
    if (num < 3 || edge_curves == null)
    {
      return Brep.CreateFromLoft(new[] { top, bottom }, pu, pu, LoftType.Straight, false)[0];
    }

    double ang_tol = 0.1;
    double cos_tol = Math.Cos(ang_tol);

    Vector3d[] axes = new Vector3d[] { Vector3d.XAxis, -Vector3d.XAxis, Vector3d.YAxis, -Vector3d.YAxis, Vector3d.ZAxis, -Vector3d.ZAxis };

    Vector3d start = top.TangentAtStart;
    Vector3d end = top.TangentAtEnd;
    for (int i = 0; i < 6; i++)
    {
      if (start * axes[i] > cos_tol) { start = axes[i]; break; }
    }
    for (int i = 0; i < 6; i++)
    {
      if (end * axes[i] > cos_tol) { end = axes[i]; break; }
    }

    int count = edge_curves.Length;
    double gap = 1 / (num - 1.0);

    Curve[] curves = new Curve[num];

    if (IsClose(edge_curves[0].PointAtStart, top.PointAtStart) || IsClose(edge_curves[0].PointAtStart, top.PointAtEnd))
         { curves[0] = top; curves[num - 1] = bottom; }
    else { curves[0] = bottom; curves[num - 1] = top; }


    int pt_num = loop ? count + 1 : count;
    Point3d[] edge_mid_pts = new Point3d[pt_num];

    // Pre-calculate parameters
    double[,] parameters = new double[num, count];
    for (int i = 1; i < num - 1; i++)
    {
        double gap_size = gap * i;
        for (int j = 0; j < count; j++) edge_curves[j].NormalizedLengthParameter(gap_size, out parameters[i, j], 1E-03);
    }

    for (int i = 1; i < num - 1; i++)
    {
      for (int j = 0; j < count; j++)
      {
        edge_mid_pts[j] = edge_curves[j].PointAt(parameters[i, j]);
      }

      if (loop) edge_mid_pts[count] = edge_mid_pts[0];

      Curve edge_mid = Curve.CreateInterpolatedCurve(edge_mid_pts, 3, CurveKnotStyle.Uniform, start, end);
      if (loop) 
      {
        if (edge_mid.IsCircle(0.01)) edge_mid = new ArcCurve(new Circle(edge_mid_pts[0], edge_mid_pts[1], edge_mid_pts[2])); //circle_check(edge_mid, edge_mid_pts);
        else edge_mid = square_crv(edge_mid);
      }
      else edge_mid = square_crv(edge_mid);
      curves[i] = edge_mid;
    }

    if (top.IsClosed) Array.Resize(ref edge_curves, edge_curves.Length - 1);

    NurbsSurface surface = NurbsSurface.CreateNetworkSurface(curves, 3, 3, edge_curves, 3, 3, tol, tol, tol, out _);
    surface ??= NurbsSurface.CreateNetworkSurface(new[] { top, bottom }, 3, 3, edge_curves, 3, 3, tol, tol, tol, out _);

    return surface.ToBrep(); // new Brep(); //
  }  // optimized
  
  private static Curve[] simple_edges(Curve crvA, Curve crvB, double bulge, int sectors)
	{
		double gap = 1.0 / (sectors - 1.0);
		Point3d[] ptsA = new Point3d[sectors];
		Point3d[] ptsB = new Point3d[sectors];
		for (int i = 0; i < sectors; ++i)
		{
			double t = gap * i;
      		crvA.NormalizedLengthParameter(t, out double tA, 1E-03);
			ptsA[i] = crvA.PointAt(tA);
      		crvB.NormalizedLengthParameter(t, out double tB, 1E-03);
			ptsB[i] = crvB.PointAt(tB);
		}

		Curve[] edge_curves = new Curve[sectors];

		// Output Chamfers    
            if (bulge == 0)
            {
                for (int i = 0; i < sectors; ++i) edge_curves[i] = new LineCurve(ptsA[i], ptsB[i]);
				return edge_curves;
			}

		// Output Arcs
            if (bulge < 0)
            {
                for (int i = 0; i < sectors; ++i) edge_curves[i] = new ArcCurve(new Arc(ptsB[i], -Vector3d.ZAxis, ptsA[i]));
				return edge_curves;
			}

		// Output Blends
		//Curve side_ln = new LineCurve(new Point3d(0, 0, 1), Point3d.Origin);
			for (int i = 0; i < sectors; ++i)
			{
				Vector3d vec = ptsA[i] - ptsB[i];
				vec.Z = 0;
				Curve crv0 = new LineCurve(ptsA[i], ptsA[i] + vec);

				Curve side_ln = new LineCurve(new Point3d(ptsB[i].X, ptsB[i].Y, ptsB[i].Z + 1), ptsB[i]);
				edge_curves[i] = Curve.CreateBlendCurve(side_ln, crv0, BlendContinuity.Curvature, bulge, bulge);

			}
		return edge_curves;
	}
  

// ------------------------------------ Helpers ------------------------------------ //

private bool no_input(string name)
    {
    int i = Component.Params.IndexOfInputParam(name);
    return i < 0 || Component.Params.Input[i].SourceCount == 0 || Component.Params.Input[i].VolatileDataCount == 0;
    }

public static Interval interval = new(0, 1);
public static Point3d pu = Point3d.Unset;

Vector3d Z_up = Vector3d.ZAxis;
}
# ---------- end extrude_punch_2 ----------
xy_2 = XYPlane(Origin=Point(0, 0, 0))
extrude_indent_3 = ExtrudeIndent(Curves=move_2.Geometry, Brep=revolve.Joined, Fillets=number_slider_6, Inset=0, Flip=Toggle(True), s=0)  # -> Breps, Planes, EdgesA, EdgesB, Notes
locate_3 = Locate(
    Geometry=geo_3,
    Position=Slider(6, range=0..15),
    InsetU=number_slider_5,
    InsetV=number_slider_5,
    OffsetW=Slider(5, range=0..10),
    box=True,
    simple=False)  # -> Plane, Surface, Edges, Body, Notes
extrude_punch_3 = ExtrudeAndPunch(curves=pill.Curves, brep=move.Geometry, radii=number_slider_4, flip=Toggle(False))  # -> out, breps, planes, crvs_A, crvs_B, notes; inputs curves: list, brep: Brep, radii: list of Double, blends: list of Double, extrude: Double, inset: Double, flip: Boolean
# ---------- extrude_punch_3: C# ----------
// Grasshopper Script Instance
#region Usings
using System;
using System.Collections.Generic;

using Rhino;
using Rhino.Geometry;
using Rhino.Geometry.Intersect;

using Grasshopper;
using Grasshopper.Kernel;
using Grasshopper.Kernel.Types;

#r "ID_Tools_Library.dll"
using static ID_Tools_Library.ID_Tools_Class;


#endregion
public class Script_Instance : GH_ScriptInstance
{
	private void RunScript(
		List<object> curves,
		Brep brep,
		List<double> radii,
		List<double> blends,
		double extrude,
		double inset,
		bool flip,
		ref object breps,
		ref object planes,
		ref object crvs_A,
		ref object crvs_B,
		ref object notes)
    {

	// Updated 2026-03-24

    bool no_brep = no_input("brep");
    bool no_curves = no_input("curves");
    bool no_extrude = no_input("extrude");

    if (no_curves) { if (!no_brep) breps = new GH_Brep(brep); Component.Message = ""; return; }

    if (no_input("blends")) blends = new List<double>() { 0.68 };
    bool no_inset = no_input("inset");
    if (no_input("flip")) flip = false;

    if (!no_brep) brep.Faces.ShrinkFaces();
    
    bool shell = !no_brep && !brep.IsSolid;      //   << ---------------------- Adjust This if necessary
    // bool hollow_inner = flip && !no_brep && !brep.IsSolid && no_extrude;

    double tol = 0.0001;
    int sectors = 27;
    Plane pln = Plane.WorldXY;


    // -------------------------------- Set Basic Conditions -------------------------------- //

    bool simple = no_input("radii");
    if (simple) radii = new List<double>() {0};
    if (radii.Count == 1) radii.Add(radii[0]);
    if (radii[0] == 0 && radii[1] == 0) simple = true;
    blends.Add(blends[0]);

    bool has_extrude = !no_extrude && Math.Abs(extrude) > tol;
    bool has_brep = !no_brep;

    bool hole = has_brep && has_extrude;
    bool through_hole = has_brep && !has_extrude;
    bool extrusion = !hole && !through_hole;

    bool quick = false;
    bool centre = extrusion && flip;

    bool simple_extrude = extrusion && simple;
    if (extrusion && !simple) quick = radii[0] == radii[1];

    bool inner_hole = false;
    bool inner_though = false;
    if (flip)
    {
      inner_hole = hole;
      inner_though = through_hole;
      hole = false;
      through_hole = false;
    }
    if (hole && !inner_hole && flip) { hole = false; inner_hole = true; }

    if (shell)  // (!brep.IsSolid)
    {
      if (through_hole)
      {
        hole = true;
        through_hole = false;
      }
      else if (inner_though)
      {
        inner_hole = true;
        inner_though = false;
      }
    }


    // -------------------------------- Sort Curves -------------------------------- //

    Curve[] curve_list = object_curve_convert(curves);

    int[] keys = sort_crvs(curve_list, out bool[] crv_closed, out _, out _);

    int idx = crv_closed.Length;
    Plane[] plns = new Plane[idx];

    BoundingBox brep_bb = new();
    if (!no_brep) brep_bb = brep.GetBoundingBox(true);

    int counter = 0;
    for (int i = 0; i < idx; i++)
    {
        if (!crv_closed[i]) continue;

        Curve[] crvs = items_by_key(curve_list, keys, i);

        if (!no_inset && inset != 0) crvs = offset(crvs, -inset, out plns[i], tol);
        else plns[i] = curves_plane(crvs);
        if (!no_brep && !shell ) plns[i] = plane_on_box(plns[i], brep_bb, 1);

        TransformGeos(crvs, Transform.Scale(plns[i], 1, 1, 0));

        int count = crvs.Length;
        if (count > 1)
        {
            sort_crvs(crvs);
            clean_lines(ref crvs);
            match_crv_ends(crvs);
        }

        for (int j = 0; j < count; j++)    // Write directly back into curve_list and keys
        {
            curve_list[counter] = crvs[j];
            keys[counter] = i;
            counter++;
        }
    }

    Array.Resize(ref curve_list, counter);
    Array.Resize(ref keys, counter);


    // -------------------------------- Manage Empty Inputs -------------------------------- //

    if ((no_extrude || extrude == 0) && (no_curves || no_brep))
    {
		crvs_A = Array.ConvertAll(curve_list, c => new GH_Curve(c));
		Component.Message = "Surface";
		if (!no_brep) breps = new GH_Brep(brep);
		else breps = Array.ConvertAll(Brep.CreatePlanarBreps(curve_list, 0.001), b => new GH_Brep(b));
		return;
    }

    if (no_extrude && no_brep) { Component.Message = ""; return; }


    // --------------------------------  Sort incoming curves -------------------------------- //

    // List<Curve> test_crvs = new ();
	List<Curve> all_A = new();
	List<Curve> all_B = new();
	List<Brep> all_breps = new();
	List<Plane> plane_list = new();

    for (int i = 0; i < idx; i++)
    {
      Curve[] crvs = items_by_key(curve_list, keys, i);
      int count = crvs.Length;

      Plane base_plane = Plane.Unset;
      Plane plane = plns[i];
      Transform orient = Transform.PlaneToPlane(plane, pln);
      Transform reorient = Transform.PlaneToPlane(pln, plane);

      if (has_brep) brep.Transform(orient);
      TransformGeos(crvs, orient);
      
      // Check that the curve is inside the Brep's bounds
      double edge_inset_caution = (through_hole || hole) && !simple ? 0.2 + Math.Max(radii[0], radii[1]) : 0.2;  // <<<<<< ----------------------      Add shell?

      if (has_brep && !boxboxinside2D(brep.GetBoundingBox(true), bb_union(crvs, edge_inset_caution)))
      {
        brep.Transform(reorient);
        continue;
      }

      if (!no_extrude && extrude == 0 ) { brep.Transform(reorient); breps = brep; crvs_A = crvs; continue; }


      // -------------------------------- Construct Breps and Parts -------------------------------- //

      //Brep test_piece = new Brep();
      Curve[] edgA = new Curve[count];
      Curve[] edgB = new Curve[count];
      Brep part = new Brep();
      if (simple_extrude) part = capped_extrude(crvs, out edgA, out edgB, extrude, centre);
      else if (quick) part = quick_extrude(crvs, extrude, radii[0], blends[0], sectors, centre, tol, out edgA, out edgB);
      else if (extrusion) part = full_extrude(crvs, extrude, radii, blends, sectors, centre, tol, out edgA, out edgB);

      else if (hole) part = hole_extrude(crvs, brep, extrude, radii, blends, sectors, tol, shell, out base_plane, out edgA, out edgB);     // <<<<<< -------- Add shell (IsSolid Test and use that to change how Extrude and Flip - OR!!! if Extrude = 0, then recalculate extrude and flip [DO THIS])
      else if (inner_hole) part = hole_inner(crvs, brep, extrude, radii, blends, sectors, tol, shell, out base_plane, out edgA, out edgB);  // <<<<<< -------- Add shell (IsSolid Test and use that to change how Extrude and Flip - OR!!! if Extrude = 0, then recalculate extrude and flip [DO THIS])

      else if (through_hole) part = hole_through(crvs, brep, radii, blends, sectors, tol, out edgA, out edgB);
      else if (inner_though) part = through_inner(crvs, brep, radii, blends, sectors, tol, out edgA, out edgB);
      else continue;

      Curve[] edges_A = remove_nulls(edgA);
      Curve[] edges_B = remove_nulls(edgB);

      part.Transform(reorient);                                    

      if (through_hole || hole) brep = part;                       
      else
      {
        all_breps.Add(part);
        if (has_brep) brep.Transform(reorient);
      }
      if (base_plane.IsValid) 
      { 
        base_plane.Transform(reorient); 
		base_plane = orient_plane(base_plane); // Square up the plane and axes
        plane_list.Add(base_plane); 
        }
            if (edges_A.Length > 0) { 
                TransformGeos(edges_A, reorient); 
                all_A.AddRange(edges_A); 
            }
            if (edges_B.Length > 0)
            {
                TransformGeos(edges_B, reorient);
                all_B.AddRange(edges_B);
            }
        }


    if (all_breps.Count == 0) breps = new GH_Brep(brep);
    else{
      int brep_count = all_breps.Count;
      GH_Brep[] gh_brep = new GH_Brep[brep_count];
      for (int i = 0; i < brep_count; i++) gh_brep[i] = new GH_Brep(all_breps[i]);
      breps = gh_brep;
    }

    int all_A_count = all_A.Count;
    int all_B_count = all_B.Count;
    GH_Curve[] gh_crvs_A = new GH_Curve[all_A_count];
    for (int i = 0; i < all_A_count; i++) gh_crvs_A[i] = new GH_Curve(all_A[i]);
    GH_Curve[] gh_crvs_B = new GH_Curve[all_B_count];
    for (int i = 0; i < all_B_count; i++) gh_crvs_B[i] = new GH_Curve(all_A[i]);

    crvs_A = gh_crvs_A;
    crvs_B = gh_crvs_B;
    planes = plane_list;

    string identifier = "";
    if (simple_extrude) identifier = "Simple Extrude " + sectors.ToString();
    else if (quick) identifier = "Quick Extrude " + sectors.ToString();
    else if (extrusion) identifier = "Full Extrusion " + sectors.ToString();
    else if (shell && hole) identifier = "Hollow " + sectors.ToString();
    else if (shell && inner_hole) identifier = "Hollow Inner " + sectors.ToString();
    else if (hole) identifier = "Indent " + sectors.ToString();
    else if (inner_hole) identifier = "Indent Inner " + sectors.ToString();
    else if (through_hole) identifier = "Through Hole " + sectors.ToString();
    else if (inner_though) identifier = "Through Hole Inner " + sectors.ToString();

    Component.Message = identifier; // "Hello"; // 
    notes = new[] { identifier };

    }

	/*══════════════════════════════════════════════════════════════════════════════╗
	║                                                                               ║
	║                     Additional Functions + Classes Below                      ║
	║                                                                               ║
	╚══════════════════════════════════════════════════════════════════════════════*/


	private Brep through_inner(Curve[] curves, Brep brep, List<double> radii, List<double> bulges, int sectors, double tol, out Curve[] crv_listA, out Curve[] crv_listB)
		{
		//List<Curve> test_crvs = new List<Curve>();
		int count = curves.Length;
		if (count == 1) sectors = (sectors * 2) + 1;
		
		double gap = 1 / (sectors - 1.0);
		Plane pln = Plane.WorldXY;
		LoftType loft_s = LoftType.Straight;

		bool top_sharp = radii[0] == 0;
		bool bot_sharp = radii[1] == 0;

		bool top_chamfer = bulges[0] == 0;
		bool bot_chamfer = bulges[1] == 0;

		int cross_numA = top_chamfer ? 2 : 4;
		int cross_numB = bot_chamfer ? 2 : 4;

		bool remirror = brep.GetBoundingBox(true).Center.Z < 0;  // Put Brep above Plane.XY
		Transform mirror = Transform.Mirror(pln);
		if (remirror) brep.Transform(mirror);


		// ------- Setup Curves ------- //
	
		double radA = -radii[0];
		double radB = -radii[1];

		Curve[] crvA = (top_sharp)
		? Array.ConvertAll(curves, c => c.DuplicateCurve())
		: offset(curves, radA, out _, tol);

		Curve[] crvB = Array.ConvertAll(curves, c => c.DuplicateCurve());
		Curve[] crvC = Array.ConvertAll(curves, c => c.DuplicateCurve());

		Curve[] crvD = (bot_sharp)
			? Array.ConvertAll(curves, c => c.DuplicateCurve())
			: offset(curves, radB, out _, tol);

		Point3d pt_on_other_side = new Point3d(0, 0, brep.GetBoundingBox(true).Max.Z + 1);
		Transform move_to_other_sides = Transform.Translation(new Vector3d(pt_on_other_side));
		TransformGeos(crvC, move_to_other_sides);
		TransformGeos(crvD, move_to_other_sides);


		// ------- Separate BrepFaces ------- //

		Brep[] final_breps = new Brep[count * 3];
		separate_brepfaces(brep, crvA, Z_up, out Brep brep_halfA, out Brep brep_out, out _);
		separate_brepfaces(brep_out, crvD, -Z_up, out Brep brep_halfB, out brep_out, out _);

		double[] ts = new double[sectors];
		for (int i = 0; i < sectors; i++) ts[i] = i * gap;


		// ------- Project Curves ------- //

		crvA = Array.ConvertAll(crvA, c => project_closest(c, brep_halfA, Z_up, tol));
		crvB = (top_sharp)
			? Array.ConvertAll(crvA, c => c.DuplicateCurve())
			: Array.ConvertAll(crvB, c => project_closest(c, brep_halfA, Z_up, tol));

		crvD = Array.ConvertAll(crvD, c => project_closest(c, brep_halfB, -Z_up, tol));
		crvC = (bot_sharp)
			? Array.ConvertAll(crvD, c => c.DuplicateCurve())
			: Array.ConvertAll(crvC, c => project_closest(c, brep_halfB, -Z_up, tol));

		match_sort_crvs(curves, crvA, false);
		match_sort_crvs(curves, crvB, false);
		match_sort_crvs(curves, crvC, false);
		match_sort_crvs(curves, crvD, false);

		Point3d central_ptA = project_point(Point3d.Origin, brep_halfA, Z_up);
		Point3d central_ptB = project_point(pt_on_other_side, brep_halfB, -Z_up);

		Curve[] final_crvsA = new Curve[count];
		Curve[] final_crvsB = new Curve[count];

		Array.Copy(Array.ConvertAll(crvB, c => c.DuplicateCurve()), final_crvsA, count);
		Array.Copy(Array.ConvertAll(crvC, c => c.DuplicateCurve()), final_crvsB, count);

		TransformGeos(crvB, Transform.Translation(0, 0, radii[0]));
		TransformGeos(crvC, Transform.Translation(0, 0, -radii[1]));


		// ---------------------------------------- main loop ---------------------------------------- //

		Curve[] edges_A = new Curve[sectors];
		Curve[] edges_B = new Curve[sectors];

		for (int i = 0; i < count; i++)
		{
			bool straightA = crvA[i].IsLinear(0.01);  //crvA[i].IsLinear(0.01) && crvB[i].IsLinear(0.01);
			bool straightB = crvD[i].IsLinear(0.01);

			for (int j = 0; j < sectors; j++)
			{
			crvB[i].NormalizedLengthParameter(ts[j], out double tB, 1E-03);
			Point3d pB = crvB[i].PointAt(tB);
			crvC[i].NormalizedLengthParameter(ts[j], out double tC, 1E-03);
			Point3d pC = crvC[i].PointAt(tC);

			Curve ln = new LineCurve(pC, pB);

			bool straight_checkA = !straightA || (straightA && (j == 0 || j == sectors - 1));
			bool straight_checkB = !straightB || (straightB && (j == 0 || j == sectors - 1));

			if (!top_sharp && straight_checkA && !top_chamfer)
			{
				crvA[i].NormalizedLengthParameter(ts[j], out double tA, 1E-03);
				Point3d pA = crvA[i].PointAt(tA);
				Vector3d vec = pA - pB;
				vec.Z = 0;

				brep_halfA.ClosestPoint(pA, out _, out ComponentIndex ci, out _, out _, 0.1, out _);
				BrepFace B_face = brep_halfA.Faces[ci.Index];
				Curve cx_crv = GetSurfaceProxyCurve(B_face, pA, vec);

				if (IsClose(pA, cx_crv.PointAtEnd)) cx_crv.Reverse();
				edges_A[j] = Curve.CreateBlendCurve(ln, cx_crv, BlendContinuity.Curvature, bulges[0], bulges[0]);
			}

			if (!bot_sharp && straight_checkB && !bot_chamfer)
			{
				crvD[i].NormalizedLengthParameter(ts[j], out double tD, 1E-03);
				Point3d pD = crvD[i].PointAt(tD);
				Vector3d vec = pD - pC;
				vec.Z = 0;

				brep_halfB.ClosestPoint(pD, out _, out ComponentIndex ci, out _, out _, 0.1, out _);
				BrepFace B_face = brep_halfB.Faces[ci.Index];
				Curve cx_crv = GetSurfaceProxyCurve(B_face, pD, vec);

				if (IsClose(pD, cx_crv.PointAtStart)) cx_crv.Reverse();
				edges_B[j] = Curve.CreateBlendCurve(cx_crv, ln, BlendContinuity.Curvature, bulges[1], bulges[1]);
			}
			}


			if (!top_sharp)
			{
			if (straightA) final_breps[i] = (top_chamfer)
				? Brep.CreateFromLoft(new[] { crvA[i], crvB[i] }, pu, pu, loft_s, false)[0]
				: Brep.CreateFromLoft(new[] { edges_A[0], edges_A[sectors - 1] }, pu, pu, loft_s, false)[0];
			else final_breps[i] = (top_chamfer)
				? Brep.CreateFromLoft(new[] { crvB[i], crvA[i] }, pu, pu, loft_s, false)[0]
				: edge_srf(crvB[i], crvA[i], edges_A, cross_numA);
			}
			if (!bot_sharp)
			{
			if (straightB) final_breps[(count * 2) + i] = (bot_chamfer)
				? Brep.CreateFromLoft(new[] { crvC[i], crvD[i] }, pu, pu, loft_s, false)[0]
				: Brep.CreateFromLoft(new[] { edges_B[0], edges_B[sectors - 1] }, pu, pu, loft_s, false)[0];
			else final_breps[(count * 2) + i] = (bot_chamfer)
				? Brep.CreateFromLoft(new[] { crvD[i], crvC[i] }, pu, pu, loft_s, false)[0]
				: edge_srf(crvD[i], crvC[i], edges_B, cross_numB);
			}
			final_breps[count + i] = Brep.CreateFromLoft(new[] { crvB[i], crvC[i] }, pu, pu, loft_s, false)[0];
		}

		Brep final_brep = BuildFinalBrep(brep_halfA, crvA, brep_halfB, crvD, final_breps, true);

		if (remirror)
		{
			brep.Transform(mirror);
			final_brep.Transform(mirror);
					TransformGeos(final_crvsA, mirror);
					TransformGeos(final_crvsB, mirror);
			//brep.Transform(mirror);
			//for (int i = 0; i < test_crvs.Count; i++) if (test_crvs[i] != null) test_crvs[i].Transform(mirror);
		}

		if (final_brep.SolidOrientation == BrepSolidOrientation.Inward) final_brep.Flip();

				crv_listA = final_crvsA;
				crv_listB = final_crvsB; // .Concat(test_crvs).ToArray();

		return final_brep;
		}
	
	private Brep hole_through(Curve[] curves, Brep brep, List<double> radii, List<double> bulges, int sectors, double tol, out Curve[] crv_listA, out Curve[] crv_listB)
		{
			//List<Curve> test_crvs = new List<Curve>();
			int count = curves.Length;
			if (count == 1) sectors = (sectors * 2) + 1;
			
			double gap = 1 / (sectors - 1.0);
			Plane pln = Plane.WorldXY;
			LoftType loft_s = LoftType.Straight;

			bool top_sharp = radii[0] == 0;
			bool bot_sharp = radii[1] == 0;

			bool top_chamfer = bulges[0] == 0;
			bool bot_chamfer = bulges[1] == 0;

			int cross_numA = top_chamfer ? 2 : 4;
			int cross_numB = bot_chamfer ? 2 : 4;

			bool remirror = brep.GetBoundingBox(true).Center.Z < 0;  // Put Brep above Plane.XY
			Transform mirror = Transform.Mirror(pln);
			if (remirror) brep.Transform(mirror);


			// ------- Setup Curves ------- //
		
			double radA = radii[0];
			double radB = radii[1];

			Curve[] crvA = (top_sharp)
			? Array.ConvertAll(curves, c => c.DuplicateCurve())
			: offset(curves, radA, out _, tol);

			Curve[] crvB = Array.ConvertAll(curves, c => c.DuplicateCurve());
			Curve[] crvC = Array.ConvertAll(curves, c => c.DuplicateCurve());

			Curve[] crvD = (bot_sharp)
			? Array.ConvertAll(curves, c => c.DuplicateCurve())
			: offset(curves, radB, out _, tol);

			Point3d pt_on_other_side = new Point3d(0, 0, brep.GetBoundingBox(true).Max.Z + 1);
			Transform move_to_other_sides = Transform.Translation(new Vector3d(pt_on_other_side));
			TransformGeos(crvC, move_to_other_sides);
			TransformGeos(crvD, move_to_other_sides);


			// ------- Separate BrepFaces ------- //

			Brep[] final_breps = new Brep[count * 3 + 1];
			separate_brepfaces(brep, crvA, Z_up, out Brep brep_halfA, out Brep brep_out, out _);
			separate_brepfaces(brep_out, crvD, -Z_up, out Brep brep_halfB, out final_breps[count * 3], out _);

			double[] ts = new double[sectors];
			for (int i = 0; i < sectors; i++) ts[i] = i * gap;


			// ------- Project Curves ------- //

			crvA = Array.ConvertAll(crvA, c => project_closest(c, brep_halfA, Z_up, tol));
			crvB = (top_sharp)
			? Array.ConvertAll(crvA, c => c.DuplicateCurve())
			: Array.ConvertAll(crvB, c => project_closest(c, brep_halfA, Z_up, tol));

			crvD = Array.ConvertAll(crvD, c => project_closest(c, brep_halfB, -Z_up, tol));
			crvC = (bot_sharp)
			? Array.ConvertAll(crvD, c => c.DuplicateCurve())
			: Array.ConvertAll(crvC, c => project_closest(c, brep_halfB, -Z_up, tol));

			match_sort_crvs(curves, crvA, false);
			match_sort_crvs(curves, crvB, false);
			match_sort_crvs(curves, crvC, false);
			match_sort_crvs(curves, crvD, false);

			Point3d central_ptA = project_point(Point3d.Origin, brep_halfA, Z_up);
			Point3d central_ptB = project_point(pt_on_other_side, brep_halfB, -Z_up);

			Curve[] final_crvsA = new Curve[count];
			Curve[] final_crvsB = new Curve[count];

			Array.Copy(Array.ConvertAll(crvB, c => c.DuplicateCurve()), final_crvsA, count);
			Array.Copy(Array.ConvertAll(crvC, c => c.DuplicateCurve()), final_crvsB, count);

			TransformGeos(crvB, Transform.Translation(0, 0, radii[0]));
			TransformGeos(crvC, Transform.Translation(0, 0, -radii[1]));


			// ---------------------------------------- main loop ---------------------------------------- //

			Curve[] edges_A = new Curve[sectors];
			Curve[] edges_B = new Curve[sectors];

			for (int i = 0; i < count; i++)
			{
			bool straightA = crvA[i].IsLinear(0.01);  //crvA[i].IsLinear(0.01) && crvB[i].IsLinear(0.01);
			bool straightB = crvD[i].IsLinear(0.01);

			for (int j = 0; j < sectors; j++)
			{
				crvB[i].NormalizedLengthParameter(ts[j], out double tB, 1E-03);
				Point3d pB = crvB[i].PointAt(tB);
				crvC[i].NormalizedLengthParameter(ts[j], out double tC, 1E-03);
				Point3d pC = crvC[i].PointAt(tC);
				Curve ln = new LineCurve(pC, pB);

				bool straight_checkA = !straightA || (straightA && (j == 0 || j == sectors - 1));
				bool straight_checkB = !straightB || (straightB && (j == 0 || j == sectors - 1));

				if (!top_sharp && straight_checkA && !top_chamfer)
				{
				crvA[i].NormalizedLengthParameter(ts[j], out double tA, 1E-03);
				Point3d pA = crvA[i].PointAt(tA);
				Vector3d vec = pA - pB;
				vec.Z = 0;

				brep_halfA.ClosestPoint(pA, out _, out ComponentIndex ci, out _, out _, 0.1, out _);
				BrepFace B_face = brep_halfA.Faces[ci.Index];
				Curve cx_crv = GetSurfaceProxyCurve(B_face, pA, vec);

				if (IsClose(pA, cx_crv.PointAtEnd)) cx_crv.Reverse();
				edges_A[j] = Curve.CreateBlendCurve(ln, cx_crv, BlendContinuity.Curvature, bulges[0], bulges[0]);
				}

				if (!bot_sharp && straight_checkB && !bot_chamfer)
				{
				crvD[i].NormalizedLengthParameter(ts[j], out double tD, 1E-03);
				Point3d pD = crvD[i].PointAt(tD);
				Vector3d vec = pD - pC;
				vec.Z = 0;

				brep_halfB.ClosestPoint(pD, out _, out ComponentIndex ci, out _, out _, 0.1, out _);
				BrepFace B_face = brep_halfB.Faces[ci.Index];
				Curve cx_crv = GetSurfaceProxyCurve(B_face, pD, vec);

				if (IsClose(pD, cx_crv.PointAtStart)) cx_crv.Reverse();
				edges_B[j] = Curve.CreateBlendCurve(cx_crv, ln, BlendContinuity.Curvature, bulges[1], bulges[1]);
				}
			}


			if (!top_sharp)
			{
				if (straightA) final_breps[i] = (top_chamfer)
					? Brep.CreateFromLoft(new[] { crvA[i], crvB[i] }, pu, pu, loft_s, false)[0]
					: Brep.CreateFromLoft(new[] { edges_A[0], edges_A[sectors - 1] }, pu, pu, loft_s, false)[0];
				else final_breps[i] = (top_chamfer)
				? Brep.CreateFromLoft(new[] { crvB[i], crvA[i] }, pu, pu, loft_s, false)[0]
				: edge_srf(crvB[i], crvA[i], edges_A, cross_numA);
			}
			if (!bot_sharp)
			{
				if (straightB) final_breps[(count * 2) + i] = (bot_chamfer)
					? Brep.CreateFromLoft(new[] { crvC[i], crvD[i] }, pu, pu, loft_s, false)[0]
					: Brep.CreateFromLoft(new[] { edges_B[0], edges_B[sectors - 1] }, pu, pu, loft_s, false)[0];
				else final_breps[(count * 2) + i] = (bot_chamfer)
				? Brep.CreateFromLoft(new[] { crvD[i], crvC[i] }, pu, pu, loft_s, false)[0]
				: edge_srf(crvD[i], crvC[i], edges_B, cross_numB);
			}
			final_breps[count + i] = Brep.CreateFromLoft(new[] { crvB[i], crvC[i] }, pu, pu, loft_s, false)[0];
			}


			Brep final_brep = BuildFinalBrep(brep_halfA, crvA, brep_halfB, crvD, final_breps, false);

			if (remirror)
			{
			brep.Transform(mirror);
			final_brep.Transform(mirror);
						TransformGeos(final_crvsA, mirror);
						TransformGeos(final_crvsB, mirror);

			//for (int i = 0; i < test_crvs.Count; i++) if (test_crvs[i] != null) test_crvs[i].Transform(mirror);
			}

			if (final_brep.SolidOrientation == BrepSolidOrientation.Inward) final_brep.Flip();

					crv_listA = final_crvsA;
					crv_listB = final_crvsB; //.Concat(test_crvs).ToArray();

			return final_brep;
		}
  
	private Brep hole_inner(Curve[] curves, Brep brep, double extrude, List<double> radii, List<double> bulges, int sectors, double tol, bool shell, out Plane pl, out Curve[] crv_listA, out Curve[] crv_listB)
		{
			// List<Curve> test_crvs = new();
			sort_crvs(curves);
			bool hollow = extrude == 0;
			
			if (curves.Length == 1) sectors = (sectors * 2) + 1;
			
			double gap = 1 / (sectors - 1.0);
			Plane pln = Plane.WorldXY;
			int count = curves.Length;

			bool top_sharp = radii[0] == 0;
			bool bot_sharp = radii[1] == 0;

			bool top_chamfer = bulges[0] == 0;
			bool bot_chamfer = bulges[1] == 0;

			int cross_numA = top_chamfer ? 2 : 4;
			int cross_numB = bot_chamfer ? 2 : 4;

			bool remirror = brep.GetBoundingBox(true).Center.Z < 0;  // Put Brep above Plane.XY

			if (shell) 
			{			
				Point3d tp = new Point3d(0,0,1);
            	Point3d[] tps = Intersection.RayShoot(new Ray3d(tp, Vector3d.ZAxis), new[] { brep }, 1);
				remirror = tps.Length == 0;
			}

			Transform mirror = Transform.Mirror(pln);
			if (remirror) brep.Transform(mirror);


			// ------- Setup Planes ------- //

			Plane base_plane = pln;
			Plane inside_plane = pln;
			Point3d central_pt = curves_central_point(curves, brep, Z_up);

			if (hollow && central_pt.Z == 0) { pl = pln; crv_listA = curves; crv_listB = curves; return brep; }
			if (hollow)
			{    // ------- For Hollow Extrude to Surface (no Extrude Input)
			extrude = central_pt.Z;
			extrude *= (extrude < 0) ? 1 : -1;
			}

			double flip = (extrude < 0) ? -1 : 1;

			base_plane.Origin = central_pt;
			base_plane.Transform(Transform.Translation(0, 0, extrude));
			

			// ------- Setup Curves ------- //
		
			double radA = -radii[0];
			double radB = -radii[1];

			Curve[] crvA = (top_sharp)
			? Array.ConvertAll(curves, c => c.DuplicateCurve())
			: offset(curves, radA, out _, tol);


			// ------- Separate BrepFaces ------- //

			Brep[] final_breps = new Brep[count * 3 + 1];
			separate_brepfaces(brep, crvA, Z_up, out Brep brep_half, out Brep brep_out, out Point3d[] flat_pts);  //  , out Curve[] pro_crvs, out Point3d[] pro_pts


			// ------- Test Flat - Use Z Height because Brep is already oriented to the XY Plane ------- //

			BoundingBox flat_bb = new BoundingBox(flat_pts);
			bool flat_srf = flat_bb.Max.Z - flat_bb.Min.Z < tol;

			//Curve[] test_flat_crvs = new Curve[count * 2];
			//Array.Copy(offset(curves, radA - 0.1, out _, tol), test_flat_crvs, count);
			//Array.Copy(crvA, 0, test_flat_crvs, count, count);
			//bool flat_srf = test_flat(test_flat_crvs, brep_half, tol); 

			if (flat_srf)
			{
			Curve[] quick_crvs = new Curve[count];
			for (int i = 0; i < count; i++) quick_crvs[i] = project_closest(curves[i], brep_half, Z_up, tol);
			Brep quick_brep = full_extrude(quick_crvs, extrude, radii, bulges, sectors, false, tol, out Curve[] f_crvsA, out Curve[] f_crvsB);

			if (remirror) 
				{
				quick_brep.Transform(mirror);
				brep.Transform(mirror);
				base_plane.Transform(mirror);
				TransformGeos(quick_crvs, mirror);
				TransformGeos(f_crvsA, mirror);
				TransformGeos(f_crvsB, mirror);
				}

			pl = base_plane; // new Plane(new Point3d(0, 0, extrude), Vector3d.XAxis, Vector3d.YAxis); //
			crv_listA = f_crvsA;
			crv_listB = f_crvsB; // quick_crvs; // 
			return quick_brep;
			}


			// ------- Setup Curves ------- //

			Curve[] crvD = (bot_sharp)
			? Array.ConvertAll(curves, c => c.DuplicateCurve())
			: offset(curves, radB, out _, tol);

			crvA = Array.ConvertAll(crvA, c => project_closest(c, brep_half, Z_up, tol));
			Curve[] crvB = (top_sharp)
			? Array.ConvertAll(crvA, c => c.DuplicateCurve())
			: Array.ConvertAll(curves, c => project_closest(c, brep_half, Z_up, tol));

			if (crvA.Length == 1) align_crvs(crvA[0], crvB[0]);
			match_sort_crvs(crvA, crvB);

			Curve[] crvC = Array.ConvertAll(curves, c => c.DuplicateCurve());
			Curve[] crvE = Array.ConvertAll(crvB, c => c.DuplicateCurve());
					Curve[] final_crvsA = Array.ConvertAll(crvB, c => c.DuplicateCurve());

			double z_move = base_plane.OriginZ;
			double inside_z = base_plane.OriginZ - (radii[1] * flip);
			inside_plane.OriginZ = inside_z;
			TransformGeos(crvB, Transform.Translation(0, 0, radii[0] * flip));
			TransformGeos(crvC, Transform.Scale(inside_plane, 1, 1, 0));
			TransformGeos(crvD, Transform.Scale(base_plane, 1, 1, 0));
			TransformGeos(crvE, Transform.Scale(inside_plane, 1, 1, 0));

			Curve[] final_crvsB = Array.ConvertAll(crvC, c => c.DuplicateCurve());
			TransformGeos(final_crvsB, Transform.Scale(base_plane, 1, 1, 0));

			// ------- main loop ------- //

			BlendContinuity curvature = BlendContinuity.Curvature;
			LoftType straight_loft = LoftType.Straight;

			double[] ts = new double[sectors];
			for (int i = 0; i < sectors; i++) ts[i] = i * gap;

			for (int i = 0; i < count; i++)
			{
			bool straight = crvA[i].IsLinear(0.01);

			Curve[] edges_A = new Curve[sectors];
			Curve[] edges_B = new Curve[sectors];

			for (int j = 0; j < sectors; j++)
			{
				bool straight_check = !straight || (straight && (j == 0 || j == sectors - 1));

				if (!top_sharp && straight_check && !top_chamfer)
				{
				crvA[i].NormalizedLengthParameter(ts[j], out double tA, 1E-03);
				Point3d pA = crvA[i].PointAt(tA);
				crvB[i].NormalizedLengthParameter(ts[j], out double tB, 1E-03);
				Point3d pB = crvB[i].PointAt(tB);

								Point3d pE = new(pB.X, pB.Y, inside_z);
				Curve lnA = new LineCurve(pB, pE);
				Vector3d vec = pA - pB;
				vec.Z = 0;

				brep_half.ClosestPoint(pA, out _, out ComponentIndex ci, out _, out _, 0.1, out _);
				BrepFace B_face = brep_half.Faces[ci.Index];
				Curve cx_crv = GetSurfaceProxyCurve(B_face, pA, vec);

				if (IsClose(pA, cx_crv.PointAtStart)) cx_crv.Reverse();
				edges_A[j] = Curve.CreateBlendCurve(cx_crv, lnA, curvature, bulges[0], bulges[0]);
				}

				if (!bot_sharp && straight_check && !bot_chamfer)
				{
				crvC[i].NormalizedLengthParameter(ts[j], out double tC, 1E-03);
				Point3d pC = crvC[i].PointAt(tC);

				Curve lnC = new LineCurve(new Point3d(pC - Z_up * flip), pC);
				crvD[i].NormalizedLengthParameter(ts[j], out double tD, 1E-03);
				Point3d pD = crvD[i].PointAt(tD);

				Vector3d vec = pD - pC;
				vec.Z = 0;
				Curve lnB = new LineCurve(pD, new Point3d(pD + vec));
				edges_B[j] = Curve.CreateBlendCurve(lnC, lnB, curvature, bulges[1], bulges[1]);
				}
			}

			if (!top_sharp)
			{
				if (straight) final_breps[i] = (top_chamfer)
					? Brep.CreateFromLoft(new[] { crvA[i], crvB[i] }, pu, pu, straight_loft, false)[0]
					: Brep.CreateFromLoft(new[] { edges_A[0], edges_A[sectors - 1] }, pu, pu, straight_loft, false)[0];
				else final_breps[i] = (top_chamfer)
				? Brep.CreateFromLoft(new[] { crvA[i], crvB[i] }, pu, pu, straight_loft, false)[0]
				: edge_srf(crvA[i], crvB[i], edges_A, cross_numA);
			}

			if (!bot_sharp)
			{
				if (straight) final_breps[(count * 2) + i] = (bot_chamfer)
					? Brep.CreateFromLoft(new[] { crvC[i], crvD[i] }, pu, pu, straight_loft, false)[0]
					: Brep.CreateFromLoft(new[] { edges_B[0], edges_B[sectors - 1] }, pu, pu, straight_loft, false)[0];
				else final_breps[(count * 2) + i] = (bot_chamfer)
				? Brep.CreateFromLoft(new[] { crvC[i], crvD[i] }, pu, pu, straight_loft, false)[0]
				: edge_srf(crvC[i], crvD[i], edges_B, cross_numB);
			}

			final_breps[count + i] = Brep.CreateFromLoft(new[] { crvB[i], crvE[i] }, pu, pu, straight_loft, false)[0];
			}


			// ------- Re-Assemble parts ------- //

			final_breps[count * 3] = Brep.CreatePlanarBreps(crvD, 0.001)[0];
			Brep final_brep = BuildFinalBrep(brep_half, crvA, final_breps, true);

			//test_crvs.AddRange(crvA);

			if (remirror)
			{
			//brep_half.Transform(mirror);
			brep.Transform(mirror);
			final_brep.Transform(mirror);
			base_plane.Transform(mirror);
			TransformGeos(final_crvsA, mirror);
			TransformGeos(final_crvsB, mirror);
			}
			else base_plane = new Plane(base_plane.Origin, -Vector3d.ZAxis);

			pl = base_plane; //   Plane.WorldXY;  //  
			crv_listA = final_crvsA; // .Concat(test_crvs).ToArray(); // new[] { new LineCurve(Point3d.Origin, new Point3d(0, 0, 1)) }; // crvA.Concat(crvB).Concat(crvC).Concat(crvD).ToArray(); //  crvD; // test_crvs.ToArray(); // 
			crv_listB = final_crvsB;
			if (final_brep.SolidOrientation == BrepSolidOrientation.Inward) final_brep.Flip();
			
			return final_brep; // brep_half; //  new Brep(); // 
		}

	private Brep hole_extrude(Curve[] curves, Brep brep, double extrude, List<double> radii, List<double> bulges, int sectors, double tol, bool shell, out Plane pl,  out Curve[] crv_listA, out Curve[] crv_listB)
		{
			Console.WriteLine("hole_extrude");
			// List<Curve> test_crvs = new();
			bool hollow = extrude == 0;
			sort_crvs(curves);
			if (curves.Length == 1) sectors = (sectors * 2) + 1;
			
			double gap = 1 / (sectors - 1.0);
			Plane pln = Plane.WorldXY;
			int count = curves.Length;

			bool top_sharp = radii[0] == 0;
			bool bot_sharp = radii[1] == 0;

			bool top_chamfer = bulges[0] == 0;
			bool bot_chamfer = bulges[1] == 0;

			int cross_numA = top_chamfer ? 2 : 4;
			int cross_numB = bot_chamfer ? 2 : 4;

			bool remirror = brep.GetBoundingBox(true).Center.Z < 0;  // Put Brep above Plane.XY

			if (shell) 
			{			
				Point3d tp = new Point3d(0,0,1);
            	Point3d[] tps = Intersection.RayShoot(new Ray3d(tp, Vector3d.ZAxis), new[] { brep }, 1);
				remirror = tps.Length == 0;
			}

			Transform mirror = Transform.Mirror(pln);
			if (remirror) brep.Transform(mirror);


			// ------- Setup Curves ------- //
		
			double radA = radii[0];
			double radB = -radii[1];

			Curve[] crvA = (top_sharp)
			? Array.ConvertAll(curves, c => c.DuplicateCurve())
			: offset(curves, radA, out _, tol);


			// ------- Separate BrepFaces ------- //

			Brep[] final_breps = new Brep[count * 3 + 2];
			separate_brepfaces(brep, crvA, Z_up, out Brep brep_half, out final_breps[count * 3 + 1], out _);  //  , out Curve[] pro_crvs, out Point3d[] pro_pts


			// ------- Setup Curves ------- //

			Curve[] crvD = bot_sharp
			? Array.ConvertAll(curves, c => c.DuplicateCurve())
			: offset(curves, radB, out _, tol);

			crvA = Array.ConvertAll(crvA, c => project_closest(c, brep_half, Z_up, tol));
			Curve[] crvB = top_sharp
			? Array.ConvertAll(crvA, c => c.DuplicateCurve())
			: Array.ConvertAll(curves, c => project_closest(c, brep_half, Z_up, tol));

			if (crvA.Length == 1) align_crvs(crvA[0], crvB[0]);
			match_sort_crvs(crvA, crvB);

			Curve[] crvC = Array.ConvertAll(curves, c => c.DuplicateCurve());
			Curve[] crvE = Array.ConvertAll(crvB, c => c.DuplicateCurve());
			Curve[] final_crvsA = Array.ConvertAll(crvB, c => c.DuplicateCurve());


			// ------- Setup Planes ------- //

			Plane base_plane = pln;
			Plane inside_plane = pln;
					Point3d central_pt = curves_central_point(curves, brep, Z_up);

			if (hollow && central_pt.Z == 0) { pl = pln; crv_listA = curves; crv_listB = curves; return brep; }
			if (hollow)
			{    // ------- For Hollow Extrude to Surface (no Extrude Input)
			extrude = central_pt.Z;
			extrude *= (extrude < 0) ? 1 : -1;
			}

			double flip = (extrude < 0) ? -1 : 1;

			base_plane.Origin = central_pt;
			base_plane.Transform(Transform.Translation(0, 0, extrude));   
			double z_move = base_plane.OriginZ;                           

			double inside_z = base_plane.OriginZ - (radii[1] * flip);
			inside_plane.OriginZ = inside_z;
			TransformGeos(crvB, Transform.Translation(0, 0, radii[0] * flip));
			TransformGeos(crvC, Transform.Scale(inside_plane, 1, 1, 0));
			TransformGeos(crvD, Transform.Scale(base_plane, 1, 1, 0));
			TransformGeos(crvE, Transform.Scale(inside_plane, 1, 1, 0));

			Curve[] final_crvsB = Array.ConvertAll(crvC, c => c.DuplicateCurve());
			TransformGeos(final_crvsB, Transform.Scale(base_plane, 1, 1, 0));

			// ------- main loop ------- //

			BlendContinuity curvature = BlendContinuity.Curvature;
			LoftType straight_loft = LoftType.Straight;

			double[] ts = new double[sectors];
			for (int i = 0; i < sectors; i++) ts[i] = i * gap;

			for (int i = 0; i < count; i++)
			{
			bool straight = crvA[i].IsLinear(0.01);

			Curve[] edges_A = new Curve[sectors];
			Curve[] edges_B = new Curve[sectors];

			for (int j = 0; j < sectors; j++)
			{
				bool straight_check = !straight || (straight && (j == 0 || j == sectors - 1));

				if (!top_sharp && straight_check && !top_chamfer)
				{
				crvA[i].NormalizedLengthParameter(ts[j], out double tA, 1E-03);
				Point3d pA = crvA[i].PointAt(tA);
				crvB[i].NormalizedLengthParameter(ts[j], out double tB, 1E-03);
				Point3d pB = crvB[i].PointAt(tB);

				Point3d pE = new (pB.X, pB.Y, inside_z);
				Curve lnA = new LineCurve(pB, pE);
				Vector3d vec = pA - pB;
				vec.Z = 0;

				brep_half.ClosestPoint(pA, out _, out ComponentIndex ci, out _, out _, 0.1, out _);
				BrepFace B_face = brep_half.Faces[ci.Index];
				Curve cx_crv = GetSurfaceProxyCurve(B_face, pA, vec);

				if (IsClose(pA, cx_crv.PointAtStart)) cx_crv.Reverse();
				edges_A[j] = Curve.CreateBlendCurve(cx_crv, lnA, curvature, bulges[0], bulges[0]);
				}

				if (!bot_sharp && straight_check && !bot_chamfer)
				{
				crvC[i].NormalizedLengthParameter(ts[j], out double tC, 1E-03);
				Point3d pC = crvC[i].PointAt(tC);
				Curve lnC =  new LineCurve(new Point3d(pC - Z_up * flip), pC);

				crvD[i].NormalizedLengthParameter(ts[j], out double tD, 1E-03);
				Point3d pD = crvD[i].PointAt(tD);

				Vector3d vec = pD - pC;
				vec.Z = 0;
				Curve lnB = new LineCurve(pD, new Point3d(pD + vec));
				edges_B[j] = Curve.CreateBlendCurve(lnC, lnB, curvature, bulges[1], bulges[1]);
				}
			}

			if (!top_sharp)
			{
				if (straight) final_breps[i] = (top_chamfer)
					? Brep.CreateFromLoft(new[] { crvA[i], crvB[i] }, pu, pu, straight_loft, false)[0]
					: Brep.CreateFromLoft(new[] { edges_A[0], edges_A[sectors - 1] }, pu, pu, straight_loft, false)[0];
				else final_breps[i] = (top_chamfer)
				? Brep.CreateFromLoft(new[] { crvA[i], crvB[i] }, pu, pu, straight_loft, false)[0]
				: edge_srf(crvA[i], crvB[i], edges_A, cross_numA);
			}

			if (!bot_sharp)
			{
				if (straight) final_breps[(count * 2) + i] = (bot_chamfer)
					? Brep.CreateFromLoft(new[] { crvC[i], crvD[i] }, pu, pu, straight_loft, false)[0]
					: Brep.CreateFromLoft(new[] { edges_B[0], edges_B[sectors - 1] }, pu, pu, straight_loft, false)[0];
				else final_breps[(count * 2) + i] = (bot_chamfer)
				? Brep.CreateFromLoft(new[] { crvC[i], crvD[i] }, pu, pu, straight_loft, false)[0]
				: edge_srf(crvC[i], crvD[i], edges_B, cross_numB);
			}

			final_breps[count + i] = Brep.CreateFromLoft(new[] { crvB[i], crvE[i] }, pu, pu, straight_loft, false)[0];
			}


			// ------- Re-Assemble parts ------- //

			final_breps[count * 3] = Brep.CreatePlanarBreps(crvD, 0.001)[0];

			Brep final_brep = BuildFinalBrep(brep_half, crvA, final_breps, false);

			if (remirror)
			{
			final_brep.Transform(mirror);
			brep.Transform(mirror);  //  **** Might need to re-comment this out if soemthing strange happens.  I uncommented it because the other methods did too...

			base_plane.Transform(mirror);
			TransformGeos(final_crvsA, mirror);
			TransformGeos(final_crvsB, mirror);

			//for (int i = 0; i < test_crvs.Count; i++) if (test_crvs[i] != null) test_crvs[i].Transform(mirror);
			}
			else base_plane = new Plane(base_plane.Origin, -Vector3d.ZAxis);

			pl = base_plane; //   Plane.WorldXY;  //  
			crv_listA = final_crvsA; // .Concat(test_crvs).ToArray(); // new[] { new LineCurve(Point3d.Origin, new Point3d(0, 0, 1)) }; // crvA.Concat(crvB).Concat(crvC).Concat(crvD).ToArray(); //  crvD; //
			crv_listB = final_crvsB;

			if (final_brep.SolidOrientation == BrepSolidOrientation.Inward) final_brep.Flip();
			
			return final_brep; // test_box.ToBrep(); // brep_half; // new Brep(); //  
		}


        // ------------------------------------ Basic Extrudes ------------------------------------ //

	private static Brep full_extrude(Curve[] crvs, double extrude, List<double> rads, List<double> bulges, int sectors, bool centre, double tol, out Curve[] crv_listA, out Curve[] crv_listB)
		{
			// List<Curve> test_crvs = new();
	  		sort_crvs(crvs);
			Plane plane = curves_plane(crvs);
			Transform orient = Transform.PlaneToPlane(plane, Plane.WorldXY);
			Transform reorient = Transform.PlaneToPlane(Plane.WorldXY, plane);

			TransformGeos(crvs, orient);

			// -------  Set Up Standard Variables  ------- //

			int count = crvs.Length;
			int v_num = (count == 1) ? v_num = sectors - 1 : sectors;

			bool loop = count == 1 && crvs[0].IsClosed;

			bool mirror = !centre && extrude != Math.Abs(extrude);
			extrude = Math.Abs(extrude);

			// -------  Set Up Radii and Decide if should add Sides  ------- //

			double[] radii = { Math.Max(rads[0], 0), Math.Max(rads[1], 0) };

			bool has_sides = radii[0] < extrude;
			if (!has_sides) { radii[0] = extrude; radii[1] = 0; }
			if (radii[1] > extrude - radii[0])
			{
			radii[1] = extrude - radii[0];
			has_sides = false;
			}

			bool C2arcA = bulges[0] <= -1 && (radii[0] * 1.5) <= extrude - radii[1];
			bool C2arcB = bulges[1] <= -1 && (radii[1] * 1.5) <= extrude - radii[0];
			if (C2arcA) { radii[0] *= 1.5; bulges[0] = 0.72; }
			if (C2arcB) { radii[1] *= 1.5; bulges[1] = 0.72; }

			bool has_radA = radii[0] != 0;
			bool has_radB = radii[1] != 0;


			// -------  Set Up Curves  ------- //

			Curve[] crvA = offset(crvs, -radii[0], out _, tol);
			Curve[] crvB = Array.ConvertAll(crvs, c => c.DuplicateCurve());
			Curve[] crvC = Array.ConvertAll(crvs, c => c.DuplicateCurve());
			Curve[] crvD = offset(crvs, -radii[1], out _, tol);

			if (Math.Abs(crvA[0].PointAtStart.DistanceTo(crvB[0].PointAtStart) - radii[0]) > tol) match_sort_crvs(crvA, crvB);
			if (Math.Abs(crvD[0].PointAtStart.DistanceTo(crvB[0].PointAtStart) - radii[1]) > tol) match_sort_crvs(crvD, crvB);

			Transform moveA = Transform.Translation(0, 0, radii[0]);
			Transform moveB = Transform.Translation(0, 0, radii[1]);
			Transform moveC = Transform.Translation(0, 0, extrude - (radii[1] * 2));
			Transform moveD = Transform.Translation(0, 0, extrude);

			Transform mirror_trans = Transform.Mirror(Plane.WorldXY);
			Transform centre_trans = Transform.Translation(0, 0, -(extrude * 0.5));


			// -------  Setup Output Curves  ------- //

			Curve[] final_crvsA = Array.ConvertAll(crvs, c => c.DuplicateCurve());
			Curve[] final_crvsB = Array.ConvertAll(crvs, c => c.DuplicateCurve());


			// -------  Main Loop - Build Surfaces  ------- //

			Brep[] srfs = new Brep[(count * 3) + 2];
			Curve[] side_crvs = new Curve[2];
			LoftType lt = LoftType.Straight;

			for (int i = 0; i < count; i++)
			{
			crvB[i].Transform(moveA);  // ---- Arrange Curves---- //
			crvC[i].Transform(moveB);
			int edge_num = crvB[i].IsLinear(0.01) ? 2 : sectors;

			if (has_radA)
			{
				int cross_num = (bulges[0] == 0) ? 2 : 4;
				Curve[] edge_curves = simple_edges(crvA[i], crvB[i], bulges[0], edge_num);
				srfs[count + i] = edge_srf(crvA[i], crvB[i], edge_curves, cross_num);
			}

			if (has_radB)
			{
				int cross_num = (bulges[1] == 0) ? 2 : 4;
				Curve[] edge_curves = simple_edges(crvD[i], crvC[i], bulges[1], edge_num);
				srfs[(count * 2) + i] = edge_srf(crvD[i], crvC[i], edge_curves, cross_num);
				srfs[(count * 2) + i].Transform(mirror_trans);
				srfs[(count * 2) + i].Transform(moveD);
			}

			crvC[i].Transform(moveC);

			if (has_sides)
			{
					side_crvs[0] = crvB[i];
					side_crvs[1] = crvC[i];
					srfs[i] = Brep.CreateFromLoft(side_crvs, pu, pu, lt, false)[0];
				}
			final_crvsB[i].Transform(moveD);
			}

			srfs[count * 3] = Brep.CreatePlanarBreps(crvA, 0.01)[0];
			srfs[(count * 3) + 1] = Brep.CreatePlanarBreps(crvD, 0.01)[0];
			srfs[(count * 3) + 1].Transform(moveD);

			Brep brep = Brep.JoinBreps(srfs, 0.1, 0.1)[0];

				if (mirror) { 
					brep.Transform(mirror_trans); 
					TransformGeos(final_crvsA, mirror_trans);
					TransformGeos(final_crvsB, mirror_trans);
				}
				if (centre) { 
					brep.Transform(centre_trans); 
					TransformGeos(final_crvsA, centre_trans);
					TransformGeos(final_crvsB, centre_trans);
				}

			brep.Transform(reorient);
			TransformGeos(final_crvsA, reorient);
			TransformGeos(final_crvsB, reorient);

			crv_listA = final_crvsA;
			crv_listB = final_crvsB;
			return brep; // new Brep();// 
		}
		
	private static Brep quick_extrude(Curve[] crvs, double extrude, double radius, double bulge, int sectors, bool centre, double tol, out Curve[] crv_listA, out Curve[] crv_listB)
	{
		// -------  Set Up Conditions  ------- //
		// List<Curve> test_crvs = new();

		int count = crvs.Length;
		bool loop = count == 1 && crvs[0].IsClosed;
		bool mirror = !centre && extrude != Math.Abs(extrude);
		extrude = Math.Abs(extrude);
		int cross_num = (bulge == 0) ? 2 : 4;

		bool has_sides = radius < extrude * 0.5;
		if (!has_sides) radius = extrude * 0.5;

		bool C2arc = bulge <= -1 && (radius * 3) + tol < extrude; // bulge is less than one and does not make the radius bigger than half the extrude
		if (C2arc)
		{
		radius *= 1.5;
		bulge = 0.72;
		}

		// -------  Set Up Standard Variables  ------- //

		Curve[] crvA = offset(crvs, -radius, out _, tol);

		// test_crvs.AddRange(crvA);

		Curve[] crvC = Array.ConvertAll(crvs, c => c.DuplicateCurve());
		if (Math.Abs(crvA[0].PointAtStart.DistanceTo(crvs[0].PointAtStart) - radius) > tol) match_sort_crvs(crvA, crvs);

		Transform moveB = Transform.Translation(0, 0, radius);
		Transform moveC = Transform.Translation(0, 0, extrude - radius);
		Transform moveD = Transform.Translation(0, 0, extrude);
		Transform moveC2 = Transform.Translation(0, 0, radius);

		Transform mirror_trans = Transform.Mirror(Plane.WorldXY);
		Transform centre_trans = Transform.Translation(0, 0, -(extrude * 0.5));


		// -------  Setup Output Curves  ------- //

		Curve[] final_crvsA = Array.ConvertAll(crvs, c => c.DuplicateCurve());
		Curve[] final_crvsB = Array.ConvertAll(crvs, c => c.DuplicateCurve());


		// -------  Main Loop - Build Surfaces  ------- //

		Brep[] srfs = new Brep[(count * 3) + 2];

		LoftType lt = LoftType.Straight;
		Curve[] crv_sides = new Curve[2];

		for (int i = 0; i < count; i++)
		{
			bool straight = crvs[i].IsLinear(0.01);
			crvs[i].Transform(moveB);  // ---- Arrange Curves---- //
			crvC[i].Transform(moveC);
			crv_sides[0] = crvs[i];
			crv_sides[1] = crvC[i];
		if (has_sides) srfs[i] = Brep.CreateFromLoft(crv_sides, pu, pu, lt, false)[0];
			srfs[i].Flip();
			int edge_num = straight ? 2 : sectors;

		Curve[] edges = simple_edges(crvA[i], crvs[i], bulge, edge_num);
		srfs[count + i] = edge_srf(crvs[i], crvA[i], edges, cross_num);

		srfs[(count * 2) + i] = srfs[count + i].DuplicateBrep();
		srfs[(count * 2) + i].Transform(mirror_trans);
		srfs[(count * 2) + i].Transform(moveD);
		
		final_crvsB[i].Transform(moveD);
		//test_crvs.AddRange(edges);
		}

		// Curve[] tc = test_crvs.ToArray();

		srfs[count * 3] = Brep.CreatePlanarBreps(crvA, 0.001)[0];
		srfs[(count * 3) + 1] = srfs[count * 3].DuplicateBrep();
		srfs[(count * 3) + 1].Transform(moveD);

		Brep brep = Brep.JoinBreps(remove_nulls(srfs), 0.001, 0.1)[0];

		if (mirror)
		{
			brep.Transform(mirror_trans);
			TransformGeos(final_crvsA, mirror_trans);
			TransformGeos(final_crvsB, mirror_trans);
		}
		if (centre)
		{
			brep.Transform(centre_trans);
			TransformGeos(final_crvsA, centre_trans);
			TransformGeos(final_crvsB, centre_trans);
		}

		crv_listA = final_crvsA;
		crv_listB = final_crvsB;
		return brep;
	}

private static Brep capped_extrude(Curve[] crvs, out Curve[] crv_listA, out Curve[] crv_listB, double length = 5.0, bool centre = false)
  {
    int count = crvs.Length;
	Plane pl = curves_plane(crvs);
    Vector3d dir = pl.Normal * length;
	Transform move = Transform.Translation(dir);
	if (centre)
	{
		TransformGeos(crvs, Transform.Translation(-dir * 0.5));
		pl.Transform(Transform.Translation(-dir * 0.5));
	}

	Curve[] final_crvsA = Array.ConvertAll(crvs, c => c.DuplicateCurve());
	Curve[] final_crvsB = Array.ConvertAll(crvs, c => c.DuplicateCurve());
	TransformGeos(final_crvsB, move);

    Brep[] sides = new Brep[count + 2];
	LoftType lt = LoftType.Straight;
	Curve[] crv_sides = new Curve[2];
    for (int i = 0; i < count; i++)
    {
		crv_sides[0] = final_crvsA[i];
		crv_sides[1] = final_crvsB[i];
		sides[i + 1] = Brep.CreateFromLoft(crv_sides, pu, pu, lt, false)[0]; // Surface.CreateExtrusion(crvs[i], dir).ToBrep();
    }
	sides[0] = Brep.CreatePlanarBreps(crvs, 0.001)[0];
    sides[count + 1] = sides[0].DuplicateBrep();
    sides[count + 1].Transform(move);

    Brep body = Brep.JoinBreps(sides, 0.001, 0.1)[0];
    if (body.SolidOrientation == BrepSolidOrientation.Inward) body.Flip();

            crv_listA = final_crvsA;
            crv_listB = final_crvsB;
    return body;
  }


	// ------------------------------------ Sub Constructions ------------------------------------ //

	private static Brep BuildFinalBrep(Brep brep_half, Curve[] curves, Brep[] final_breps, bool inside = false)
        {
            Brep[] final_joined = Brep.JoinBreps(final_breps, 0.001, 0.1);
            if (final_joined.Length > 1) final_joined = Brep.JoinBreps(final_joined, 0.01, 0.1);

            BoundingBox test_box = bb_union(curves, 0.1);

            Brep[] split = brep_half.Split(curves, 0.001);
            int spl_len = split.Length;
            int fj_len = final_joined.Length;

            int maxCount = spl_len + fj_len;
            Brep[] pieces = new Brep[maxCount];
            int piece_count = 0;

            for (int i = 0; i < spl_len; ++i)
            {
                bool condition = boxboxinside2D(test_box, split[i].GetBoundingBox(true));
                if ((inside && condition) || (!inside && !condition)) pieces[piece_count++] = split[i];
            }

            for (int i = 0; i < fj_len; ++i) pieces[piece_count++] = final_joined[i];

            Brep[] joined = Brep.JoinBreps(remove_nulls(pieces), 0.001, 0.1);
            if (joined.Length > 1 || !joined[0].IsSolid) joined = Brep.JoinBreps(joined, 0.01, 0.1);

            return joined[0];
        }

        private static Brep BuildFinalBrep(Brep brep_halfA, Curve[] curves_A, Brep brep_halfB, Curve[] curves_B, Brep[] final_breps, bool inside = false)
        {
            // First join the existing final breps
            Brep[] final_joined = Brep.JoinBreps(final_breps, 0.001, 0.1);

            // Compute bounding boxes for each curve set
            BoundingBox test_boxA = bb_union(curves_A, 0.1);
            BoundingBox test_boxB = bb_union(curves_B, 0.1);

            // Split each half with its curve set
            Brep[] splitA = brep_halfA.Split(curves_A, 0.01);
            Brep[] splitB = brep_halfB.Split(curves_B, 0.01);

            int spl_A_len = splitA.Length;
            int spl_B_len = splitB.Length;
            int fj_len = final_joined.Length;

            int maxCount = spl_A_len + spl_B_len + fj_len;
            Brep[] pieces = new Brep[maxCount];
            int piece_count = 0;

            // Collect pieces from splitA
            for (int i = 0; i < spl_A_len; ++i)
            {
                bool condition = boxboxinside2D(test_boxA, splitA[i].GetBoundingBox(true));
                if ((inside && condition) || (!inside && !condition)) pieces[piece_count++] = splitA[i];
            }

            // Collect pieces from splitB
            for (int i = 0; i < spl_B_len; ++i)
            {
                bool condition = boxboxinside2D(test_boxB, splitB[i].GetBoundingBox(true));
                if ((inside && condition) || (!inside && !condition))
                    pieces[piece_count++] = splitB[i];
            }

            // Add existing final breps
            for (int i = 0; i < fj_len; ++i) pieces[piece_count++] = final_joined[i];

            // Remove nulls and join
            Brep[] joined = Brep.JoinBreps(remove_nulls(pieces), 0.001, 0.1);
            if (joined.Length > 1 || !joined[0].IsSolid) joined = Brep.JoinBreps(joined, 0.01, 0.1);

            return joined[0];
        }



	// ------------------------------------ Updated Needs Checking ------------------------------------ //

	private static void align_crvs(Curve crvA, Curve crvB)
		{
			if (crvA.PointAtStart.DistanceToSquared(crvB.PointAtStart) > crvA.PointAtStart.DistanceToSquared(crvB.PointAtEnd)) crvB.Reverse();
		}



  // ------------------------------------ Optimized Already ------------------------------------ //


	private static Point3d project_point(Point3d pt, Brep brep, Vector3d direction) // Optimised
	{
		pt = new Point3d(pt - direction);
		Point3d[] pts = Intersection.RayShoot(new Ray3d(pt, direction), new[] { brep }, 1);
		return pts[0];
	}


  private static Point3d curves_central_point(Curve[] curves, Brep brep, Vector3d direction)
  {
      double minZ = double.MaxValue;                     // initialise to largest possible value

      for (int i = 0, n = curves.Length; i < n; ++i)
      {
          double projZ = project_point(curves[i].PointAtMid, brep, direction).Z;          // project the curve’s midpoint onto the brep and get its Z‑value
          if (projZ < minZ) minZ = projZ;                // keep the smallest Z seen
      }
      return new Point3d(0.0, 0.0, minZ);
  }


  private static Curve project_closest(Curve crv, Brep brep, Vector3d dir, double tol)  // Optimised
  {
    crv.Transform(Transform.Translation(-dir));
    Curve[] projected_curves = Curve.ProjectToBrep(crv, brep, dir, tol);
    Curve[] projected_joined = Curve.JoinCurves(projected_curves, tol, false);

    Point3d centre = crv.PointAtMid;
    int closestIndex = 0;
    double minDistance = double.MaxValue;

    for (int i = 0; i < projected_joined.Length; i++)
    {
      double distance = centre.DistanceToSquared(projected_joined[i].PointAtMid);
      if (distance < minDistance)
      {
        minDistance = distance;
        closestIndex = i;
      }
    }

    return projected_joined[closestIndex];
  }
  
  private static Brep edge_srf(Curve top, Curve bottom, Curve[] edge_curves, int num, bool loop = false, double tol = 0.001)
  {
    if (num < 3 || edge_curves == null)
    {
      return Brep.CreateFromLoft(new[] { top, bottom }, pu, pu, LoftType.Straight, false)[0];
    }

    double ang_tol = 0.1;
    double cos_tol = Math.Cos(ang_tol);

    Vector3d[] axes = new Vector3d[] { Vector3d.XAxis, -Vector3d.XAxis, Vector3d.YAxis, -Vector3d.YAxis, Vector3d.ZAxis, -Vector3d.ZAxis };

    Vector3d start = top.TangentAtStart;
    Vector3d end = top.TangentAtEnd;
    for (int i = 0; i < 6; i++)
    {
      if (start * axes[i] > cos_tol) { start = axes[i]; break; }
    }
    for (int i = 0; i < 6; i++)
    {
      if (end * axes[i] > cos_tol) { end = axes[i]; break; }
    }

    int count = edge_curves.Length;
    double gap = 1 / (num - 1.0);

    Curve[] curves = new Curve[num];

    if (IsClose(edge_curves[0].PointAtStart, top.PointAtStart) || IsClose(edge_curves[0].PointAtStart, top.PointAtEnd))
         { curves[0] = top; curves[num - 1] = bottom; }
    else { curves[0] = bottom; curves[num - 1] = top; }


    int pt_num = loop ? count + 1 : count;
    Point3d[] edge_mid_pts = new Point3d[pt_num];

    // Pre-calculate parameters
    double[,] parameters = new double[num, count];
    for (int i = 1; i < num - 1; i++)
    {
        double gap_size = gap * i;
        for (int j = 0; j < count; j++) edge_curves[j].NormalizedLengthParameter(gap_size, out parameters[i, j], 1E-03);
    }

    for (int i = 1; i < num - 1; i++)
    {
      for (int j = 0; j < count; j++)
      {
        edge_mid_pts[j] = edge_curves[j].PointAt(parameters[i, j]);
      }

      if (loop) edge_mid_pts[count] = edge_mid_pts[0];

      Curve edge_mid = Curve.CreateInterpolatedCurve(edge_mid_pts, 3, CurveKnotStyle.Uniform, start, end);
      if (loop) 
      {
        if (edge_mid.IsCircle(0.01)) edge_mid = new ArcCurve(new Circle(edge_mid_pts[0], edge_mid_pts[1], edge_mid_pts[2])); //circle_check(edge_mid, edge_mid_pts);
        else edge_mid = square_crv(edge_mid);
      }
      else edge_mid = square_crv(edge_mid);
      curves[i] = edge_mid;
    }

    if (top.IsClosed) Array.Resize(ref edge_curves, edge_curves.Length - 1);

    NurbsSurface surface = NurbsSurface.CreateNetworkSurface(curves, 3, 3, edge_curves, 3, 3, tol, tol, tol, out _);
    surface ??= NurbsSurface.CreateNetworkSurface(new[] { top, bottom }, 3, 3, edge_curves, 3, 3, tol, tol, tol, out _);

    return surface.ToBrep(); // new Brep(); //
  }  // optimized
  
  private static Curve[] simple_edges(Curve crvA, Curve crvB, double bulge, int sectors)
	{
		double gap = 1.0 / (sectors - 1.0);
		Point3d[] ptsA = new Point3d[sectors];
		Point3d[] ptsB = new Point3d[sectors];
		for (int i = 0; i < sectors; ++i)
		{
			double t = gap * i;
      		crvA.NormalizedLengthParameter(t, out double tA, 1E-03);
			ptsA[i] = crvA.PointAt(tA);
      		crvB.NormalizedLengthParameter(t, out double tB, 1E-03);
			ptsB[i] = crvB.PointAt(tB);
		}

		Curve[] edge_curves = new Curve[sectors];

		// Output Chamfers    
            if (bulge == 0)
            {
                for (int i = 0; i < sectors; ++i) edge_curves[i] = new LineCurve(ptsA[i], ptsB[i]);
				return edge_curves;
			}

		// Output Arcs
            if (bulge < 0)
            {
                for (int i = 0; i < sectors; ++i) edge_curves[i] = new ArcCurve(new Arc(ptsB[i], -Vector3d.ZAxis, ptsA[i]));
				return edge_curves;
			}

		// Output Blends
		//Curve side_ln = new LineCurve(new Point3d(0, 0, 1), Point3d.Origin);
			for (int i = 0; i < sectors; ++i)
			{
				Vector3d vec = ptsA[i] - ptsB[i];
				vec.Z = 0;
				Curve crv0 = new LineCurve(ptsA[i], ptsA[i] + vec);

				Curve side_ln = new LineCurve(new Point3d(ptsB[i].X, ptsB[i].Y, ptsB[i].Z + 1), ptsB[i]);
				edge_curves[i] = Curve.CreateBlendCurve(side_ln, crv0, BlendContinuity.Curvature, bulge, bulge);

			}
		return edge_curves;
	}
  

// ------------------------------------ Copied from ID_Tools_Library.ID_Tools_Class ------------------------------------ //
  




	// public static Curve[] offset(Curve[] curves, double fillet, out Plane pln, double tol = 0.01, double arc_tol = 0.05)
	// {
	// 	int num = curves.Length;
	// 	Plane plane = curves_plane(curves);
	// 	pln = orient_plane(plane);
	// 	Point3d origin = plane.Origin;
	// 	Vector3d normal = plane.Normal;
	// 	CurveOffsetCornerStyle cornerStyle = CurveOffsetCornerStyle.Smooth;
	// 	CurveOffsetEndStyle endStyle = CurveOffsetEndStyle.None;
	// 	Curve[] array = new Curve[num];
	// 	if (fillet == 0.0)
	// 	{
	// 		for (int i = 0; i < num; i++)
	// 		{
	// 			array[i] = curves[i].DuplicateCurve();
	// 		}
	// 		return array;
	// 	}
	// 	if (num == 1)
	// 	{
	// 		bool loose = !arc_test(curves[0]);
	// 		Curve[] array2 = curves[0].Offset(origin, normal, fillet, tol, tol, loose, cornerStyle, endStyle);
	// 		if (curves[0].IsClosed)
	// 		{
	// 			double length = curves[0].GetBoundingBox(accurate: true).Diagonal.Length;
	// 			GeometryBase[] geos = array2;
	// 			double length2 = bb_union(geos).Diagonal.Length;
	// 			if ((fillet > 0.0 && length2 < length) || (fillet < 0.0 && length2 > length))
	// 			{
	// 				fillet = 0.0 - fillet;
	// 				array2 = curves[0].Offset(origin, normal, fillet, tol, tol, loose, cornerStyle, endStyle);
	// 			}
	// 		}
	// 		return array2;
	// 	}
	// 	bool flag = IsClose(curves[0].PointAtStart, curves[^1].PointAtEnd);
	// 	for (int j = 0; j < num; j++)
	// 	{
	// 		Curve[] array3 = curves[j].Offset(origin, normal, 0.0 - fillet, tol, tol, loose: false, cornerStyle, endStyle);
	// 		array[j] = ((array3.Length > 1) ? Curve.JoinCurves(array3, tol, preserveDirection: false)[0] : array3[0]);
	// 	}
	// 	if (flag)
	// 	{
	// 		GeometryBase[] geos = curves;
	// 		double length3 = bb_union(geos).Diagonal.Length;
	// 		geos = array;
	// 		double length4 = bb_union(geos).Diagonal.Length;
	// 		if ((fillet > 0.0 && length4 < length3) || (fillet < 0.0 && length4 > length3))
	// 		{
	// 			fillet = 0.0 - fillet;
	// 			for (int k = 0; k < num; k++)
	// 			{
	// 				Curve[] array4 = curves[k].Offset(origin, normal, 0.0 - fillet, tol, tol, loose: false, cornerStyle, endStyle);
	// 				array[k] = ((array4.Length > 1) ? Curve.JoinCurves(array4, tol, preserveDirection: false)[0] : array4[0]);
	// 			}
	// 		}
	// 	}
	// 	array = loop_crv(array, fillet, flag);
	// 	clean_offset(array);
	// 	return array;
	// }

	// public static Curve[] loop_crv(Curve[] curves, double radius, bool closed_loop = true, double tol = 0.0001, double arc_tol = 0.03)
	// {
	// 	int num = curves.Length;
	// 	double length = Math.Abs(radius) * 1.1;
	// 	int num2 = (closed_loop ? num : (num - 1));



	// 	Console.WriteLine(" - " + curves[2].GetLength().ToString());
	// 	for (int i = 0; i < num2; i++)
	// 	{
	// 		int num3 = (closed_loop ? ((i + 1) % num) : (i + 1));
	// 		Console.WriteLine(i.ToString() + ", " + num3.ToString());
	// 		if (!IsClose(curves[i].PointAtEnd, curves[num3].PointAtStart))
	// 		{
	// 			Curve curve = curves[i].Extend(CurveEnd.End, length, CurveExtensionStyle.Smooth);
	// 			Curve curve2 = curves[num3].Extend(CurveEnd.Start, length, CurveExtensionStyle.Smooth);
	// 			CurveIntersections curveIntersections = Intersection.CurveCurve(curve, curve2, tol, tol);
	// 			if (curveIntersections != null && curveIntersections.Count != 0)
	// 			{
	// 				curves[i] = curve.Trim(curve.Domain.Min, curveIntersections[0].ParameterA);
	// 				curves[num3] = curve2.Trim(curveIntersections[0].ParameterB, curve2.Domain.Max);
	// 			}
	// 		}
	// 	}
	// 	for (int j = 0; j < num; j++)
	// 	{
	// 		Vector3d tangentAtStart = curves[j].TangentAtStart;
	// 		Vector3d tangentAtEnd = curves[j].TangentAtEnd;
	// 		Point3d pointAtStart = curves[j].PointAtStart;
	// 		Point3d pointAtEnd = curves[j].PointAtEnd;
	// 		if (IsCloseVec(tangentAtStart, tangentAtEnd) && curves[j].IsLinear(0.01))
	// 		{
	// 			curves[j] = new LineCurve(pointAtStart, pointAtEnd);
	// 		}
	// 		else if (arc_test(curves[j], arc_tol))
	// 		{
	// 			Curve curve3 = new ArcCurve(new Arc(pointAtStart, curves[j].PointAtMid, pointAtEnd));
	// 			if (IsCloseVec(tangentAtStart, curve3.TangentAtStart) && IsCloseVec(tangentAtEnd, curve3.TangentAtEnd))
	// 			{
	// 				curves[j] = curve3;
	// 			}
	// 		}
	// 		else
	// 		{
	// 			if (!(curves[j].CurvatureAt(curves[j].Domain.Mid).SquareLength > 200.0) && !(curves[j] is PolyCurve))
	// 			{
	// 				continue;
	// 			}
	// 			curves[j] = curves[j].Smooth(0.5, bXSmooth: true, bYSmooth: true, bZSmooth: true, bFixBoundaries: true, SmoothingCoordinateSystem.World, Plane.WorldXY);
	// 			BoundingBox boundingBox = curves[j].GetBoundingBox(accurate: true);
	// 			double num4 = boundingBox.Max.X - boundingBox.Min.X;
	// 			double num5 = boundingBox.Max.Y - boundingBox.Min.Y;
	// 			double num6 = Math.Sqrt(num4 * num4 + num5 * num5) * 0.005;
	// 			if (num6 < 0.001)
	// 			{
	// 				num6 = 0.001;
	// 			}
	// 			int degree = curves[j].Degree;
	// 			Point3d[] array = rebuild_crv_pts(curves[j], 7);
	// 			int num7 = array.Length;
	// 			double x = boundingBox.Min.X;
	// 			double y = boundingBox.Min.Y;
	// 			double z = boundingBox.Min.Z;
	// 			double x2 = boundingBox.Max.X;
	// 			double y2 = boundingBox.Max.Y;
	// 			double z2 = boundingBox.Max.Z;
	// 			for (int k = 0; k < num7; k++)
	// 			{
	// 				double num8 = array[k].X;
	// 				double num9 = array[k].Y;
	// 				double num10 = array[k].Z;
	// 				if (num8 < x + num6)
	// 				{
	// 					num8 = x;
	// 				}
	// 				else if (num8 > x2 - num6)
	// 				{
	// 					num8 = x2;
	// 				}
	// 				if (num9 < y + num6)
	// 				{
	// 					num9 = y;
	// 				}
	// 				else if (num9 > y2 - num6)
	// 				{
	// 					num9 = y2;
	// 				}
	// 				if (num10 < z + num6)
	// 				{
	// 					num10 = z;
	// 				}
	// 				else if (num10 > z2 - num6)
	// 				{
	// 					num10 = z2;
	// 				}
	// 				array[k].X = num8;
	// 				array[k].Y = num9;
	// 				array[k].Z = num10;
	// 			}
	// 			curves[j] = Curve.CreateControlPointCurve(array, degree);
	// 		}
	// 	}
	// 	return curves;
	// }



	public static Plane orient_plane(Plane plane)
	{
		const double tol = 0.01;
		Vector3d z = plane.ZAxis;

		if (IsCloseVec(z, Vector3d.ZAxis, false, tol))
		{ 			Console.WriteLine("0");
			return new Plane(plane.Origin, Vector3d.XAxis, Vector3d.YAxis);// Z ≈ +World_Z
		}

		if (IsCloseVec(z, -Vector3d.ZAxis, false, tol))
		{			Console.WriteLine("1");
			return new Plane(plane.Origin, Vector3d.XAxis, -Vector3d.YAxis);  // Z ≈ -World_Z  (bidirectional check true covers both ±, then sign decides)
		}
		Console.WriteLine("2");
		Vector3d z_cross = Vector3d.CrossProduct(Vector3d.ZAxis, z);

		Vector3d refX = Vector3d.CrossProduct(z, z_cross); refX.Unitize();
		Vector3d refY = Vector3d.CrossProduct(z, refX); refY.Unitize();

		if (refY.Z < 0.0) refX = -refX;

		Vector3d x, y;
		if (Math.Abs(refX.Z) < 0.5)
		{
			x = refX;
			y = Vector3d.CrossProduct(x, z); y.Unitize();
		}
		else
		{
			y = refX;
			x = Vector3d.CrossProduct(y, z); x.Unitize();
		}

		if (y.Z < 0.0) { x = -x; y = -y; }

		return new Plane(plane.Origin, x, y);
	}







// ------------------------------------ Helpers ------------------------------------ //

private bool no_input(string name)
    {
    int i = Component.Params.IndexOfInputParam(name);
    return i < 0 || Component.Params.Input[i].SourceCount == 0 || Component.Params.Input[i].VolatileDataCount == 0;
    }

public static Interval interval = new(0, 1);
public static Point3d pu = Point3d.Unset;

Vector3d Z_up = Vector3d.ZAxis;
}
# ---------- end extrude_punch_3 ----------
panel = Panel(extrude_punch_3.out)
split_brep_3 = SplitBrep(Brep=extrude_indent_2.Breps, Plane=xy_2, Fillet=Slider(0.9, range=0..3), Blend=0.68, Flip=False, cap=True, match=False)  # -> Breps, Curves
locate_4 = Locate(
    Geometry=locate_2.Surface,
    Position=[Slider(0, range=0..10), Slider(2, range=0..10), Slider(6, range=0..10), Slider(8, range=0..10)],
    InsetU=number_slider_8,
    InsetV=number_slider_8,
    OffsetW=0,
    box=False,
    simple=False)  # -> Plane, Surface, Edges, Body, Notes
place = Place(Geometry=groove.Curves, Plane=graft(locate_4.Plane))  # -> flatten(Geometry), Transform
text = Text(Text="Logo", Style=text_style)  # -> Curves, Hatches, Bounds
asterisk = Asterisk(Radius=Slider(5, range=0..10), Width=2, NumberOfArms=5, s=0)  # -> Curves, Joined, Points
polygon = Polygon(Radius=5, Sides=5, Fillet=Slider(1.5, range=0..3), Blend=0.72, Match=False, s=0)  # -> Curves, Joined, Circle, Centres, Points
place_2 = Place(Geometry=groove.Brep, Plane=locate_4.Plane)  # -> Geometry, Transform
locate_5 = Locate(
    Geometry=split_brep_3.Breps,
    Face=Slider(2, range=0..10),
    InsetU=0,
    InsetV=Slider(0, range=0..100),
    OffsetW=0,
    box=False,
    simple=False)  # -> Plane, Surface, Edges, Body, Notes
number_slider_9 = Slider(2, range=0..10)
number_slider_10 = Slider(0.2, range=0..1)
place_3 = Place(Geometry=rectangle_4.Curves, Plane=locate_3.Plane)  # -> Geometry, Transform
cir = Circle(Plane=locate.Plane, Radius=Slider(20, range=0..100))
number_slider_11 = Slider(1, range=0..1)
number_slider_12 = Slider(0.1, range=0..0.1)
srfsplit = SurfaceSplit(Surface=locate_2.Surface, Curves=flatten(place.Geometry))
volcano_curved = CurvedVolcano(
    Brep=geo_3,
    Curves=place_3.Geometry,
    Offset=Slider(5, range=0..10),
    Fillet=Slider(0.4, range=0..10),
    Blend=0.68,
    cap=True,
    from_edge=False,
    s=3)  # -> Brep, Planes, TopCurves, MidCurves, BottomCurves, FilletCurves, SideCurves
place_4 = Place(Geometry=polygon.Curves, Plane=locate_5.Plane)  # -> Geometry, Transform
toggle_2 = BooleanToggle(False)
extrude_indent_4 = ExtrudeIndent(
    Curves=cir,
    Brep=split_brep.Breps,
    Fillets=number_slider_10,
    Extrude=number_slider_9,
    Inset=Slider(1, range=0..10),
    Flip=Toggle(True),
    s=0)  # -> Breps, Planes, EdgesA, EdgesB, Notes
extrude_indent_5 = ExtrudeIndent(Curves=cir, Brep=split_brep.Breps, Fillets=number_slider_10, Extrude=number_slider_9, Inset=0, Flip=False, s=0)  # -> Breps, Planes, EdgesA, EdgesB, Notes
resize_2 = Resize(Geometry=asterisk.Joined, Refs=text.Curves, X=Toggle(True), align=False, match=True, union=True)  # -> Geometry, Planes, Scales, Moves, Notes
size = SizeSelect(Geometry=srfsplit, s=0)  # -> Piece, Others
geo_4 = Geometry([item.Item1, item.Item2, item.Item3, item.Item4])
extrude_indent_6 = ExtrudeIndent(
    Curves=place_4.Geometry,
    Brep=split_brep_3.Breps,
    Fillets=number_slider_12,
    Extrude=number_slider_11,
    Inset=0,
    Flip=False,
    s=4)  # -> Breps, Planes, EdgesA, EdgesB, Notes
geo_5 = Geometry(volcano_curved.TopCurves)
distribute = Distribute(Geometry=flatten([text.Curves, asterisk.Joined]), Y=Slider(1.1, range=0..10), align=False, centre=0, order=True)  # -> Geometry, Moves, Notes
number_slider_13 = Slider(6.1, range=0..10)
geo_6 = Geometry(size.Piece)
entwine = Entwine(Branch00=text.Curves, Branch01=resize_2.Geometry, FlattenInputs=True)
locate_6 = Locate(Geometry=extrude_indent_5.Breps, Face=Slider(2, range=0..10), InsetU=0, InsetV=0, OffsetW=0, box=True, simple=False)  # -> Plane, Surface, Edges, Body, Notes
extrude_punch_4 = ExtrudeAndPunch(curves=place_4.Geometry, brep=split_brep_3.Breps, radii=number_slider_12, extrude=number_slider_11)  # -> out, breps, planes, crvs_A, crvs_B, notes; inputs curves: list, brep: Brep, radii: list of Double, blends: list of Double, extrude: Double, inset: Double, flip: Boolean
# ---------- extrude_punch_4: C# ----------
// Grasshopper Script Instance
#region Usings
using System;
using System.Collections.Generic;

using Rhino;
using Rhino.Geometry;
using Rhino.Geometry.Intersect;

using Grasshopper;
using Grasshopper.Kernel;
using Grasshopper.Kernel.Types;

#r "ID_Tools_Library.dll"
using static ID_Tools_Library.ID_Tools_Class;


#endregion
public class Script_Instance : GH_ScriptInstance
{
	private void RunScript(
		List<object> curves,
		Brep brep,
		List<double> radii,
		List<double> blends,
		double extrude,
		double inset,
		bool flip,
		ref object breps,
		ref object planes,
		ref object crvs_A,
		ref object crvs_B,
		ref object notes)
    {

	// Updated 2026-03-24

    bool no_brep = no_input("brep");
    bool no_curves = no_input("curves");
    bool no_extrude = no_input("extrude");

    if (no_curves) { if (!no_brep) breps = new GH_Brep(brep); Component.Message = ""; return; }

    if (no_input("blends")) blends = new List<double>() { 0.68 };
    bool no_inset = no_input("inset");
    if (no_input("flip")) flip = false;

    if (!no_brep) brep.Faces.ShrinkFaces();
    
    bool hollow = !no_brep && !brep.IsSolid;      //   << ---------------------- Adjust This if necessary
    // bool hollow_inner = flip && !no_brep && !brep.IsSolid && no_extrude;

    double tol = 0.0001;
    int sectors = 27;
    Plane pln = Plane.WorldXY;


    // -------------------------------- Set Basic Conditions -------------------------------- //

    bool simple = no_input("radii");
    if (simple) radii = new List<double>() {0};
    if (radii.Count == 1) radii.Add(radii[0]);
    if (radii[0] == 0 && radii[1] == 0) simple = true;
    blends.Add(blends[0]);

    bool has_extrude = !no_extrude && Math.Abs(extrude) > tol;
    bool has_brep = !no_brep;

    bool hole = has_brep && has_extrude;
    bool through_hole = has_brep && !has_extrude;
    bool extrusion = !hole && !through_hole;

    bool quick = false;
    bool centre = extrusion && flip;

    bool simple_extrude = extrusion && simple;
    if (extrusion && !simple) quick = radii[0] == radii[1];

    bool inner_hole = false;
    bool inner_though = false;
    if (flip)
    {
      inner_hole = hole;
      inner_though = through_hole;
      hole = false;
      through_hole = false;
    }
    if (hole && !inner_hole && flip) { hole = false; inner_hole = true; }

    if (hollow)  // (!brep.IsSolid)
    {
      if (through_hole)
      {
        hole = true;
        through_hole = false;
      }
      else if (inner_though)
      {
        inner_hole = true;
        inner_though = false;
      }
    }


    // -------------------------------- Sort Curves -------------------------------- //

    Curve[] curve_list = object_curve_convert(curves);

    int[] keys = sort_crvs(curve_list, out bool[] crv_closed, out _, out _);

    int idx = crv_closed.Length;
    Plane[] plns = new Plane[idx];

    BoundingBox brep_bb = new();
    if (!no_brep) brep_bb = brep.GetBoundingBox(true);

    int counter = 0;
    for (int i = 0; i < idx; i++)
    {
        if (!crv_closed[i]) continue;

        Curve[] crvs = items_by_key(curve_list, keys, i);

        if (!no_inset && inset != 0) crvs = offset(crvs, -inset, out plns[i], tol);
        else plns[i] = curves_plane(crvs);
        if (!no_brep || hollow) plns[i] = plane_on_box(plns[i], brep_bb, 1); // if (!no_brep || hollow) ?

        TransformGeos(crvs, Transform.Scale(plns[i], 1, 1, 0));

        int count = crvs.Length;
        if (count > 1)
        {
            sort_crvs(crvs);
            clean_lines(ref crvs);
            match_crv_ends(crvs);
        }

        for (int j = 0; j < count; j++)    // Write directly back into curve_list and keys
        {
            curve_list[counter] = crvs[j];
            keys[counter] = i;
            counter++;
        }
    }

    Array.Resize(ref curve_list, counter);
    Array.Resize(ref keys, counter);


    // -------------------------------- Manage Empty Inputs -------------------------------- //

    if ((no_extrude || extrude == 0) && (no_curves || no_brep))
    {
		crvs_A = Array.ConvertAll(curve_list, c => new GH_Curve(c));
		Component.Message = "Surface";
		if (!no_brep) breps = new GH_Brep(brep);
		else breps = Array.ConvertAll(Brep.CreatePlanarBreps(curve_list, 0.001), b => new GH_Brep(b));
		return;
    }

    if (no_extrude && no_brep) { Component.Message = ""; return; }


    // --------------------------------  Sort incoming curves -------------------------------- //

    // List<Curve> test_crvs = new ();
	List<Curve> all_A = new();
	List<Curve> all_B = new();
	List<Brep> all_breps = new();
	List<Plane> plane_list = new();

    for (int i = 0; i < idx; i++)
    {
      Curve[] crvs = items_by_key(curve_list, keys, i);
      int count = crvs.Length;

      Plane base_plane = Plane.Unset;
      Plane plane = plns[i];
      Transform orient = Transform.PlaneToPlane(plane, pln);
      Transform reorient = Transform.PlaneToPlane(pln, plane);

      if (has_brep) brep.Transform(orient);
      TransformGeos(crvs, orient);
      
      // Check that the curve is inside the Brep's bounds
      double edge_inset_caution = (through_hole || hole) && !simple ? 0.2 + Math.Max(radii[0], radii[1]) : 0.2;  // <<<<<< ----------------------      Add Hollow?

      if (has_brep && !boxboxinside2D(brep.GetBoundingBox(true), bb_union(crvs, edge_inset_caution)))
      {
        brep.Transform(reorient);
        continue;
      }

      if (!no_extrude && extrude == 0 ) { brep.Transform(reorient); breps = brep; crvs_A = crvs; continue; }


      // -------------------------------- Construct Breps and Parts -------------------------------- //

      //Brep test_piece = new Brep();
      Curve[] edgA = new Curve[count];
      Curve[] edgB = new Curve[count];
      Brep part = new Brep();
      if (simple_extrude) part = capped_extrude(crvs, out edgA, out edgB, extrude, centre);
      else if (quick) part = quick_extrude(crvs, extrude, radii[0], blends[0], sectors, centre, tol, out edgA, out edgB);
      else if (extrusion) part = full_extrude(crvs, extrude, radii, blends, sectors, centre, tol, out edgA, out edgB);

      else if (hole) part = hole_extrude(crvs, brep, extrude, radii, blends, sectors, tol, out base_plane, out edgA, out edgB);     // <<<<<< -------- Add Hollow (IsSolid Test and use that to change how Extrude and Flip - OR!!! if Extrude = 0, then recalculate extrude and flip [DO THIS])
      else if (inner_hole) part = hole_inner(crvs, brep, extrude, radii, blends, sectors, tol, out base_plane, out edgA, out edgB);  // <<<<<< -------- Add Hollow (IsSolid Test and use that to change how Extrude and Flip - OR!!! if Extrude = 0, then recalculate extrude and flip [DO THIS])

      else if (through_hole) part = hole_through(crvs, brep, radii, blends, sectors, tol, out edgA, out edgB);
      else if (inner_though) part = through_inner(crvs, brep, radii, blends, sectors, tol, out edgA, out edgB);
      else continue;

      Curve[] edges_A = remove_nulls(edgA);
      Curve[] edges_B = remove_nulls(edgB);

      part.Transform(reorient);                                    

      if (through_hole || hole) brep = part;                       
      else
      {
        all_breps.Add(part);
        if (has_brep) brep.Transform(reorient);
      }
      if (base_plane.IsValid) 
      { 
        base_plane.Transform(reorient); 
		base_plane = orient_plane(base_plane); // Square up the plane and axes
        plane_list.Add(base_plane); 
        }
            if (edges_A.Length > 0) { 
                TransformGeos(edges_A, reorient); 
                all_A.AddRange(edges_A); 
            }
            if (edges_B.Length > 0)
            {
                TransformGeos(edges_B, reorient);
                all_B.AddRange(edges_B);
            }
        }


    if (all_breps.Count == 0) breps = new GH_Brep(brep);
    else{
      int brep_count = all_breps.Count;
      GH_Brep[] gh_brep = new GH_Brep[brep_count];
      for (int i = 0; i < brep_count; i++) gh_brep[i] = new GH_Brep(all_breps[i]);
      breps = gh_brep;
    }

    int all_A_count = all_A.Count;
    int all_B_count = all_B.Count;
    GH_Curve[] gh_crvs_A = new GH_Curve[all_A_count];
    for (int i = 0; i < all_A_count; i++) gh_crvs_A[i] = new GH_Curve(all_A[i]);
    GH_Curve[] gh_crvs_B = new GH_Curve[all_B_count];
    for (int i = 0; i < all_B_count; i++) gh_crvs_B[i] = new GH_Curve(all_A[i]);

    crvs_A = gh_crvs_A;
    crvs_B = gh_crvs_B;
    planes = plane_list;

    string identifier = "";
    if (simple_extrude) identifier = "Simple Extrude " + sectors.ToString();
    else if (quick) identifier = "Quick Extrude " + sectors.ToString();
    else if (extrusion) identifier = "Full Extrusion " + sectors.ToString();
    else if (hollow && hole) identifier = "Hollow " + sectors.ToString();
    else if (hollow && inner_hole) identifier = "Hollow Inner " + sectors.ToString();
    else if (hole) identifier = "Indent " + sectors.ToString();
    else if (inner_hole) identifier = "Indent Inner " + sectors.ToString();
    else if (through_hole) identifier = "Through Hole " + sectors.ToString();
    else if (inner_though) identifier = "Through Hole Inner " + sectors.ToString();

    Component.Message = identifier; // "Hello"; // 
    notes = new[] { identifier };

    }

	/*══════════════════════════════════════════════════════════════════════════════╗
	║                                                                               ║
	║                     Additional Functions + Classes Below                      ║
	║                                                                               ║
	╚══════════════════════════════════════════════════════════════════════════════*/


	private Brep through_inner(Curve[] curves, Brep brep, List<double> radii, List<double> bulges, int sectors, double tol, out Curve[] crv_listA, out Curve[] crv_listB)
		{
		//List<Curve> test_crvs = new List<Curve>();
		int count = curves.Length;
		if (count == 1) sectors = (sectors * 2) + 1;
		
		double gap = 1 / (sectors - 1.0);
		Plane pln = Plane.WorldXY;
		LoftType loft_s = LoftType.Straight;

		bool top_sharp = radii[0] == 0;
		bool bot_sharp = radii[1] == 0;

		bool top_chamfer = bulges[0] == 0;
		bool bot_chamfer = bulges[1] == 0;

		int cross_numA = top_chamfer ? 2 : 4;
		int cross_numB = bot_chamfer ? 2 : 4;

		bool remirror = brep.GetBoundingBox(true).Center.Z < 0;  // Put Brep above Plane.XY
		Transform mirror = Transform.Mirror(pln);
		if (remirror) brep.Transform(mirror);


		// ------- Setup Curves ------- //
	
		double radA = -radii[0];
		double radB = -radii[1];

		Curve[] crvA = (top_sharp)
		? Array.ConvertAll(curves, c => c.DuplicateCurve())
		: offset(curves, radA, out _, tol);

		Curve[] crvB = Array.ConvertAll(curves, c => c.DuplicateCurve());
		Curve[] crvC = Array.ConvertAll(curves, c => c.DuplicateCurve());

		Curve[] crvD = (bot_sharp)
			? Array.ConvertAll(curves, c => c.DuplicateCurve())
			: offset(curves, radB, out _, tol);

		Point3d pt_on_other_side = new Point3d(0, 0, brep.GetBoundingBox(true).Max.Z + 1);
		Transform move_to_other_sides = Transform.Translation(new Vector3d(pt_on_other_side));
		TransformGeos(crvC, move_to_other_sides);
		TransformGeos(crvD, move_to_other_sides);


		// ------- Separate BrepFaces ------- //

		Brep[] final_breps = new Brep[count * 3];
		separate_brepfaces(brep, crvA, Z_up, out Brep brep_halfA, out Brep brep_out, out _);
		separate_brepfaces(brep_out, crvD, -Z_up, out Brep brep_halfB, out brep_out, out _);

		double[] ts = new double[sectors];
		for (int i = 0; i < sectors; i++) ts[i] = i * gap;


		// ------- Project Curves ------- //

		crvA = Array.ConvertAll(crvA, c => project_closest(c, brep_halfA, Z_up, tol));
		crvB = (top_sharp)
			? Array.ConvertAll(crvA, c => c.DuplicateCurve())
			: Array.ConvertAll(crvB, c => project_closest(c, brep_halfA, Z_up, tol));

		crvD = Array.ConvertAll(crvD, c => project_closest(c, brep_halfB, -Z_up, tol));
		crvC = (bot_sharp)
			? Array.ConvertAll(crvD, c => c.DuplicateCurve())
			: Array.ConvertAll(crvC, c => project_closest(c, brep_halfB, -Z_up, tol));

		match_sort_crvs(curves, crvA, false);
		match_sort_crvs(curves, crvB, false);
		match_sort_crvs(curves, crvC, false);
		match_sort_crvs(curves, crvD, false);

		Point3d central_ptA = project_point(Point3d.Origin, brep_halfA, Z_up);
		Point3d central_ptB = project_point(pt_on_other_side, brep_halfB, -Z_up);

				Curve[] final_crvsA = new Curve[count];
				Curve[] final_crvsB = new Curve[count];

				Array.Copy(Array.ConvertAll(crvB, c => c.DuplicateCurve()), final_crvsA, count);
				Array.Copy(Array.ConvertAll(crvC, c => c.DuplicateCurve()), final_crvsB, count);

		TransformGeos(crvB, Transform.Translation(0, 0, radii[0]));
		TransformGeos(crvC, Transform.Translation(0, 0, -radii[1]));


		// ---------------------------------------- main loop ---------------------------------------- //

		Curve[] edges_A = new Curve[sectors];
		Curve[] edges_B = new Curve[sectors];

		for (int i = 0; i < count; i++)
		{
			bool straightA = crvA[i].IsLinear(0.01);  //crvA[i].IsLinear(0.01) && crvB[i].IsLinear(0.01);
			bool straightB = crvD[i].IsLinear(0.01);

			for (int j = 0; j < sectors; j++)
			{
			crvB[i].NormalizedLengthParameter(ts[j], out double tB, 1E-03);
			Point3d pB = crvB[i].PointAt(tB);
			crvC[i].NormalizedLengthParameter(ts[j], out double tC, 1E-03);
			Point3d pC = crvC[i].PointAt(tC);

			Curve ln = new LineCurve(pC, pB);

			bool straight_checkA = !straightA || (straightA && (j == 0 || j == sectors - 1));
			bool straight_checkB = !straightB || (straightB && (j == 0 || j == sectors - 1));

			if (!top_sharp && straight_checkA && !top_chamfer)
			{
				crvA[i].NormalizedLengthParameter(ts[j], out double tA, 1E-03);
				Point3d pA = crvA[i].PointAt(tA);
				Vector3d vec = pA - pB;
				vec.Z = 0;

				brep_halfA.ClosestPoint(pA, out _, out ComponentIndex ci, out _, out _, 0.1, out _);
				BrepFace B_face = brep_halfA.Faces[ci.Index];
				Curve cx_crv = GetSurfaceProxyCurve(B_face, pA, vec);

				if (IsClose(pA, cx_crv.PointAtEnd)) cx_crv.Reverse();
				edges_A[j] = Curve.CreateBlendCurve(ln, cx_crv, BlendContinuity.Curvature, bulges[0], bulges[0]);
			}

			if (!bot_sharp && straight_checkB && !bot_chamfer)
			{
				crvD[i].NormalizedLengthParameter(ts[j], out double tD, 1E-03);
				Point3d pD = crvD[i].PointAt(tD);
				Vector3d vec = pD - pC;
				vec.Z = 0;

				brep_halfB.ClosestPoint(pD, out _, out ComponentIndex ci, out _, out _, 0.1, out _);
				BrepFace B_face = brep_halfB.Faces[ci.Index];
				Curve cx_crv = GetSurfaceProxyCurve(B_face, pD, vec);

				if (IsClose(pD, cx_crv.PointAtStart)) cx_crv.Reverse();
				edges_B[j] = Curve.CreateBlendCurve(cx_crv, ln, BlendContinuity.Curvature, bulges[1], bulges[1]);
			}
			}


			if (!top_sharp)
			{
			if (straightA) final_breps[i] = (top_chamfer)
				? Brep.CreateFromLoft(new[] { crvA[i], crvB[i] }, pu, pu, loft_s, false)[0]
				: Brep.CreateFromLoft(new[] { edges_A[0], edges_A[sectors - 1] }, pu, pu, loft_s, false)[0];
			else final_breps[i] = (top_chamfer)
				? Brep.CreateFromLoft(new[] { crvB[i], crvA[i] }, pu, pu, loft_s, false)[0]
				: edge_srf(crvB[i], crvA[i], edges_A, cross_numA);
			}
			if (!bot_sharp)
			{
			if (straightB) final_breps[(count * 2) + i] = (bot_chamfer)
				? Brep.CreateFromLoft(new[] { crvC[i], crvD[i] }, pu, pu, loft_s, false)[0]
				: Brep.CreateFromLoft(new[] { edges_B[0], edges_B[sectors - 1] }, pu, pu, loft_s, false)[0];
			else final_breps[(count * 2) + i] = (bot_chamfer)
				? Brep.CreateFromLoft(new[] { crvD[i], crvC[i] }, pu, pu, loft_s, false)[0]
				: edge_srf(crvD[i], crvC[i], edges_B, cross_numB);
			}
			final_breps[count + i] = Brep.CreateFromLoft(new[] { crvB[i], crvC[i] }, pu, pu, loft_s, false)[0];
		}

		Brep final_brep = BuildFinalBrep(brep_halfA, crvA, brep_halfB, crvD, final_breps, true);

		if (remirror)
		{
			brep.Transform(mirror);
			final_brep.Transform(mirror);
					TransformGeos(final_crvsA, mirror);
					TransformGeos(final_crvsB, mirror);
			//brep.Transform(mirror);
			//for (int i = 0; i < test_crvs.Count; i++) if (test_crvs[i] != null) test_crvs[i].Transform(mirror);
		}

		if (final_brep.SolidOrientation == BrepSolidOrientation.Inward) final_brep.Flip();

				crv_listA = final_crvsA;
				crv_listB = final_crvsB; // .Concat(test_crvs).ToArray();

		return final_brep;
		}
	
	private Brep hole_through(Curve[] curves, Brep brep, List<double> radii, List<double> bulges, int sectors, double tol, out Curve[] crv_listA, out Curve[] crv_listB)
		{
			//List<Curve> test_crvs = new List<Curve>();
			int count = curves.Length;
			if (count == 1) sectors = (sectors * 2) + 1;
			
			double gap = 1 / (sectors - 1.0);
			Plane pln = Plane.WorldXY;
			LoftType loft_s = LoftType.Straight;

			bool top_sharp = radii[0] == 0;
			bool bot_sharp = radii[1] == 0;

			bool top_chamfer = bulges[0] == 0;
			bool bot_chamfer = bulges[1] == 0;

			int cross_numA = top_chamfer ? 2 : 4;
			int cross_numB = bot_chamfer ? 2 : 4;

			bool remirror = brep.GetBoundingBox(true).Center.Z < 0;  // Put Brep above Plane.XY
			Transform mirror = Transform.Mirror(pln);
			if (remirror) brep.Transform(mirror);


			// ------- Setup Curves ------- //
		
			double radA = radii[0];
			double radB = radii[1];

			Curve[] crvA = (top_sharp)
			? Array.ConvertAll(curves, c => c.DuplicateCurve())
			: offset(curves, radA, out _, tol);

			Curve[] crvB = Array.ConvertAll(curves, c => c.DuplicateCurve());
			Curve[] crvC = Array.ConvertAll(curves, c => c.DuplicateCurve());

			Curve[] crvD = (bot_sharp)
			? Array.ConvertAll(curves, c => c.DuplicateCurve())
			: offset(curves, radB, out _, tol);

			Point3d pt_on_other_side = new Point3d(0, 0, brep.GetBoundingBox(true).Max.Z + 1);
			Transform move_to_other_sides = Transform.Translation(new Vector3d(pt_on_other_side));
			TransformGeos(crvC, move_to_other_sides);
			TransformGeos(crvD, move_to_other_sides);


			// ------- Separate BrepFaces ------- //

			Brep[] final_breps = new Brep[count * 3 + 1];
			separate_brepfaces(brep, crvA, Z_up, out Brep brep_halfA, out Brep brep_out, out _);
			separate_brepfaces(brep_out, crvD, -Z_up, out Brep brep_halfB, out final_breps[count * 3], out _);

			double[] ts = new double[sectors];
			for (int i = 0; i < sectors; i++) ts[i] = i * gap;


			// ------- Project Curves ------- //

			crvA = Array.ConvertAll(crvA, c => project_closest(c, brep_halfA, Z_up, tol));
			crvB = (top_sharp)
			? Array.ConvertAll(crvA, c => c.DuplicateCurve())
			: Array.ConvertAll(crvB, c => project_closest(c, brep_halfA, Z_up, tol));

			crvD = Array.ConvertAll(crvD, c => project_closest(c, brep_halfB, -Z_up, tol));
			crvC = (bot_sharp)
			? Array.ConvertAll(crvD, c => c.DuplicateCurve())
			: Array.ConvertAll(crvC, c => project_closest(c, brep_halfB, -Z_up, tol));

			match_sort_crvs(curves, crvA, false);
			match_sort_crvs(curves, crvB, false);
			match_sort_crvs(curves, crvC, false);
			match_sort_crvs(curves, crvD, false);

			Point3d central_ptA = project_point(Point3d.Origin, brep_halfA, Z_up);
			Point3d central_ptB = project_point(pt_on_other_side, brep_halfB, -Z_up);

			Curve[] final_crvsA = new Curve[count];
			Curve[] final_crvsB = new Curve[count];

			Array.Copy(Array.ConvertAll(crvB, c => c.DuplicateCurve()), final_crvsA, count);
			Array.Copy(Array.ConvertAll(crvC, c => c.DuplicateCurve()), final_crvsB, count);

			TransformGeos(crvB, Transform.Translation(0, 0, radii[0]));
			TransformGeos(crvC, Transform.Translation(0, 0, -radii[1]));


			// ---------------------------------------- main loop ---------------------------------------- //

			Curve[] edges_A = new Curve[sectors];
			Curve[] edges_B = new Curve[sectors];

			for (int i = 0; i < count; i++)
			{
			bool straightA = crvA[i].IsLinear(0.01);  //crvA[i].IsLinear(0.01) && crvB[i].IsLinear(0.01);
			bool straightB = crvD[i].IsLinear(0.01);

			for (int j = 0; j < sectors; j++)
			{
				crvB[i].NormalizedLengthParameter(ts[j], out double tB, 1E-03);
				Point3d pB = crvB[i].PointAt(tB);
				crvC[i].NormalizedLengthParameter(ts[j], out double tC, 1E-03);
				Point3d pC = crvC[i].PointAt(tC);
				Curve ln = new LineCurve(pC, pB);

				bool straight_checkA = !straightA || (straightA && (j == 0 || j == sectors - 1));
				bool straight_checkB = !straightB || (straightB && (j == 0 || j == sectors - 1));

				if (!top_sharp && straight_checkA && !top_chamfer)
				{
				crvA[i].NormalizedLengthParameter(ts[j], out double tA, 1E-03);
				Point3d pA = crvA[i].PointAt(tA);
				Vector3d vec = pA - pB;
				vec.Z = 0;

				brep_halfA.ClosestPoint(pA, out _, out ComponentIndex ci, out _, out _, 0.1, out _);
				BrepFace B_face = brep_halfA.Faces[ci.Index];
				Curve cx_crv = GetSurfaceProxyCurve(B_face, pA, vec);

				if (IsClose(pA, cx_crv.PointAtEnd)) cx_crv.Reverse();
				edges_A[j] = Curve.CreateBlendCurve(ln, cx_crv, BlendContinuity.Curvature, bulges[0], bulges[0]);
				}

				if (!bot_sharp && straight_checkB && !bot_chamfer)
				{
				crvD[i].NormalizedLengthParameter(ts[j], out double tD, 1E-03);
				Point3d pD = crvD[i].PointAt(tD);
				Vector3d vec = pD - pC;
				vec.Z = 0;

				brep_halfB.ClosestPoint(pD, out _, out ComponentIndex ci, out _, out _, 0.1, out _);
				BrepFace B_face = brep_halfB.Faces[ci.Index];
				Curve cx_crv = GetSurfaceProxyCurve(B_face, pD, vec);

				if (IsClose(pD, cx_crv.PointAtStart)) cx_crv.Reverse();
				edges_B[j] = Curve.CreateBlendCurve(cx_crv, ln, BlendContinuity.Curvature, bulges[1], bulges[1]);
				}
			}


			if (!top_sharp)
			{
				if (straightA) final_breps[i] = (top_chamfer)
					? Brep.CreateFromLoft(new[] { crvA[i], crvB[i] }, pu, pu, loft_s, false)[0]
					: Brep.CreateFromLoft(new[] { edges_A[0], edges_A[sectors - 1] }, pu, pu, loft_s, false)[0];
				else final_breps[i] = (top_chamfer)
				? Brep.CreateFromLoft(new[] { crvB[i], crvA[i] }, pu, pu, loft_s, false)[0]
				: edge_srf(crvB[i], crvA[i], edges_A, cross_numA);
			}
			if (!bot_sharp)
			{
				if (straightB) final_breps[(count * 2) + i] = (bot_chamfer)
					? Brep.CreateFromLoft(new[] { crvC[i], crvD[i] }, pu, pu, loft_s, false)[0]
					: Brep.CreateFromLoft(new[] { edges_B[0], edges_B[sectors - 1] }, pu, pu, loft_s, false)[0];
				else final_breps[(count * 2) + i] = (bot_chamfer)
				? Brep.CreateFromLoft(new[] { crvD[i], crvC[i] }, pu, pu, loft_s, false)[0]
				: edge_srf(crvD[i], crvC[i], edges_B, cross_numB);
			}
			final_breps[count + i] = Brep.CreateFromLoft(new[] { crvB[i], crvC[i] }, pu, pu, loft_s, false)[0];
			}


			Brep final_brep = BuildFinalBrep(brep_halfA, crvA, brep_halfB, crvD, final_breps, false);

			if (remirror)
			{
			brep.Transform(mirror);
			final_brep.Transform(mirror);
						TransformGeos(final_crvsA, mirror);
						TransformGeos(final_crvsB, mirror);

			//for (int i = 0; i < test_crvs.Count; i++) if (test_crvs[i] != null) test_crvs[i].Transform(mirror);
			}

			if (final_brep.SolidOrientation == BrepSolidOrientation.Inward) final_brep.Flip();

					crv_listA = final_crvsA;
					crv_listB = final_crvsB; //.Concat(test_crvs).ToArray();

			return final_brep;
		}
  
	private Brep hole_inner(Curve[] curves, Brep brep, double extrude, List<double> radii, List<double> bulges, int sectors, double tol, out Plane pl, out Curve[] crv_listA, out Curve[] crv_listB)
		{
			// List<Curve> test_crvs = new();
			sort_crvs(curves);
			bool hollow = extrude == 0;
			
			if (curves.Length == 1) sectors = (sectors * 2) + 1;
			
			double gap = 1 / (sectors - 1.0);
			Plane pln = Plane.WorldXY;
			int count = curves.Length;

			bool top_sharp = radii[0] == 0;
			bool bot_sharp = radii[1] == 0;

			bool top_chamfer = bulges[0] == 0;
			bool bot_chamfer = bulges[1] == 0;

			int cross_numA = top_chamfer ? 2 : 4;
			int cross_numB = bot_chamfer ? 2 : 4;

			bool remirror = brep.GetBoundingBox(true).Center.Z < 0;  // Put Brep above Plane.XY
			Transform mirror = Transform.Mirror(pln);
			if (remirror) brep.Transform(mirror);


			// ------- Setup Planes ------- //

			Plane base_plane = pln;
			Plane inside_plane = pln;
			Point3d central_pt = curves_central_point(curves, brep, Z_up);

			if (hollow && central_pt.Z == 0) { pl = pln; crv_listA = curves; crv_listB = curves; return brep; }
			if (hollow)
			{    // ------- For Hollow Extrude to Surface (no Extrude Input)
			extrude = central_pt.Z;
			extrude *= (extrude < 0) ? 1 : -1;
			}

			double flip = (extrude < 0) ? -1 : 1;

			base_plane.Origin = central_pt;
			base_plane.Transform(Transform.Translation(0, 0, extrude));
			

			// ------- Setup Curves ------- //
		
			double radA = -radii[0];
			double radB = -radii[1];

			Curve[] crvA = (top_sharp)
			? Array.ConvertAll(curves, c => c.DuplicateCurve())
			: offset(curves, radA, out _, tol);


			// ------- Separate BrepFaces ------- //

			Brep[] final_breps = new Brep[count * 3 + 1];
			separate_brepfaces(brep, crvA, Z_up, out Brep brep_half, out Brep brep_out, out Point3d[] flat_pts);  //  , out Curve[] pro_crvs, out Point3d[] pro_pts


			// ------- Test Flat - Use Z Height because Brep is already oriented to the XY Plane ------- //

			BoundingBox flat_bb = new BoundingBox(flat_pts);
			bool flat_srf = flat_bb.Max.Z - flat_bb.Min.Z < tol;

			//Curve[] test_flat_crvs = new Curve[count * 2];
			//Array.Copy(offset(curves, radA - 0.1, out _, tol), test_flat_crvs, count);
			//Array.Copy(crvA, 0, test_flat_crvs, count, count);
			//bool flat_srf = test_flat(test_flat_crvs, brep_half, tol); 

			if (flat_srf)
			{
			Curve[] quick_crvs = new Curve[count];
			for (int i = 0; i < count; i++) quick_crvs[i] = project_closest(curves[i], brep_half, Z_up, tol);
			Brep quick_brep = full_extrude(quick_crvs, extrude, radii, bulges, sectors, false, tol, out Curve[] f_crvsA, out Curve[] f_crvsB);

			if (remirror) 
				{
				quick_brep.Transform(mirror);
				brep.Transform(mirror);
				base_plane.Transform(mirror);
				TransformGeos(quick_crvs, mirror);
				TransformGeos(f_crvsA, mirror);
				TransformGeos(f_crvsB, mirror);
				}

			pl = base_plane; // new Plane(new Point3d(0, 0, extrude), Vector3d.XAxis, Vector3d.YAxis); //
			crv_listA = f_crvsA;
			crv_listB = f_crvsB; // quick_crvs; // 
			return quick_brep;
			}


			// ------- Setup Curves ------- //

			Curve[] crvD = (bot_sharp)
			? Array.ConvertAll(curves, c => c.DuplicateCurve())
			: offset(curves, radB, out _, tol);

			crvA = Array.ConvertAll(crvA, c => project_closest(c, brep_half, Z_up, tol));
			Curve[] crvB = (top_sharp)
			? Array.ConvertAll(crvA, c => c.DuplicateCurve())
			: Array.ConvertAll(curves, c => project_closest(c, brep_half, Z_up, tol));

			if (crvA.Length == 1) align_crvs(crvA[0], crvB[0]);
			match_sort_crvs(crvA, crvB);

			Curve[] crvC = Array.ConvertAll(curves, c => c.DuplicateCurve());
			Curve[] crvE = Array.ConvertAll(crvB, c => c.DuplicateCurve());
					Curve[] final_crvsA = Array.ConvertAll(crvB, c => c.DuplicateCurve());

			double z_move = base_plane.OriginZ;
			double inside_z = base_plane.OriginZ - (radii[1] * flip);
			inside_plane.OriginZ = inside_z;
			TransformGeos(crvB, Transform.Translation(0, 0, radii[0] * flip));
			TransformGeos(crvC, Transform.Scale(inside_plane, 1, 1, 0));
			TransformGeos(crvD, Transform.Scale(base_plane, 1, 1, 0));
			TransformGeos(crvE, Transform.Scale(inside_plane, 1, 1, 0));

			Curve[] final_crvsB = Array.ConvertAll(crvC, c => c.DuplicateCurve());
			TransformGeos(final_crvsB, Transform.Scale(base_plane, 1, 1, 0));

			// ------- main loop ------- //

			BlendContinuity curvature = BlendContinuity.Curvature;
			LoftType straight_loft = LoftType.Straight;

			double[] ts = new double[sectors];
			for (int i = 0; i < sectors; i++) ts[i] = i * gap;

			for (int i = 0; i < count; i++)
			{
			bool straight = crvA[i].IsLinear(0.01);

			Curve[] edges_A = new Curve[sectors];
			Curve[] edges_B = new Curve[sectors];

			for (int j = 0; j < sectors; j++)
			{
				bool straight_check = !straight || (straight && (j == 0 || j == sectors - 1));

				if (!top_sharp && straight_check && !top_chamfer)
				{
				crvA[i].NormalizedLengthParameter(ts[j], out double tA, 1E-03);
				Point3d pA = crvA[i].PointAt(tA);
				crvB[i].NormalizedLengthParameter(ts[j], out double tB, 1E-03);
				Point3d pB = crvB[i].PointAt(tB);

								Point3d pE = new(pB.X, pB.Y, inside_z);
				Curve lnA = new LineCurve(pB, pE);
				Vector3d vec = pA - pB;
				vec.Z = 0;

				brep_half.ClosestPoint(pA, out _, out ComponentIndex ci, out _, out _, 0.1, out _);
				BrepFace B_face = brep_half.Faces[ci.Index];
				Curve cx_crv = GetSurfaceProxyCurve(B_face, pA, vec);

				if (IsClose(pA, cx_crv.PointAtStart)) cx_crv.Reverse();
				edges_A[j] = Curve.CreateBlendCurve(cx_crv, lnA, curvature, bulges[0], bulges[0]);
				}

				if (!bot_sharp && straight_check && !bot_chamfer)
				{
				crvC[i].NormalizedLengthParameter(ts[j], out double tC, 1E-03);
				Point3d pC = crvC[i].PointAt(tC);

				Curve lnC = new LineCurve(new Point3d(pC - Z_up * flip), pC);
				crvD[i].NormalizedLengthParameter(ts[j], out double tD, 1E-03);
				Point3d pD = crvD[i].PointAt(tD);

				Vector3d vec = pD - pC;
				vec.Z = 0;
				Curve lnB = new LineCurve(pD, new Point3d(pD + vec));
				edges_B[j] = Curve.CreateBlendCurve(lnC, lnB, curvature, bulges[1], bulges[1]);
				}
			}

			if (!top_sharp)
			{
				if (straight) final_breps[i] = (top_chamfer)
					? Brep.CreateFromLoft(new[] { crvA[i], crvB[i] }, pu, pu, straight_loft, false)[0]
					: Brep.CreateFromLoft(new[] { edges_A[0], edges_A[sectors - 1] }, pu, pu, straight_loft, false)[0];
				else final_breps[i] = (top_chamfer)
				? Brep.CreateFromLoft(new[] { crvA[i], crvB[i] }, pu, pu, straight_loft, false)[0]
				: edge_srf(crvA[i], crvB[i], edges_A, cross_numA);
			}

			if (!bot_sharp)
			{
				if (straight) final_breps[(count * 2) + i] = (bot_chamfer)
					? Brep.CreateFromLoft(new[] { crvC[i], crvD[i] }, pu, pu, straight_loft, false)[0]
					: Brep.CreateFromLoft(new[] { edges_B[0], edges_B[sectors - 1] }, pu, pu, straight_loft, false)[0];
				else final_breps[(count * 2) + i] = (bot_chamfer)
				? Brep.CreateFromLoft(new[] { crvC[i], crvD[i] }, pu, pu, straight_loft, false)[0]
				: edge_srf(crvC[i], crvD[i], edges_B, cross_numB);
			}

			final_breps[count + i] = Brep.CreateFromLoft(new[] { crvB[i], crvE[i] }, pu, pu, straight_loft, false)[0];
			}


			// ------- Re-Assemble parts ------- //

			final_breps[count * 3] = Brep.CreatePlanarBreps(crvD, 0.001)[0];
			Brep final_brep = BuildFinalBrep(brep_half, crvA, final_breps, true);

			//test_crvs.AddRange(crvA);

			if (remirror)
			{
			//brep_half.Transform(mirror);
			brep.Transform(mirror);
			final_brep.Transform(mirror);
			base_plane.Transform(mirror);
			TransformGeos(final_crvsA, mirror);
			TransformGeos(final_crvsB, mirror);
			}
			else base_plane = new Plane(base_plane.Origin, -Vector3d.ZAxis);

			pl = base_plane; //   Plane.WorldXY;  //  
			crv_listA = final_crvsA; // .Concat(test_crvs).ToArray(); // new[] { new LineCurve(Point3d.Origin, new Point3d(0, 0, 1)) }; // crvA.Concat(crvB).Concat(crvC).Concat(crvD).ToArray(); //  crvD; // test_crvs.ToArray(); // 
			crv_listB = final_crvsB;
			if (final_brep.SolidOrientation == BrepSolidOrientation.Inward) final_brep.Flip();
			
			return final_brep; // brep_half; //  new Brep(); // 
		}

	private Brep hole_extrude(Curve[] curves, Brep brep, double extrude, List<double> radii, List<double> bulges, int sectors, double tol, out Plane pl, out Curve[] crv_listA, out Curve[] crv_listB)
		{
			Console.WriteLine("hole_extrude");
			// List<Curve> test_crvs = new();
			bool hollow = extrude == 0;
			sort_crvs(curves);
			if (curves.Length == 1) sectors = (sectors * 2) + 1;
			
			double gap = 1 / (sectors - 1.0);
			Plane pln = Plane.WorldXY;
			int count = curves.Length;

			bool top_sharp = radii[0] == 0;
			bool bot_sharp = radii[1] == 0;

			bool top_chamfer = bulges[0] == 0;
			bool bot_chamfer = bulges[1] == 0;

			int cross_numA = top_chamfer ? 2 : 4;
			int cross_numB = bot_chamfer ? 2 : 4;

			bool remirror = brep.GetBoundingBox(true).Center.Z < 0;  // Put Brep above Plane.XY
			Transform mirror = Transform.Mirror(pln);
			if (remirror) brep.Transform(mirror);


			// ------- Setup Curves ------- //
		
			double radA = radii[0];
			double radB = -radii[1];

			Curve[] crvA = (top_sharp)
			? Array.ConvertAll(curves, c => c.DuplicateCurve())
			: offset(curves, radA, out _, tol);


			// ------- Separate BrepFaces ------- //

			Brep[] final_breps = new Brep[count * 3 + 2];
			separate_brepfaces(brep, crvA, Z_up, out Brep brep_half, out final_breps[count * 3 + 1], out _);  //  , out Curve[] pro_crvs, out Point3d[] pro_pts


			// ------- Setup Curves ------- //

			Curve[] crvD = bot_sharp
			? Array.ConvertAll(curves, c => c.DuplicateCurve())
			: offset(curves, radB, out _, tol);

			crvA = Array.ConvertAll(crvA, c => project_closest(c, brep_half, Z_up, tol));
			Curve[] crvB = top_sharp
			? Array.ConvertAll(crvA, c => c.DuplicateCurve())
			: Array.ConvertAll(curves, c => project_closest(c, brep_half, Z_up, tol));

			if (crvA.Length == 1) align_crvs(crvA[0], crvB[0]);
			match_sort_crvs(crvA, crvB);

			Curve[] crvC = Array.ConvertAll(curves, c => c.DuplicateCurve());
			Curve[] crvE = Array.ConvertAll(crvB, c => c.DuplicateCurve());
			Curve[] final_crvsA = Array.ConvertAll(crvB, c => c.DuplicateCurve());


			// ------- Setup Planes ------- //

			Plane base_plane = pln;
			Plane inside_plane = pln;
					Point3d central_pt = curves_central_point(curves, brep, Z_up);

			if (hollow && central_pt.Z == 0) { pl = pln; crv_listA = curves; crv_listB = curves; return brep; }
			if (hollow)
			{    // ------- For Hollow Extrude to Surface (no Extrude Input)
			extrude = central_pt.Z;
			extrude *= (extrude < 0) ? 1 : -1;
			}

			double flip = (extrude < 0) ? -1 : 1;

			base_plane.Origin = central_pt;
			base_plane.Transform(Transform.Translation(0, 0, extrude));   
			double z_move = base_plane.OriginZ;                           

			double inside_z = base_plane.OriginZ - (radii[1] * flip);
			inside_plane.OriginZ = inside_z;
			TransformGeos(crvB, Transform.Translation(0, 0, radii[0] * flip));
			TransformGeos(crvC, Transform.Scale(inside_plane, 1, 1, 0));
			TransformGeos(crvD, Transform.Scale(base_plane, 1, 1, 0));
			TransformGeos(crvE, Transform.Scale(inside_plane, 1, 1, 0));

			Curve[] final_crvsB = Array.ConvertAll(crvC, c => c.DuplicateCurve());
			TransformGeos(final_crvsB, Transform.Scale(base_plane, 1, 1, 0));

			// ------- main loop ------- //

			BlendContinuity curvature = BlendContinuity.Curvature;
			LoftType straight_loft = LoftType.Straight;

			double[] ts = new double[sectors];
			for (int i = 0; i < sectors; i++) ts[i] = i * gap;

			for (int i = 0; i < count; i++)
			{
			bool straight = crvA[i].IsLinear(0.01);

			Curve[] edges_A = new Curve[sectors];
			Curve[] edges_B = new Curve[sectors];

			for (int j = 0; j < sectors; j++)
			{
				bool straight_check = !straight || (straight && (j == 0 || j == sectors - 1));

				if (!top_sharp && straight_check && !top_chamfer)
				{
				crvA[i].NormalizedLengthParameter(ts[j], out double tA, 1E-03);
				Point3d pA = crvA[i].PointAt(tA);
				crvB[i].NormalizedLengthParameter(ts[j], out double tB, 1E-03);
				Point3d pB = crvB[i].PointAt(tB);

				Point3d pE = new (pB.X, pB.Y, inside_z);
				Curve lnA = new LineCurve(pB, pE);
				Vector3d vec = pA - pB;
				vec.Z = 0;

				brep_half.ClosestPoint(pA, out _, out ComponentIndex ci, out _, out _, 0.1, out _);
				BrepFace B_face = brep_half.Faces[ci.Index];
				Curve cx_crv = GetSurfaceProxyCurve(B_face, pA, vec);

				if (IsClose(pA, cx_crv.PointAtStart)) cx_crv.Reverse();
				edges_A[j] = Curve.CreateBlendCurve(cx_crv, lnA, curvature, bulges[0], bulges[0]);
				}

				if (!bot_sharp && straight_check && !bot_chamfer)
				{
				crvC[i].NormalizedLengthParameter(ts[j], out double tC, 1E-03);
				Point3d pC = crvC[i].PointAt(tC);
				Curve lnC =  new LineCurve(new Point3d(pC - Z_up * flip), pC);

				crvD[i].NormalizedLengthParameter(ts[j], out double tD, 1E-03);
				Point3d pD = crvD[i].PointAt(tD);

				Vector3d vec = pD - pC;
				vec.Z = 0;
				Curve lnB = new LineCurve(pD, new Point3d(pD + vec));
				edges_B[j] = Curve.CreateBlendCurve(lnC, lnB, curvature, bulges[1], bulges[1]);
				}
			}

			if (!top_sharp)
			{
				if (straight) final_breps[i] = (top_chamfer)
					? Brep.CreateFromLoft(new[] { crvA[i], crvB[i] }, pu, pu, straight_loft, false)[0]
					: Brep.CreateFromLoft(new[] { edges_A[0], edges_A[sectors - 1] }, pu, pu, straight_loft, false)[0];
				else final_breps[i] = (top_chamfer)
				? Brep.CreateFromLoft(new[] { crvA[i], crvB[i] }, pu, pu, straight_loft, false)[0]
				: edge_srf(crvA[i], crvB[i], edges_A, cross_numA);
			}

			if (!bot_sharp)
			{
				if (straight) final_breps[(count * 2) + i] = (bot_chamfer)
					? Brep.CreateFromLoft(new[] { crvC[i], crvD[i] }, pu, pu, straight_loft, false)[0]
					: Brep.CreateFromLoft(new[] { edges_B[0], edges_B[sectors - 1] }, pu, pu, straight_loft, false)[0];
				else final_breps[(count * 2) + i] = (bot_chamfer)
				? Brep.CreateFromLoft(new[] { crvC[i], crvD[i] }, pu, pu, straight_loft, false)[0]
				: edge_srf(crvC[i], crvD[i], edges_B, cross_numB);
			}

			final_breps[count + i] = Brep.CreateFromLoft(new[] { crvB[i], crvE[i] }, pu, pu, straight_loft, false)[0];
			}


			// ------- Re-Assemble parts ------- //

			final_breps[count * 3] = Brep.CreatePlanarBreps(crvD, 0.001)[0];

			Brep final_brep = BuildFinalBrep(brep_half, crvA, final_breps, false);

			if (remirror)
			{
			final_brep.Transform(mirror);
			brep.Transform(mirror);  //  **** Might need to re-comment this out if soemthing strange happens.  I uncommented it because the other methods did too...

			base_plane.Transform(mirror);
			TransformGeos(final_crvsA, mirror);
			TransformGeos(final_crvsB, mirror);

			//for (int i = 0; i < test_crvs.Count; i++) if (test_crvs[i] != null) test_crvs[i].Transform(mirror);
			}
			else base_plane = new Plane(base_plane.Origin, -Vector3d.ZAxis);

			pl = base_plane; //   Plane.WorldXY;  //  
			crv_listA = final_crvsA; // .Concat(test_crvs).ToArray(); // new[] { new LineCurve(Point3d.Origin, new Point3d(0, 0, 1)) }; // crvA.Concat(crvB).Concat(crvC).Concat(crvD).ToArray(); //  crvD; //
			crv_listB = final_crvsB;

			if (final_brep.SolidOrientation == BrepSolidOrientation.Inward) final_brep.Flip();
			
			return final_brep; // test_box.ToBrep(); // brep_half; // new Brep(); //  
		}


        // ------------------------------------ Basic Extrudes ------------------------------------ //

	private static Brep full_extrude(Curve[] crvs, double extrude, List<double> rads, List<double> bulges, int sectors, bool centre, double tol, out Curve[] crv_listA, out Curve[] crv_listB)
		{
			// List<Curve> test_crvs = new();
	  		sort_crvs(crvs);
			Plane plane = curves_plane(crvs);
			Transform orient = Transform.PlaneToPlane(plane, Plane.WorldXY);
			Transform reorient = Transform.PlaneToPlane(Plane.WorldXY, plane);

			TransformGeos(crvs, orient);

			// -------  Set Up Standard Variables  ------- //

			int count = crvs.Length;
			int v_num = (count == 1) ? v_num = sectors - 1 : sectors;

			bool loop = count == 1 && crvs[0].IsClosed;

			bool mirror = !centre && extrude != Math.Abs(extrude);
			extrude = Math.Abs(extrude);

			// -------  Set Up Radii and Decide if should add Sides  ------- //

			double[] radii = { Math.Max(rads[0], 0), Math.Max(rads[1], 0) };

			bool has_sides = radii[0] < extrude;
			if (!has_sides) { radii[0] = extrude; radii[1] = 0; }
			if (radii[1] > extrude - radii[0])
			{
			radii[1] = extrude - radii[0];
			has_sides = false;
			}

			bool C2arcA = bulges[0] <= -1 && (radii[0] * 1.5) <= extrude - radii[1];
			bool C2arcB = bulges[1] <= -1 && (radii[1] * 1.5) <= extrude - radii[0];
			if (C2arcA) { radii[0] *= 1.5; bulges[0] = 0.72; }
			if (C2arcB) { radii[1] *= 1.5; bulges[1] = 0.72; }

			bool has_radA = radii[0] != 0;
			bool has_radB = radii[1] != 0;


			// -------  Set Up Curves  ------- //

			Curve[] crvA = offset(crvs, -radii[0], out _, tol);
			Curve[] crvB = Array.ConvertAll(crvs, c => c.DuplicateCurve());
			Curve[] crvC = Array.ConvertAll(crvs, c => c.DuplicateCurve());
			Curve[] crvD = offset(crvs, -radii[1], out _, tol);

			if (Math.Abs(crvA[0].PointAtStart.DistanceTo(crvB[0].PointAtStart) - radii[0]) > tol) match_sort_crvs(crvA, crvB);
			if (Math.Abs(crvD[0].PointAtStart.DistanceTo(crvB[0].PointAtStart) - radii[1]) > tol) match_sort_crvs(crvD, crvB);

			Transform moveA = Transform.Translation(0, 0, radii[0]);
			Transform moveB = Transform.Translation(0, 0, radii[1]);
			Transform moveC = Transform.Translation(0, 0, extrude - (radii[1] * 2));
			Transform moveD = Transform.Translation(0, 0, extrude);

			Transform mirror_trans = Transform.Mirror(Plane.WorldXY);
			Transform centre_trans = Transform.Translation(0, 0, -(extrude * 0.5));


			// -------  Setup Output Curves  ------- //

			Curve[] final_crvsA = Array.ConvertAll(crvs, c => c.DuplicateCurve());
			Curve[] final_crvsB = Array.ConvertAll(crvs, c => c.DuplicateCurve());


			// -------  Main Loop - Build Surfaces  ------- //

			Brep[] srfs = new Brep[(count * 3) + 2];
			Curve[] side_crvs = new Curve[2];
			LoftType lt = LoftType.Straight;

			for (int i = 0; i < count; i++)
			{
			crvB[i].Transform(moveA);  // ---- Arrange Curves---- //
			crvC[i].Transform(moveB);
			int edge_num = crvB[i].IsLinear(0.01) ? 2 : sectors;

			if (has_radA)
			{
				int cross_num = (bulges[0] == 0) ? 2 : 4;
				Curve[] edge_curves = simple_edges(crvA[i], crvB[i], bulges[0], edge_num);
				srfs[count + i] = edge_srf(crvA[i], crvB[i], edge_curves, cross_num);
			}

			if (has_radB)
			{
				int cross_num = (bulges[1] == 0) ? 2 : 4;
				Curve[] edge_curves = simple_edges(crvD[i], crvC[i], bulges[1], edge_num);
				srfs[(count * 2) + i] = edge_srf(crvD[i], crvC[i], edge_curves, cross_num);
				srfs[(count * 2) + i].Transform(mirror_trans);
				srfs[(count * 2) + i].Transform(moveD);
			}

			crvC[i].Transform(moveC);

			if (has_sides)
			{
					side_crvs[0] = crvB[i];
					side_crvs[1] = crvC[i];
					srfs[i] = Brep.CreateFromLoft(side_crvs, pu, pu, lt, false)[0];
				}
			final_crvsB[i].Transform(moveD);
			}

			srfs[count * 3] = Brep.CreatePlanarBreps(crvA, 0.01)[0];
			srfs[(count * 3) + 1] = Brep.CreatePlanarBreps(crvD, 0.01)[0];
			srfs[(count * 3) + 1].Transform(moveD);

			Brep brep = Brep.JoinBreps(srfs, 0.1, 0.1)[0];

				if (mirror) { 
					brep.Transform(mirror_trans); 
					TransformGeos(final_crvsA, mirror_trans);
					TransformGeos(final_crvsB, mirror_trans);
				}
				if (centre) { 
					brep.Transform(centre_trans); 
					TransformGeos(final_crvsA, centre_trans);
					TransformGeos(final_crvsB, centre_trans);
				}

			brep.Transform(reorient);
			TransformGeos(final_crvsA, reorient);
			TransformGeos(final_crvsB, reorient);

			crv_listA = final_crvsA;
			crv_listB = final_crvsB;
			return brep; // new Brep();// 
		}
		
	private static Brep quick_extrude(Curve[] crvs, double extrude, double radius, double bulge, int sectors, bool centre, double tol, out Curve[] crv_listA, out Curve[] crv_listB)
	{
		// -------  Set Up Conditions  ------- //
		// List<Curve> test_crvs = new();

		int count = crvs.Length;
		bool loop = count == 1 && crvs[0].IsClosed;
		bool mirror = !centre && extrude != Math.Abs(extrude);
		extrude = Math.Abs(extrude);
		int cross_num = (bulge == 0) ? 2 : 4;

		bool has_sides = radius < extrude * 0.5;
		if (!has_sides) radius = extrude * 0.5;

		bool C2arc = bulge <= -1 && (radius * 3) + tol < extrude; // bulge is less than one and does not make the radius bigger than half the extrude
		if (C2arc)
		{
		radius *= 1.5;
		bulge = 0.72;
		}

		// -------  Set Up Standard Variables  ------- //

		Curve[] crvA = offset(crvs, -radius, out _, tol);

		// test_crvs.AddRange(crvA);

		Curve[] crvC = Array.ConvertAll(crvs, c => c.DuplicateCurve());
		if (Math.Abs(crvA[0].PointAtStart.DistanceTo(crvs[0].PointAtStart) - radius) > tol) match_sort_crvs(crvA, crvs);

		Transform moveB = Transform.Translation(0, 0, radius);
		Transform moveC = Transform.Translation(0, 0, extrude - radius);
		Transform moveD = Transform.Translation(0, 0, extrude);
		Transform moveC2 = Transform.Translation(0, 0, radius);

		Transform mirror_trans = Transform.Mirror(Plane.WorldXY);
		Transform centre_trans = Transform.Translation(0, 0, -(extrude * 0.5));


		// -------  Setup Output Curves  ------- //

		Curve[] final_crvsA = Array.ConvertAll(crvs, c => c.DuplicateCurve());
		Curve[] final_crvsB = Array.ConvertAll(crvs, c => c.DuplicateCurve());


		// -------  Main Loop - Build Surfaces  ------- //

		Brep[] srfs = new Brep[(count * 3) + 2];

		LoftType lt = LoftType.Straight;
		Curve[] crv_sides = new Curve[2];

		for (int i = 0; i < count; i++)
		{
			bool straight = crvs[i].IsLinear(0.01);
			crvs[i].Transform(moveB);  // ---- Arrange Curves---- //
			crvC[i].Transform(moveC);
			crv_sides[0] = crvs[i];
			crv_sides[1] = crvC[i];
		if (has_sides) srfs[i] = Brep.CreateFromLoft(crv_sides, pu, pu, lt, false)[0];
			srfs[i].Flip();
			int edge_num = straight ? 2 : sectors;

		Curve[] edges = simple_edges(crvA[i], crvs[i], bulge, edge_num);
		srfs[count + i] = edge_srf(crvs[i], crvA[i], edges, cross_num);

		srfs[(count * 2) + i] = srfs[count + i].DuplicateBrep();
		srfs[(count * 2) + i].Transform(mirror_trans);
		srfs[(count * 2) + i].Transform(moveD);
		
		final_crvsB[i].Transform(moveD);
		//test_crvs.AddRange(edges);
		}

		// Curve[] tc = test_crvs.ToArray();

		srfs[count * 3] = Brep.CreatePlanarBreps(crvA, 0.001)[0];
		srfs[(count * 3) + 1] = srfs[count * 3].DuplicateBrep();
		srfs[(count * 3) + 1].Transform(moveD);

		Brep brep = Brep.JoinBreps(remove_nulls(srfs), 0.001, 0.1)[0];

		if (mirror)
		{
			brep.Transform(mirror_trans);
			TransformGeos(final_crvsA, mirror_trans);
			TransformGeos(final_crvsB, mirror_trans);
		}
		if (centre)
		{
			brep.Transform(centre_trans);
			TransformGeos(final_crvsA, centre_trans);
			TransformGeos(final_crvsB, centre_trans);
		}

		crv_listA = final_crvsA;
		crv_listB = final_crvsB;
		return brep;
	}

private static Brep capped_extrude(Curve[] crvs, out Curve[] crv_listA, out Curve[] crv_listB, double length = 5.0, bool centre = false)
  {
    int count = crvs.Length;
	Plane pl = curves_plane(crvs);
    Vector3d dir = pl.Normal * length;
	Transform move = Transform.Translation(dir);
	if (centre)
	{
		TransformGeos(crvs, Transform.Translation(-dir * 0.5));
		pl.Transform(Transform.Translation(-dir * 0.5));
	}

	Curve[] final_crvsA = Array.ConvertAll(crvs, c => c.DuplicateCurve());
	Curve[] final_crvsB = Array.ConvertAll(crvs, c => c.DuplicateCurve());
	TransformGeos(final_crvsB, move);

    Brep[] sides = new Brep[count + 2];
	LoftType lt = LoftType.Straight;
	Curve[] crv_sides = new Curve[2];
    for (int i = 0; i < count; i++)
    {
		crv_sides[0] = final_crvsA[i];
		crv_sides[1] = final_crvsB[i];
		sides[i + 1] = Brep.CreateFromLoft(crv_sides, pu, pu, lt, false)[0]; // Surface.CreateExtrusion(crvs[i], dir).ToBrep();
    }
	sides[0] = Brep.CreatePlanarBreps(crvs, 0.001)[0];
    sides[count + 1] = sides[0].DuplicateBrep();
    sides[count + 1].Transform(move);

    Brep body = Brep.JoinBreps(sides, 0.001, 0.1)[0];
    if (body.SolidOrientation == BrepSolidOrientation.Inward) body.Flip();

            crv_listA = final_crvsA;
            crv_listB = final_crvsB;
    return body;
  }


	// ------------------------------------ Sub Constructions ------------------------------------ //

	private static Brep BuildFinalBrep(Brep brep_half, Curve[] curves, Brep[] final_breps, bool inside = false)
        {
            Brep[] final_joined = Brep.JoinBreps(final_breps, 0.001, 0.1);
            if (final_joined.Length > 1) final_joined = Brep.JoinBreps(final_joined, 0.01, 0.1);

            BoundingBox test_box = bb_union(curves, 0.1);

            Brep[] split = brep_half.Split(curves, 0.001);
            int spl_len = split.Length;
            int fj_len = final_joined.Length;

            int maxCount = spl_len + fj_len;
            Brep[] pieces = new Brep[maxCount];
            int piece_count = 0;

            for (int i = 0; i < spl_len; ++i)
            {
                bool condition = boxboxinside2D(test_box, split[i].GetBoundingBox(true));
                if ((inside && condition) || (!inside && !condition)) pieces[piece_count++] = split[i];
            }

            for (int i = 0; i < fj_len; ++i) pieces[piece_count++] = final_joined[i];

            Brep[] joined = Brep.JoinBreps(remove_nulls(pieces), 0.001, 0.1);
            if (joined.Length > 1 || !joined[0].IsSolid) joined = Brep.JoinBreps(joined, 0.01, 0.1);

            return joined[0];
        }

        private static Brep BuildFinalBrep(Brep brep_halfA, Curve[] curves_A, Brep brep_halfB, Curve[] curves_B, Brep[] final_breps, bool inside = false)
        {
            // First join the existing final breps
            Brep[] final_joined = Brep.JoinBreps(final_breps, 0.001, 0.1);

            // Compute bounding boxes for each curve set
            BoundingBox test_boxA = bb_union(curves_A, 0.1);
            BoundingBox test_boxB = bb_union(curves_B, 0.1);

            // Split each half with its curve set
            Brep[] splitA = brep_halfA.Split(curves_A, 0.01);
            Brep[] splitB = brep_halfB.Split(curves_B, 0.01);

            int spl_A_len = splitA.Length;
            int spl_B_len = splitB.Length;
            int fj_len = final_joined.Length;

            int maxCount = spl_A_len + spl_B_len + fj_len;
            Brep[] pieces = new Brep[maxCount];
            int piece_count = 0;

            // Collect pieces from splitA
            for (int i = 0; i < spl_A_len; ++i)
            {
                bool condition = boxboxinside2D(test_boxA, splitA[i].GetBoundingBox(true));
                if ((inside && condition) || (!inside && !condition)) pieces[piece_count++] = splitA[i];
            }

            // Collect pieces from splitB
            for (int i = 0; i < spl_B_len; ++i)
            {
                bool condition = boxboxinside2D(test_boxB, splitB[i].GetBoundingBox(true));
                if ((inside && condition) || (!inside && !condition))
                    pieces[piece_count++] = splitB[i];
            }

            // Add existing final breps
            for (int i = 0; i < fj_len; ++i) pieces[piece_count++] = final_joined[i];

            // Remove nulls and join
            Brep[] joined = Brep.JoinBreps(remove_nulls(pieces), 0.001, 0.1);
            if (joined.Length > 1 || !joined[0].IsSolid) joined = Brep.JoinBreps(joined, 0.01, 0.1);

            return joined[0];
        }



	// ------------------------------------ Updated Needs Checking ------------------------------------ //

	private static void align_crvs(Curve crvA, Curve crvB)
		{
			if (crvA.PointAtStart.DistanceToSquared(crvB.PointAtStart) > crvA.PointAtStart.DistanceToSquared(crvB.PointAtEnd)) crvB.Reverse();
		}



  // ------------------------------------ Optimized Already ------------------------------------ //


	private static Point3d project_point(Point3d pt, Brep brep, Vector3d direction) // Optimised
	{
		pt = new Point3d(pt - direction);
		Point3d[] pts = Intersection.RayShoot(new Ray3d(pt, direction), new[] { brep }, 1);
		return pts[0];
	}


  private static Point3d curves_central_point(Curve[] curves, Brep brep, Vector3d direction)
  {
      double minZ = double.MaxValue;                     // initialise to largest possible value

      for (int i = 0, n = curves.Length; i < n; ++i)
      {
          double projZ = project_point(curves[i].PointAtMid, brep, direction).Z;          // project the curve’s midpoint onto the brep and get its Z‑value
          if (projZ < minZ) minZ = projZ;                // keep the smallest Z seen
      }
      return new Point3d(0.0, 0.0, minZ);
  }


  private static Curve project_closest(Curve crv, Brep brep, Vector3d dir, double tol)  // Optimised
  {
    crv.Transform(Transform.Translation(-dir));
    Curve[] projected_curves = Curve.ProjectToBrep(crv, brep, dir, tol);
    Curve[] projected_joined = Curve.JoinCurves(projected_curves, tol, false);

    Point3d centre = crv.PointAtMid;
    int closestIndex = 0;
    double minDistance = double.MaxValue;

    for (int i = 0; i < projected_joined.Length; i++)
    {
      double distance = centre.DistanceToSquared(projected_joined[i].PointAtMid);
      if (distance < minDistance)
      {
        minDistance = distance;
        closestIndex = i;
      }
    }

    return projected_joined[closestIndex];
  }
  
  private static Brep edge_srf(Curve top, Curve bottom, Curve[] edge_curves, int num, bool loop = false, double tol = 0.001)
  {
    if (num < 3 || edge_curves == null)
    {
      return Brep.CreateFromLoft(new[] { top, bottom }, pu, pu, LoftType.Straight, false)[0];
    }

    double ang_tol = 0.1;
    double cos_tol = Math.Cos(ang_tol);

    Vector3d[] axes = new Vector3d[] { Vector3d.XAxis, -Vector3d.XAxis, Vector3d.YAxis, -Vector3d.YAxis, Vector3d.ZAxis, -Vector3d.ZAxis };

    Vector3d start = top.TangentAtStart;
    Vector3d end = top.TangentAtEnd;
    for (int i = 0; i < 6; i++)
    {
      if (start * axes[i] > cos_tol) { start = axes[i]; break; }
    }
    for (int i = 0; i < 6; i++)
    {
      if (end * axes[i] > cos_tol) { end = axes[i]; break; }
    }

    int count = edge_curves.Length;
    double gap = 1 / (num - 1.0);

    Curve[] curves = new Curve[num];

    if (IsClose(edge_curves[0].PointAtStart, top.PointAtStart) || IsClose(edge_curves[0].PointAtStart, top.PointAtEnd))
         { curves[0] = top; curves[num - 1] = bottom; }
    else { curves[0] = bottom; curves[num - 1] = top; }


    int pt_num = loop ? count + 1 : count;
    Point3d[] edge_mid_pts = new Point3d[pt_num];

    // Pre-calculate parameters
    double[,] parameters = new double[num, count];
    for (int i = 1; i < num - 1; i++)
    {
        double gap_size = gap * i;
        for (int j = 0; j < count; j++) edge_curves[j].NormalizedLengthParameter(gap_size, out parameters[i, j], 1E-03);
    }

    for (int i = 1; i < num - 1; i++)
    {
      for (int j = 0; j < count; j++)
      {
        edge_mid_pts[j] = edge_curves[j].PointAt(parameters[i, j]);
      }

      if (loop) edge_mid_pts[count] = edge_mid_pts[0];

      Curve edge_mid = Curve.CreateInterpolatedCurve(edge_mid_pts, 3, CurveKnotStyle.Uniform, start, end);
      if (loop) 
      {
        if (edge_mid.IsCircle(0.01)) edge_mid = new ArcCurve(new Circle(edge_mid_pts[0], edge_mid_pts[1], edge_mid_pts[2])); //circle_check(edge_mid, edge_mid_pts);
        else edge_mid = square_crv(edge_mid);
      }
      else edge_mid = square_crv(edge_mid);
      curves[i] = edge_mid;
    }

    if (top.IsClosed) Array.Resize(ref edge_curves, edge_curves.Length - 1);

    NurbsSurface surface = NurbsSurface.CreateNetworkSurface(curves, 3, 3, edge_curves, 3, 3, tol, tol, tol, out _);
    surface ??= NurbsSurface.CreateNetworkSurface(new[] { top, bottom }, 3, 3, edge_curves, 3, 3, tol, tol, tol, out _);

    return surface.ToBrep(); // new Brep(); //
  }  // optimized
  
  private static Curve[] simple_edges(Curve crvA, Curve crvB, double bulge, int sectors)
	{
		double gap = 1.0 / (sectors - 1.0);
		Point3d[] ptsA = new Point3d[sectors];
		Point3d[] ptsB = new Point3d[sectors];
		for (int i = 0; i < sectors; ++i)
		{
			double t = gap * i;
      		crvA.NormalizedLengthParameter(t, out double tA, 1E-03);
			ptsA[i] = crvA.PointAt(tA);
      		crvB.NormalizedLengthParameter(t, out double tB, 1E-03);
			ptsB[i] = crvB.PointAt(tB);
		}

		Curve[] edge_curves = new Curve[sectors];

		// Output Chamfers    
            if (bulge == 0)
            {
                for (int i = 0; i < sectors; ++i) edge_curves[i] = new LineCurve(ptsA[i], ptsB[i]);
				return edge_curves;
			}

		// Output Arcs
            if (bulge < 0)
            {
                for (int i = 0; i < sectors; ++i) edge_curves[i] = new ArcCurve(new Arc(ptsB[i], -Vector3d.ZAxis, ptsA[i]));
				return edge_curves;
			}

		// Output Blends
		//Curve side_ln = new LineCurve(new Point3d(0, 0, 1), Point3d.Origin);
			for (int i = 0; i < sectors; ++i)
			{
				Vector3d vec = ptsA[i] - ptsB[i];
				vec.Z = 0;
				Curve crv0 = new LineCurve(ptsA[i], ptsA[i] + vec);

				Curve side_ln = new LineCurve(new Point3d(ptsB[i].X, ptsB[i].Y, ptsB[i].Z + 1), ptsB[i]);
				edge_curves[i] = Curve.CreateBlendCurve(side_ln, crv0, BlendContinuity.Curvature, bulge, bulge);

			}
		return edge_curves;
	}
  

// ------------------------------------ Copied from ID_Tools_Library.ID_Tools_Class ------------------------------------ //
  




	// public static Curve[] offset(Curve[] curves, double fillet, out Plane pln, double tol = 0.01, double arc_tol = 0.05)
	// {
	// 	int num = curves.Length;
	// 	Plane plane = curves_plane(curves);
	// 	pln = orient_plane(plane);
	// 	Point3d origin = plane.Origin;
	// 	Vector3d normal = plane.Normal;
	// 	CurveOffsetCornerStyle cornerStyle = CurveOffsetCornerStyle.Smooth;
	// 	CurveOffsetEndStyle endStyle = CurveOffsetEndStyle.None;
	// 	Curve[] array = new Curve[num];
	// 	if (fillet == 0.0)
	// 	{
	// 		for (int i = 0; i < num; i++)
	// 		{
	// 			array[i] = curves[i].DuplicateCurve();
	// 		}
	// 		return array;
	// 	}
	// 	if (num == 1)
	// 	{
	// 		bool loose = !arc_test(curves[0]);
	// 		Curve[] array2 = curves[0].Offset(origin, normal, fillet, tol, tol, loose, cornerStyle, endStyle);
	// 		if (curves[0].IsClosed)
	// 		{
	// 			double length = curves[0].GetBoundingBox(accurate: true).Diagonal.Length;
	// 			GeometryBase[] geos = array2;
	// 			double length2 = bb_union(geos).Diagonal.Length;
	// 			if ((fillet > 0.0 && length2 < length) || (fillet < 0.0 && length2 > length))
	// 			{
	// 				fillet = 0.0 - fillet;
	// 				array2 = curves[0].Offset(origin, normal, fillet, tol, tol, loose, cornerStyle, endStyle);
	// 			}
	// 		}
	// 		return array2;
	// 	}
	// 	bool flag = IsClose(curves[0].PointAtStart, curves[^1].PointAtEnd);
	// 	for (int j = 0; j < num; j++)
	// 	{
	// 		Curve[] array3 = curves[j].Offset(origin, normal, 0.0 - fillet, tol, tol, loose: false, cornerStyle, endStyle);
	// 		array[j] = ((array3.Length > 1) ? Curve.JoinCurves(array3, tol, preserveDirection: false)[0] : array3[0]);
	// 	}
	// 	if (flag)
	// 	{
	// 		GeometryBase[] geos = curves;
	// 		double length3 = bb_union(geos).Diagonal.Length;
	// 		geos = array;
	// 		double length4 = bb_union(geos).Diagonal.Length;
	// 		if ((fillet > 0.0 && length4 < length3) || (fillet < 0.0 && length4 > length3))
	// 		{
	// 			fillet = 0.0 - fillet;
	// 			for (int k = 0; k < num; k++)
	// 			{
	// 				Curve[] array4 = curves[k].Offset(origin, normal, 0.0 - fillet, tol, tol, loose: false, cornerStyle, endStyle);
	// 				array[k] = ((array4.Length > 1) ? Curve.JoinCurves(array4, tol, preserveDirection: false)[0] : array4[0]);
	// 			}
	// 		}
	// 	}
	// 	array = loop_crv(array, fillet, flag);
	// 	clean_offset(array);
	// 	return array;
	// }

	// public static Curve[] loop_crv(Curve[] curves, double radius, bool closed_loop = true, double tol = 0.0001, double arc_tol = 0.03)
	// {
	// 	int num = curves.Length;
	// 	double length = Math.Abs(radius) * 1.1;
	// 	int num2 = (closed_loop ? num : (num - 1));



	// 	Console.WriteLine(" - " + curves[2].GetLength().ToString());
	// 	for (int i = 0; i < num2; i++)
	// 	{
	// 		int num3 = (closed_loop ? ((i + 1) % num) : (i + 1));
	// 		Console.WriteLine(i.ToString() + ", " + num3.ToString());
	// 		if (!IsClose(curves[i].PointAtEnd, curves[num3].PointAtStart))
	// 		{
	// 			Curve curve = curves[i].Extend(CurveEnd.End, length, CurveExtensionStyle.Smooth);
	// 			Curve curve2 = curves[num3].Extend(CurveEnd.Start, length, CurveExtensionStyle.Smooth);
	// 			CurveIntersections curveIntersections = Intersection.CurveCurve(curve, curve2, tol, tol);
	// 			if (curveIntersections != null && curveIntersections.Count != 0)
	// 			{
	// 				curves[i] = curve.Trim(curve.Domain.Min, curveIntersections[0].ParameterA);
	// 				curves[num3] = curve2.Trim(curveIntersections[0].ParameterB, curve2.Domain.Max);
	// 			}
	// 		}
	// 	}
	// 	for (int j = 0; j < num; j++)
	// 	{
	// 		Vector3d tangentAtStart = curves[j].TangentAtStart;
	// 		Vector3d tangentAtEnd = curves[j].TangentAtEnd;
	// 		Point3d pointAtStart = curves[j].PointAtStart;
	// 		Point3d pointAtEnd = curves[j].PointAtEnd;
	// 		if (IsCloseVec(tangentAtStart, tangentAtEnd) && curves[j].IsLinear(0.01))
	// 		{
	// 			curves[j] = new LineCurve(pointAtStart, pointAtEnd);
	// 		}
	// 		else if (arc_test(curves[j], arc_tol))
	// 		{
	// 			Curve curve3 = new ArcCurve(new Arc(pointAtStart, curves[j].PointAtMid, pointAtEnd));
	// 			if (IsCloseVec(tangentAtStart, curve3.TangentAtStart) && IsCloseVec(tangentAtEnd, curve3.TangentAtEnd))
	// 			{
	// 				curves[j] = curve3;
	// 			}
	// 		}
	// 		else
	// 		{
	// 			if (!(curves[j].CurvatureAt(curves[j].Domain.Mid).SquareLength > 200.0) && !(curves[j] is PolyCurve))
	// 			{
	// 				continue;
	// 			}
	// 			curves[j] = curves[j].Smooth(0.5, bXSmooth: true, bYSmooth: true, bZSmooth: true, bFixBoundaries: true, SmoothingCoordinateSystem.World, Plane.WorldXY);
	// 			BoundingBox boundingBox = curves[j].GetBoundingBox(accurate: true);
	// 			double num4 = boundingBox.Max.X - boundingBox.Min.X;
	// 			double num5 = boundingBox.Max.Y - boundingBox.Min.Y;
	// 			double num6 = Math.Sqrt(num4 * num4 + num5 * num5) * 0.005;
	// 			if (num6 < 0.001)
	// 			{
	// 				num6 = 0.001;
	// 			}
	// 			int degree = curves[j].Degree;
	// 			Point3d[] array = rebuild_crv_pts(curves[j], 7);
	// 			int num7 = array.Length;
	// 			double x = boundingBox.Min.X;
	// 			double y = boundingBox.Min.Y;
	// 			double z = boundingBox.Min.Z;
	// 			double x2 = boundingBox.Max.X;
	// 			double y2 = boundingBox.Max.Y;
	// 			double z2 = boundingBox.Max.Z;
	// 			for (int k = 0; k < num7; k++)
	// 			{
	// 				double num8 = array[k].X;
	// 				double num9 = array[k].Y;
	// 				double num10 = array[k].Z;
	// 				if (num8 < x + num6)
	// 				{
	// 					num8 = x;
	// 				}
	// 				else if (num8 > x2 - num6)
	// 				{
	// 					num8 = x2;
	// 				}
	// 				if (num9 < y + num6)
	// 				{
	// 					num9 = y;
	// 				}
	// 				else if (num9 > y2 - num6)
	// 				{
	// 					num9 = y2;
	// 				}
	// 				if (num10 < z + num6)
	// 				{
	// 					num10 = z;
	// 				}
	// 				else if (num10 > z2 - num6)
	// 				{
	// 					num10 = z2;
	// 				}
	// 				array[k].X = num8;
	// 				array[k].Y = num9;
	// 				array[k].Z = num10;
	// 			}
	// 			curves[j] = Curve.CreateControlPointCurve(array, degree);
	// 		}
	// 	}
	// 	return curves;
	// }



	public static Plane orient_plane(Plane plane)
	{
		const double tol = 0.01;
		Vector3d z = plane.ZAxis;

		if (IsCloseVec(z, Vector3d.ZAxis, false, tol))
		{ 			Console.WriteLine("0");
			return new Plane(plane.Origin, Vector3d.XAxis, Vector3d.YAxis);// Z ≈ +World_Z
		}

		if (IsCloseVec(z, -Vector3d.ZAxis, false, tol))
		{			Console.WriteLine("1");
			return new Plane(plane.Origin, Vector3d.XAxis, -Vector3d.YAxis);  // Z ≈ -World_Z  (bidirectional check true covers both ±, then sign decides)
		}
		Console.WriteLine("2");
		Vector3d z_cross = Vector3d.CrossProduct(Vector3d.ZAxis, z);

		Vector3d refX = Vector3d.CrossProduct(z, z_cross); refX.Unitize();
		Vector3d refY = Vector3d.CrossProduct(z, refX); refY.Unitize();

		if (refY.Z < 0.0) refX = -refX;

		Vector3d x, y;
		if (Math.Abs(refX.Z) < 0.5)
		{
			x = refX;
			y = Vector3d.CrossProduct(x, z); y.Unitize();
		}
		else
		{
			y = refX;
			x = Vector3d.CrossProduct(y, z); x.Unitize();
		}

		if (y.Z < 0.0) { x = -x; y = -y; }

		return new Plane(plane.Origin, x, y);
	}







// ------------------------------------ Helpers ------------------------------------ //

private bool no_input(string name)
    {
    int i = Component.Params.IndexOfInputParam(name);
    return i < 0 || Component.Params.Input[i].SourceCount == 0 || Component.Params.Input[i].VolatileDataCount == 0;
    }

public static Interval interval = new(0, 1);
public static Point3d pu = Point3d.Unset;

Vector3d Z_up = Vector3d.ZAxis;
}
# ---------- end extrude_punch_4 ----------
distribute_2 = Distribute(Geometry=entwine, Y=Slider(1.1, range=0..10), align=False, centre=0, order=True)  # -> Geometry, Moves, Notes
join = BrepJoin(Breps=flatten([locate_2.Body, size.Piece, place_2.Geometry]))  # -> Breps, Closed
locate_7 = Locate(
    Geometry=split_brep_3.Breps,
    Face=Slider(0, range=0..10),
    InsetU=0,
    InsetV=Slider(0, range=0..100),
    OffsetW=0,
    box=False,
    simple=False)  # -> Plane, Surface, Edges, Body, Notes
pill_2 = Pill(X=8.5, Y=2.5, p_width=False, smooth=False)  # -> Curves, Joined, Pivots
locate_8 = Locate(
    Geometry=geo_5,
    Position=[Slider(0, range=0..100), Slider(2, range=0..10), Slider(6, range=0..10), Slider(8, range=0..10)],
    InsetU=number_slider_13,
    InsetV=number_slider_13,
    OffsetW=0,
    box=True,
    simple=False)  # -> Plane, Surface, Edges, Body, Notes
surface = Surface(Curves=distribute_2.Geometry, s=0)
place_5 = Place(Geometry=pill_2.Curves, Plane=locate_7.Plane)  # -> Geometry, Transform
cylinder = Cylinder(
    TopAndBottomRadius=Slider(5, range=0..10),
    Height=Slider(1.2, range=0..10),
    Sections=1,
    Fillets=[Slider(0.33, range=0..1), Slider(0.05, range=0..1)],
    CapEnds=True,
    Centre=False,
    s=2)  # -> Brep, Profile, Circles, Arcs
place_6 = Place(Geometry=cylinder.Brep, Plane=locate_8.Plane)  # -> Geometry, Transform
extrude_indent_7 = ExtrudeIndent(
    Curves=place_5.Geometry,
    Brep=extrude_indent_6.Breps,
    Fillets=Slider(0.1, range=0..0.1),
    Extrude=Slider(5.5, range=0..10),
    Inset=0,
    Flip=False,
    s=4)  # -> Breps, Planes, EdgesA, EdgesB, Notes
usb_c_connectors = Brep([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])
usb_c_tongue = Brep(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)
place_7 = Place(Geometry=surface, Plane=locate_6.Plane)  # -> Geometry, Transform
geo_7 = Geometry([volcano_curved.Brep, geo_4, place_6.Geometry])
place_8 = Place(Geometry=usb_c_tongue, Plane=extrude_indent_7.Planes)  # -> Geometry, Transform
place_9 = Place(Geometry=usb_c_connectors, Plane=extrude_indent_7.Planes)  # -> Geometry, Transform
N = Nudge(Geometry=place_7.Geometry, AxisIdx=1, ValIdx=3)
geo_8 = Geometry([extrude_indent_7.Breps, place_8.Geometry, place_9.Geometry])
upper = Geometry(extrude_indent_5.Breps)
logo = Geometry(N)
base = Geometry(join.Breps)
top = Geometry(extrude_indent_4.Breps)
